# Grasshopper definition AIStructureGenerator.gh (Grasshopper 1.0.7)

list = ValueList({"DragonflyWings", "DamselflyWings", "GrasshopperWings", "AmazonWaterLily", "AutoMode"}, selected="DragonflyWings")
form_boundary = Curve(<curve referenced from the Rhino model>)
select_mode = Select_mode(G=form_boundary, mode=list)
generate_input_image = Generate_Input_Image(txt=select_mode, crv=form_boundary, run=Toggle(False))  # -> file_path, pt_7, pt_5, pt_6
generate_force_image = GhPythonScript(type=select_mode, file_path=generate_input_image.file_path, run=Toggle(False))  # -> out, file_path; inputs run: Boolean
# ---------- generate_force_image: Python ----------
__author__ = "Platina"
__version__ = "2021.07.19"

#encoding=utf-8
import os
import shutil
import rhinoscriptsyntax as rs
from subprocess import Popen, PIPE
DETACHED_PROCESS = 0x00000008

import ghpythonlib.components as gh

if run:
    
    if type=="DragonflyWings":
        os.system("cd C:\\AIStructureGenerator && C: && python test.py --name fmb_to_fcb --dataroot ./datasets/fmb_to_fcb/ --no_instance --label_nc 0 --loadSize 1000 --fineSize 1000 --resize_or_crop none --how_many 1 --gpu_ids 0")
        shutil.copy(r'C:\\AIStructureGenerator\\results\\fmb_to_fcb\\test_latest\\images\\test_synthesized_image.jpg', r'C:\\AIStructureGenerator\\datasets\\fcb_to_fc\\test_A\\test.jpg')
        os.system("cd C:\\AIStructureGenerator && C: && python test.py --name fcb_to_fc --dataroot ./datasets/fcb_to_fc/ --no_instance --label_nc 0 --loadSize 1000 --fineSize 1000 --resize_or_crop none --how_many 1 --gpu_ids 0")
        shutil.copy(r'C:\\AIStructureGenerator\\results\\fcb_to_fc\\test_latest\\images\\test_synthesized_image.jpg', r'C:\\AIStructureGenerator\\datasets\\fc_to_fcg\\test_A\\test.jpg')
        os.system("cd C:\\AIStructureGenerator && C: && python test.py --name fc_to_fcg --dataroot ./datasets/fc_to_fcg/ --no_instance --label_nc 0 --loadSize 1000 --fineSize 1000 --resize_or_crop none --how_many 1 --gpu_ids 0")
        shutil.copy(r'C:\\AIStructureGenerator\\results\\fc_to_fcg\\test_latest\\images\\test_synthesized_image.jpg', r'C:\\AIStructureGenerator\\results\\result.jpg')
    elif type=="DamselflyWings":
        os.system("cd C:\\AIStructureGenerator && C: && python test.py --name Damselfly_1 --dataroot ./datasets/Damselfly_1/ --no_instance --label_nc 0 --loadSize 1000 --fineSize 1000 --resize_or_crop none --how_many 1 --gpu_ids 0")
        shutil.copy(r'C:\\AIStructureGenerator\\results\\Damselfly_1\\test_latest\\images\\test_synthesized_image.jpg', r'C:\\AIStructureGenerator\\datasets\\Damselfly_2\\test_A\\test.jpg')
        os.system("cd C:\\AIStructureGenerator && C: && python test.py --name Damselfly_2 --dataroot ./datasets/Damselfly_2/ --no_instance --label_nc 0 --loadSize 1000 --fineSize 1000 --resize_or_crop none --how_many 1 --gpu_ids 0")
        shutil.copy(r'C:\\AIStructureGenerator\\results\\Damselfly_2\\test_latest\\images\\test_synthesized_image.jpg', r'C:\\AIStructureGenerator\\results\\result.jpg')
    elif type=="GrasshopperWings":
        os.system("cd C:\\AIStructureGenerator && C: && python test.py --name GH_1 --dataroot ./datasets/GH_1/ --no_instance --label_nc 0 --loadSize 1000 --fineSize 1000 --resize_or_crop none --how_many 1 --gpu_ids 0")
        shutil.copy(r'C:\\AIStructureGenerator\\results\\GH_1\\test_latest\\images\\test_synthesized_image.jpg', r'C:\\AIStructureGenerator\\datasets\\GH_2\\test_A\\test.jpg')
        os.system("cd C:\\AIStructureGenerator && C: && python test.py --name GH_2 --dataroot ./datasets/GH_2/ --no_instance --label_nc 0 --loadSize 1000 --fineSize 1000 --resize_or_crop none --how_many 1 --gpu_ids 0")
        shutil.copy(r'C:\\AIStructureGenerator\\results\\GH_2\\test_latest\\images\\test_synthesized_image.jpg', r'C:\\AIStructureGenerator\\results\\result.jpg')
    elif type=="AmazonWaterLily":
        os.system("cd C:\\AIStructureGenerator && C: && python test.py --name AWL_1 --dataroot ./datasets/AWL_1/ --no_instance --label_nc 0 --loadSize 1000 --fineSize 1000 --resize_or_crop none --how_many 1 --gpu_ids 0")
        shutil.copy(r'C:\\AIStructureGenerator\\results\\AWL_1\\test_latest\\images\\test_synthesized_image.jpg', r'C:\\AIStructureGenerator\\datasets\\AWL_2\\test_A\\test.jpg')
        os.system("cd C:\\AIStructureGenerator && C: && python test.py --name AWL_2 --dataroot ./datasets/AWL_2/ --no_instance --label_nc 0 --loadSize 1000 --fineSize 1000 --resize_or_crop none --how_many 1 --gpu_ids 0")
        shutil.copy(r'C:\\AIStructureGenerator\\results\\AWL_2\\test_latest\\images\\test_synthesized_image.jpg', r'C:\\AIStructureGenerator\\results\\result.jpg')
        
    file_path = 'C:\\AIStructureGenerator\\results\\result.jpg'
# ---------- end generate_force_image ----------
place_force_image = GhPythonScript(
    pt1=generate_input_image.pt_7,
    pt2=generate_input_image.pt_5,
    pt3=generate_input_image.pt_6,
    file_path=generate_force_image.file_path,
    run=Toggle(False))  # inputs pt1: Point3d, pt2: Point3d, pt3: Point3d, run: Boolean
# ---------- place_force_image: Python ----------
__author__ = "Platina"
__version__ = "2021.07.19"

import rhinoscriptsyntax as rs

if run:
    
    cmd = "_-Pictureframe " + file_path + " " + "3Point" + " " + str(pt1) + " " + str(pt2) + " " + str(pt3) + " " + " _EnterEnd"
    
    rs.Command(cmd, True)
# ---------- end place_force_image ----------
generate_force_geometry = Generate_Force_Geometry(
    pt=generate_input_image.pt_7,
    pt_2=generate_input_image.pt_5,
    pt_3=generate_input_image.pt_6,
    txt=generate_force_image.file_path,
    bool=Toggle(False))
force_geometry = Curve([<curve referenced from the Rhino model> x1512])
generate_dual = Generate_Dual(crv=force_geometry, bool=Toggle(False))
generate_ann_input = Generate_ANN_Input(crv=generate_dual, bool=Toggle(False))
generate_form_length = GhPythonScript(type=select_mode, file_path=generate_ann_input, run=Toggle(False))  # -> out, file_path; inputs run: Boolean
# ---------- generate_form_length: Python ----------
__author__ = "Platina"
__version__ = "2021.07.19"

#encoding=utf-8
import os
import rhinoscriptsyntax as rs
DETACHED_PROCESS = 0x00000010

if run:
    
    os.system("cd C:\\AIStructureGenerator\\ANN && C: && python main.py "+type)
    
    file_path = "C:\\AIStructureGenerator\\ANN\\results.csv"
# ---------- end generate_form_length ----------
generate_structural_form = Generate_Structural_Form(crv=form_boundary, crv_3=generate_dual, F=generate_form_length.file_path, pleaserun=Toggle(False))

# ==== cluster Generate_Input_Image
crv = ClusterInput()
run = ClusterInput()
txt = ClusterInput()
crv_2 = Curve(crv)
python = GhPythonScript(run=run)  # -> out, a, b; inputs run: Boolean
# ---------- python: Python ----------
__author__ = "Platina"
__version__ = "2021.07.19"

import rhinoscriptsyntax as rs

if run:
    a = 1024
    b = 512
else:
    a = 0
    b = 0
# ---------- end python ----------
txt_2 = Text(txt)
brec = BoundingRectangle(Geometry=crv_2, Plane=PlaneXY(0, 0, 0), Axis=0, Slide=0, Union=True)  # -> Bounding, DimensionX, DimensionY
drec = DeconstuctRectangle(Rectangle=brec.Bounding)  # -> BasePlane, XInterval, YInterval
dedomain = DeconstructDomain(Domain=drec.YInterval)  # -> Start, End
dedomain_2 = DeconstructDomain(Domain=drec.XInterval)  # -> Start, End
subtraction = Subtraction(A=dedomain.End, B=dedomain.Start)
subtraction_2 = Subtraction(A=dedomain_2.End, B=dedomain_2.Start)
python_2 = GhPythonScript(x=subtraction_2, y=subtraction, z=Slider(2, range=0..10))  # -> out, a, b
# ---------- python_2: Python ----------
__author__ = "Platina"
__version__ = "2021.07.19"

import rhinoscriptsyntax as rs

if x>2*y:
    a = x
    b = x/2
else:
    a = 2*y
    b = y

a = a/2*z
b = b/2*z
# ---------- end python_2 ----------
pt = Point(drec.BasePlane)
pdecon = Deconstruct(Point=pt)  # -> XComponent, YComponent, ZComponent
subtraction_3 = Subtraction(A=pdecon.XComponent, B=python_2.a)
subtraction_4 = Subtraction(A=pdecon.YComponent, B=python_2.b)
addition = Addition(A=pdecon.YComponent, B=python_2.b)
addition_2 = Addition(A=pdecon.XComponent, B=python_2.a)
pt_2 = ConstructPoint(XCoordinate=subtraction_3, YCoordinate=subtraction_4, ZCoordinate=0)
pt_3 = ConstructPoint(XCoordinate=addition_2, YCoordinate=addition, ZCoordinate=0)
multiplication = Multiplication(A=python_2.a, B=2)
multiplication_2 = Multiplication(A=python_2.b, B=2)
xz = XZPlane(Origin=drec.BasePlane)
division = Division(A=multiplication, B=1024)
division_2 = Division(A=multiplication_2, B=512)
dom = ConstructDomain(DomainStart=0, DomainEnd=division_2)
dom_2 = ConstructDomain(DomainStart=0, DomainEnd=division)
rectangle = Rectangle(Plane=pt_2, XSize=dom_2, YSize=dom, Radius=0)  # -> Rectangle, Length
arrrec = RectangularArray(Geometry=pt_2, Cell=rectangle.Rectangle, XCount=python.a, YCount=python.b)  # -> Geometry, Transform
item = ListItem(List=arrrec.Geometry, Index=1023, Wrap=True)
pt_4 = Point(item)
mirror = Mirror(Geometry=arrrec.Geometry, Plane=xz)  # -> Geometry, Transform
incurve = PointInCurve(Point=mirror.Geometry, Curve=crv_2)  # -> Relationship, Point
python_3 = GhPythonScript(type=txt_2, x=incurve.Relationship)  # -> out, file_path; inputs x: list of Int32
# ---------- python_3: Python ----------
__author__ = "Platina"
__version__ = "2021.07.19"

import rhinoscriptsyntax as rs
import System

a = System.Drawing.Bitmap(512,1024)

count = 0
for i in range(512):
    for j in range(1024):
        if x[count]==2:
            a.SetPixel(i,j,System.Drawing.Color.FromArgb(0,0,0))
        else:
            a.SetPixel(i,j,System.Drawing.Color.FromArgb(255,255,255))
        count += 1

a.RotateFlip(System.Drawing.RotateFlipType.Rotate90FlipX)

file_path = "C:\\AIStructureGenerator\\datasets\\test.jpg"

System.Drawing.Bitmap.Save(a,file_path)

if type=="DragonflyWings":
    file_path = "C:\\AIStructureGenerator\\datasets\\fmb_to_fcb\\test_A\\test.jpg"
elif type=="DamselflyWings":
    file_path = "C:\\AIStructureGenerator\\datasets\\Damselfly_1\\test_A\\test.jpg"
elif type=="GrasshopperWings":
    file_path = "C:\\AIStructureGenerator\\datasets\\GH_1\\test_A\\test.jpg"
elif type=="AmazonWaterLily":
    file_path = "C:\\AIStructureGenerator\\datasets\\AWL_1\\test_A\\test.jpg"

System.Drawing.Bitmap.Save(a,file_path)
# ---------- end python_3 ----------
file_path = ClusterOutput(python_3.file_path)
pt_5 = ClusterOutput(pt_4)
pt_6 = ClusterOutput(pt_3)
pt_7 = ClusterOutput(pt_2)

# ==== cluster Generate_Dual
crv = ClusterInput()
crv_2 = Curve(crv)
crv_3 = Curve(crv_2)

grid_divisions = Integer(20)
crv_4 = Curve(simplify(crv_3))
x_bounds = Domain(Domain(1950, 3650))
y_bounds = Domain(Domain(2750, 3550))

dom² = Domain²(DomainU=x_bounds, DomainV=y_bounds)
hem_open_xy_networks = VBScript(seg=crv_4, bnd=dom², sbdv=grid_divisions)  # -> out, flatten(e), flatten(eOV), flatten(ePE), flatten(eNE), flatten(eTE), flatten(eIF), flatten(v)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; inputs seg: list of Curve
# ---------- hem_open_xy_networks: VB ----------
    Dim edgeList As New list(Of Line)
    Dim eOVlist As New dataTree(Of int32)
    Dim ePElist As New dataTree(Of int32)
    Dim eNElist As New dataTree(Of int32)
    Dim eTElist As New list(Of int32)
    Dim eIFlist As New list(Of int32)
    Dim vtxList As New list(Of point3d)
    Dim vIElist As New list(Of int32)
    Dim fList As New datatree(Of point3d)
    Dim fIElist As New dataTree(Of int32)

    Dim vIEall As New dataTree(Of int32)
    Dim eF As New list(Of Boolean)

    Dim eDegList As New List(Of Double)

    '********FOR EACH SEGMENT, ADD EDGE AND ITS REVERSE (twin) TO edgeList********
    Dim segCt As int32 = 0
    For i As int32=0 To seg.count - 1
      If seg(i).pointAtStart.distanceto(seg(i).pointAtEnd) > 0 Then
        edgeList.add(New Line(seg(i).pointAtStart, seg(i).pointAtEnd))
        edgeList.add(New Line(seg(i).pointAtEnd, seg(i).pointAtStart))
        eTEList.add((segCt * 2) + 1)
        eTEList.add((segCt * 2))
        'DEFAULT SETTING FOR ef IS TRUE (ie EDGE NEEDS TO BE ASSIGNED TO A FACE)
        ef.add(True)
        ef.add(True)
        eIFlist.add(-10)
        eIFlist.add(-10)

        EdgeDirection(edgeList(edgeList.count - 2), eDegList)
        segCt += 1
      End If
    Next

    Dim vtxTree As New dataTree(Of point3d)
    Dim vNdxTree As New dataTree(Of Int32)
    For i As int32=0 To sbdv - 1
      For j As int32=0 To sbdv - 1
        vtxTree.ensurepath(New gh_path(i, j))
        vNdxTree.ensurepath(New gh_path(i, j))
      Next
    Next


    '********CONSTRUCT VERTEX LIST FROM LIST OF HALF-EDGES********
    For i As int32=0 To edgeList.count - 1
      'boolCk = (is there a close point?, what is the index)
      Dim boolCk() As int32 = {0,-10}

      Dim vCt As int32 = vtxTree.datacount
      CheckLinePt(edgeList(i), vtxTree, vNdxTree, boolCk, bnd, sbdv, 0)

      'IF A NEW VERTEX WAS ADDED, THEN ADD EDGE INDEX TO vIE, vIEall, AND eOV
      If vtxTree.datacount > vCt Then
        vIElist.add(i)
        vIEall.add(i, New GH_Path(boolCk(1)))
        eOVlist.add(boolCk(1), New GH_Path(i))

      Else If boolCK(1) >= 0 Then
        vIEall.add(i, New GH_Path(boolCK(1)))
        eOVlist.add(boolCK(1), New GH_Path(i))
      End If
    Next



    '********FROM EACH HALF-EDGE..
    For i As int32=0 To edgeList.count - 1
      Dim boolCk() As int32 = {0,-10}
      'FIND VERTEX CORRESPONDING TO ENDPOINT (=boolCk(1))
      CheckLinePt(edgeList(i), vtxTree, vNdxTree, boolCk, bnd, sbdv, 1)

      'boolCk(1)=TARGET VERTEX, CHECK ANGLE OF ALL EDGES LEAVING THIS VERTEX
      Dim nxtVtxPth As New gh_path(boolCk(1))
      Dim angCk As Double = -100
      Dim ndx As int32 = -10
      'Dim xProd As vector3d = vector3d.CrossProduct(edgeList(i).direction, vector3d.ZAxis)



      '..FIND NEXT EDGE********
      For j As int32=0 To vIEall.branch(nxtVtxPth).count - 1
        If i <> eTElist(vIEall(nxtVtxPth, j)) Then
          Dim ang As Double = eDegList(eTElist(i)) - eDegList(vIEall(nxtVtxPth, j))
          If ang < 0 Then ang += 360
          If ang > angCk  Then
            angCk = ang
            ndx = j
          End If
        End If
      Next

      If ndx >= 0 Then
        eNElist.add(vIEall(nxtVtxPth, ndx), New GH_Path(i))
        ePElist.add(i, New GH_Path(vIEall(nxtVtxPth, ndx)))
      Else
        'NO NEXT EDGE FOUND, THEN NEXT EDGE IS TWIN
        angCk = math.PI
        ndx = eTElist(i)
        eNElist.add(eTElist(i), New GH_Path(i))
        ePElist.add(i, New GH_Path(eTElist(i)))
      End If
    Next



    '********FIND EDGE-LOOPS / 'FACES'********
    Dim faceCt As int32 = 0
    For i As int32=0 To edgeList.count - 1
      If ef(i) Then
        fList.add(edgeList(i).pointAt(0), New gh_path(faceCt))
        fIEList.add(i, New gh_path(faceCt))
        eIFlist(i) = faceCt
        ef(i) = False
        loopFace(edgeList, ef, eNElist, eNElist(New GH_Path(i), 0), i, fIElist, fList, eIFlist, faceCt)
        faceCt += 1
      End If
    Next


    '********CONVERT vtxTree (SORTED IN BRANCHES BY LOCATION IN GRID)TO LIST (IN ORDER OF INDEX VALUE)********
    For i As int32=0 To vtxTree.datacount - 1
      vtxList.add(Nothing)
    Next
    For i As int32=0 To vtxTree.datacount - 1
      Dim sortNdx As int32 = vNdxTree.alldata(i)
      vtxList(sortNdx) = vtxTree.alldata(i)
    Next

    e = edgeList
    eOV = eOVlist
    eNE = eNElist
    ePE = ePElist
    eTE = eTElist
    eIF = eIFlist
    v = vtxList ' vtxTree
    vIE = vIEall
    f = fList
    fIE = fIElist

    '********PRINT HEM STATS********
    print(vtxList.count & " vertices")
    print(faceCt & " faces")
    print(edgeList.count & " ½ edges")
# ---------- hem_open_xy_networks: VB additional code ----------
  Sub CheckLinePt(ByVal eCurr As Line, ByRef vTree As datatree(Of point3d), ByRef nTree As datatree (Of int32), ByRef ck As Array, ByVal dom As UVInterval, ByVal div As int32, ByVal t As Double)
    'WHEN t=0: CHECKING START POINT; WHEN t=1: CHECKING END POINT
    Dim ptCk As New point3d(eCurr.PointAt(t))

    'POINT VALUE (MINUS DOMAIN STARTING POINT) DIVIDED BY STEP, FLOORED
    Dim pthX As int32 = Math.floor((ptCk.X - dom.u0) / ((dom.U1 - dom.U0) / div))
    Dim pthY As int32 = Math.floor((ptCk.y - dom.v0) / ((dom.v1 - dom.v0) / div))
    pthX = math.min(math.Max(pthX, 0), div - 1)
    pthY = math.min(math.Max(pthY, 0), div - 1)
    Dim pthXY As New gh_path(pthX, pthY)
    ck(1) = -10

    'CHECK ALREADY ADDED NODES
    If vTree.pathExists(pthXY) Then
      For j As int32=0 To vTree.branch(pthXY).count - 1
        If ptCk.DistanceTo(vTree(pthXY, j)) < .1 Then
          ck(0) += 1
          ck(1) = nTree(pthXY, j)
          Exit For
        End If
      Next
    End If

    'IF NOT ALREADY ADDED, THEN ADD
    If  ck(0) = 0 AndAlso ck(1) < 0 Then
      ck(1) = vTree.datacount
      nTree.add(vTree.datacount, pthXY)
      vTree.add(ptCk, pthXY)
    End If

  End Sub


  Sub EdgeDirection(ByRef eCurr As Line, ByRef degList As List(Of Double))
    'FIND DIRECTION OF EDGE
    Dim deg As Double
    If eCurr.direction.x = 0 Then
      deg = (90 * (eCurr.Direction.Y / math.abs(eCurr.Direction.Y))) + 360
      deg = (360 + deg) Mod 360
    Else
      deg = ((math.atan(eCurr.Direction.Y / eCurr.Direction.x)) * 180 / math.PI)
      If eCurr.Direction.X < 0 Then deg = 180 + deg
      If eCurr.Direction.X > 0  Then deg = (360 + deg) Mod 360
    End If

    degList.add(deg)
    degList.add((deg + 180) Mod 360)
  End Sub


  Sub loopFace(ByVal eList As list(Of line), ByRef ck As list(Of Boolean), ByVal eNE As datatree(Of int32), ByVal n As int32, ByVal init As int32, ByRef fList As datatree(Of int32), ByRef f As datatree(Of point3d), ByRef efList As List(Of int32), ByRef ct As int32)
    If n <> init Then
      f.add(eList(n).pointAt(0), New gh_path(ct))
      fList.add(n, New gh_path(ct))
      efList(n) = ct
      ck(n) = False
      loopFace(eList, ck, eNE, eNE(New GH_Path(n), 0), init, fList, f, efList, ct)
    End If
  End Sub
# ---------- end hem_open_xy_networks ----------
pline = PolyLine(Vertices=hem_open_xy_networks.f, Closed=True)
flatten = FlattenTree(Tree=pline, Path="{0}")
srf = Surface(flatten)
area = Area(Geometry=srf)  # -> Area, Centroid
sort = SortList(Keys=area.Area, ValuesA=flatten)  # -> Keys, ValuesA

# ---- group: make lines to polygons
shift = ShiftList(List=sort.ValuesA, Shift=-1, Wrap=False)

# ----
srf_2 = Surface(shift)
Z = UnitZ(Factor=50)
extr = Extrude(Base=srf_2, Direction=Vector(0, 0, -100))
bool = ClusterInput()
move = Move(Geometry=extr, Motion=Z)  # -> Geometry, Transform
bool_2 = Boolean(bool)
python = GhPythonScript(run=bool_2, geo=move.Geometry)  # -> out, Form_InternalLines; inputs geo: list of Brep
# ---------- python: Python ----------
__author__ = "Hao"
__version__ = "2018.1.28"


import rhinoscriptsyntax as rs
import scriptcontext as sc
import Rhino
import ghpythonlib.treehelpers as ghtree
import math
import ghpythonlib.components as gh

import clr
import os
import time
clr.AddReferenceToFileAndPath("C:\\PolyFramework\\PolyFramework.dll")

import Rhino.Geometry as rg
import PolyFramework as pf

if run:
    
    sc.doc = Rhino.RhinoDoc.ActiveDoc
    rhdoc = Rhino.RhinoDoc.ActiveDoc
    
    rs.AddLayer("temp")
    a = rs.ObjectsByLayer("temp")
    rs.DeleteObjects(a)
    
    rl = Rhino.DocObjects.ObjectAttributes()
    rl.LayerIndex = rhdoc.Layers.FindName("temp").Index
    for geoi in geo:
        rhdoc.Objects.Add(geoi,rl)
    
    rs.Command("_SelLayerNumber "+str(rhdoc.Layers.FindName("temp").Index))
    rs.Command("PFBuild _Enter _Enter _Enter")
    rs.Command("_SelLayerNumber "+str(rhdoc.Layers.FindName("_Force_Lines").Index))
    rs.Command("PFDual _Enter _Enter _Enter _Enter")
    
    Form_InternalLines = rs.ObjectsByLayer("_Form_InternalLines")
# ---------- end python ----------
form_internallines = ClusterOutput(python.Form_InternalLines)

# ==== cluster Generate_ANN_Input
bool = ClusterInput()
crv = ClusterInput()
bool_2 = Boolean(bool)
crv_2 = Curve(crv)
python = GhPythonScript(Form_InternalLines=crv_2, pleaserun=bool_2)  # -> out, linestemp, edgetemp, facetemp; inputs Form_InternalLines: list of Curve, pleaserun: Boolean
# ---------- python: Python ----------
__author__ = "Platina"
__version__ = "2019.12.15"

import rhinoscriptsyntax as rs
import scriptcontext as sc
import Rhino
import ghpythonlib.treehelpers as ghtree
import math
import ghpythonlib.components as gh

import clr
import os
import time
clr.AddReferenceToFileAndPath("C:\\PolyFramework\\PolyFramework.dll")

import Rhino.Geometry as rg
import PolyFramework as pf

if pleaserun:
    rhdoc = Rhino.RhinoDoc.ActiveDoc
    linestemp = []
    edgetemp = []
    facetemp = []
    rs.Command("_SelLayerNumber "+str(rhdoc.Layers.FindName("_Form_InternalLines").Index))
    primal = pf.PFoam()
    dual = pf.PFoam()
    containerType = pf.ContainerType
    multiData = pf.LoadData.LoadPrimalDual(True)
    guids = multiData[0]
    primal = multiData[1]
    dual = multiData[2]
    containerType = multiData[3]
    for edge in primal.Edges:
        if (edge.Dual) and (edge.Id>=0):
            if (edge.GetLength()>0) and (edge.Dual.Area>0):
                linestemp.append(edge.CreateLine())
                edgelength = edge.GetLength()
                edgetemp.append(edge.GetLength())
                facearea = edge.Dual.Area
                facetemp.append(edge.Dual.Area)
# ---------- end python ----------
curvepoint = PointOnCurve(python.linestemp, parameter=0.5)
curvepoint_2 = PointOnCurve(crv_2, parameter=0.5)
cp = ClosestPoint(Point=curvepoint_2, Cloud=curvepoint)  # -> ClosestPoint, CPIndex, Distance
item = ListItem(List=python.facetemp, Index=cp.CPIndex, Wrap=True)
end = EndPoints(Curve=crv_2)  # -> Start, End
pdecon = Deconstruct(Point=end.Start)  # -> XComponent, YComponent, ZComponent
pdecon_2 = Deconstruct(Point=end.End)  # -> XComponent, YComponent, ZComponent
merge = Merge(
    Data1=simplify(graft(pdecon.XComponent)),
    Data2=simplify(graft(pdecon.YComponent)),
    Data3=simplify(graft(pdecon_2.XComponent)),
    Data4=simplify(graft(pdecon_2.YComponent)),
    Data5=simplify(graft(item)))
merge_2 = Merge(
    Data1=simplify(graft(pdecon_2.XComponent)),
    Data2=simplify(graft(pdecon_2.YComponent)),
    Data3=simplify(graft(pdecon.XComponent)),
    Data4=simplify(graft(pdecon.YComponent)),
    Data5=simplify(graft(item)))
join = TextJoin(Text=merge_2, Join=",")  # -> flatten(Result)
join_2 = TextJoin(Text=merge, Join=",")  # -> flatten(Result)
merge_3 = Merge(Data1=join_2, Data2=join)  # -> flatten(Result)
panel = Panel(merge_3)
python_2 = FileCreator(name="C:\AIStructureGenerator\ANN\pre", ext="csv", lines=merge_3, write=bool_2)  # -> file_path; inputs lines: list, write: Boolean
# ---------- python_2: Python ----------
"""
Creates a file with a given ndame and extension.
    Inputs:
        name: Desired file name.
        ext: Desired file extension.
        lines: Text to write.
        write: Set to True to write.
"""

# Stephen P. Maher /  2015

ghenv.Component.Name = "File Creator"

import Grasshopper as gh
import os

gh_path = ghdoc.Path # Get GH file path
file = os.path.dirname(os.path.realpath(gh_path)) # Get GH file directory to save to

if "." not in ext: ext = "." + ext
else: pass

#if os.path.exists(file) == False: # Test if file already exists; if it doesn't, proceed
file = name + ext # Set file name and extension
#if os.path.exists(file) == True: # If it does exists, follow the next steps
#    file_count = len([f for f in os.walk(".").next()[2] if f[-4:] == ext]) # Find all files with the same extension
#    file = name + "_" + str(file_count) + ext # Add the number to the new file name as a differentiator

if write:
    filePath = open(file, "w") # Open the file
    for line in lines: # Iterate through lines
        filePath.write(line + "\n") # Write separate lines
    filePath.close() # Close the file
else:
    msg = "Set 'write' to True."
    ghenv.Component.AddRuntimeMessage(gh.Kernel.GH_RuntimeMessageLevel.Warning, msg)

file_path = file
# ---------- end python_2 ----------
file_path = ClusterOutput(python_2)

# ==== cluster Generate_Structural_Form
pleaserun = ClusterInput()
F = ClusterInput()
crv = ClusterInput()
python = GhPythonScript(file_path=F, run=pleaserun)  # -> out, a; inputs run: Boolean; disabled
# ---------- python: Python ----------
__author__ = "Platina"
__version__ = "2021.07.19"

import rhinoscriptsyntax as rs
import csv
import ghpythonlib.treehelpers as ghtree

if run:
    with open(file_path, 'r') as f:
        a = []
        reader = csv.reader(f)
        for row in reader:
            temp = float(row[0])
            a.append(temp)
    
    a = ghtree.list_to_tree(a)
# ---------- end python ----------
file = ReadFile(File=F, PerLineParse=True)
crv_2 = Curve(crv)
num = Number(file)
crv_3 = ClusterInput()
crv_4 = Curve(crv_3)
lng = ListLength(List=num)
division = Division(A=lng, B=2)
boundary = BoundarySurfaces(Edges=crv_4)
subtraction = Subtraction(A=division, B=1)
crv_5 = Curve(boundary)
dom = ConstructDomain(DomainStart=0, DomainEnd=subtraction)
subset = SubList(List=num, Domain=dom, Wrap=True)  # -> List, Index
explode = Explode(Curve=crv_5, Recursive=True)  # -> Segments, Vertices
pt = Point(explode.Vertices)
divide = DivideCurve(Curve=crv_2, Count=100, Kinks=False)  # -> Points, Tangents, Parameters
data = Data(subset.List)
python_2 = GhPythonScript(pleaserun=pleaserun, constraint=divide.Points, marker=pt, ori=crv_4, ori_len=data, tor=Slider(0.3, range=0..1))  # -> out, bakeout; inputs constraint: list of Point3d, marker: list of Point3d, ori: list of Curve, ori_len: list
# ---------- python_2: Python ----------
__author__ = "Hao"
__version__ = "2018.1.28"


import rhinoscriptsyntax as rs
import scriptcontext as sc
import Rhino
import ghpythonlib.treehelpers as ghtree
import math
import ghpythonlib.components as gh

import clr
import os
import time
clr.AddReferenceToFileAndPath("C:\\PolyFramework\\PolyFramework.dll")

import Rhino.Geometry as rg
import PolyFramework as pf

if pleaserun :
    
    cir = gh.Interpolate(constraint,3,True)[0]
    
    InternalLines = []
    ExternalForces = []
    ExternalPoly = []
    
    edgelengths = []
    faceareas = []
    lines = []
    mibfs = []
    primals = []
    
    countc = 0
    
    sc.doc = Rhino.RhinoDoc.ActiveDoc
    rhdoc = Rhino.RhinoDoc.ActiveDoc
    rs.Command("_SelLayerNumber "+str(rhdoc.Layers.FindName("_Form_InternalLines").Index))
    primal = pf.PFoam()
    dual = pf.PFoam()
    containerType = pf.ContainerType
    multiData = pf.LoadData.LoadPrimalDual(True)
    guids = multiData[0]
    primal = multiData[1]
    dual = multiData[2]
    containerType = multiData[3]
    geoouttemp = rs.ObjectsByLayer('_Form_ExternalForces')
    geoouttemp = [rs.coercecurve(j) for j in geoouttemp]
    ExternalForcestemp = geoouttemp
    pt1 = gh.EndPoints(ExternalForcestemp)[0]
    pt2 = gh.EndPoints(ExternalForcestemp)[1]
    pt1.extend(pt2)
    ptall = pt1
    result = []
    for i in range(len(ptall)):
        for j in range(len(marker)):
            if rs.Distance(ptall[i],marker[j])<0.01:
                result.append(ptall[i])
                break
    pickedVertsup = []
    fixableVerts ={}
    result2 = []
    for vert in primal.Vertices:
        id = vert.Id
        location = vert.Point
        for i in range(len(result)):
            if rs.Distance(result[i],location)<0.01:
                fixableVerts[location] = vert
                pickedVertsup.append(fixableVerts[location])
                primal.SetVertexConstraints([fixableVerts[location]], cir, 1.0, True)
                result2.append(location)
                break
                
    stpp = []
    enpp = []
    for i in range(len(ori)):
        temp = gh.EndPoints(ori[i])
        stpp.append(temp[0])
        enpp.append(temp[1])
    for edge in primal.Edges:
        for i in range(len(ori)):
            if (rs.Distance(stpp[i],edge.Vertices[0].Point)<0.01) and (rs.Distance(enpp[i],edge.Vertices[1].Point)<0.01) or (rs.Distance(stpp[i],edge.Vertices[1].Point)<0.01) and (rs.Distance(enpp[i],edge.Vertices[1].Point)<0.01):
                   edge.MinLength = ori_len[i]*(1.0-tor)
                   edge.MaxLength = ori_len[i]*(1.0+tor)
    
    primal.PerpSoft(maxSteps = 10000)
    bakeout = pf.PFoam.SaveAsEdges(primal)
# ---------- end python_2 ----------

# ==== cluster Select_mode
G = ClusterInput()
brec = BoundingRectangle(Geometry=G, Plane=PlaneXY(0, 0, 0), Axis=0, Slide=0, Union=True)  # -> Bounding, DimensionX, DimensionY
explode = Explode(Curve=brec.Bounding, Recursive=True)  # -> Segments, Vertices
mode = ClusterInput()
item = ListItem(List=explode.Segments, Index=0, Wrap=True)  # -> Item, Item1
len = Length(Curve=item.Item)
len_2 = Length(Curve=item.Item1)
division = Division(A=len, B=len_2)
select_type = GhPythonScript(ratio=division, mode=mode)  # -> out, type
# ---------- select_type: Python ----------
__author__ = "Platina"
__version__ = "2021.07.24"

import rhinoscriptsyntax as rs
import ghpythonlib.components as gh

a = [1.0,1.8,3.5,4.4]
b = ["AmazonWaterLily","GrasshopperWings","DragonflyWings","DamselflyWings"]

if mode!="AutoMode":
    type = mode
else:
    if ratio<1.4:
        type = "AmazonWaterLily"
    elif ratio<2.65:
        type = "GrasshopperWings"
    elif ratio<3.95:
        type = "DragonflyWings"
    else:
        type = "DamselflyWings"
# ---------- end select_type ----------
type = ClusterOutput(select_type.type)

# ==== cluster Generate_Force_Geometry
pt = ClusterInput()
bool = ClusterInput()
pt_2 = ClusterInput()
pt_3 = ClusterInput()
txt = ClusterInput()
pt_4 = Point(pt)
pt_5 = Point(pt_3)
txt_2 = Text(txt)
pt_6 = Point(pt_2)
bool_2 = Boolean(bool)
generate_force_geometry = GhPythonScript(pt1=pt_4, file_path=txt_2, run=bool_2)  # -> out, file_path; inputs pt1: Point3d, run: Boolean
# ---------- generate_force_geometry: Python ----------
__author__ = "Platina"
__version__ = "2021.07.19"

import rhinoscriptsyntax as rs
import os

if run:
    
    os.system("cd C:\\AIStructureGenerator && C: && python get_skeleton.py")
    
    file_path = 'C:\\AIStructureGenerator\\results\\result.csv'
# ---------- end generate_force_geometry ----------
dist = Distance(PointA=pt_6, PointB=pt_4)
division = Division(A=dist, B=1024)
file = ReadFile(File=generate_force_geometry.file_path, PerLineParse=True)
split = TextSplit(Text=file, Separators=",")  # -> simplify(Result)
split_2 = TextSplit(Text=split, Separators=" ")  # -> simplify(Result)
split_3 = TextSplit(Text=split_2, Separators=" .")  # -> simplify(Result)
trim = TrimTree(Tree=split_3, Depth=1)
split_4 = TextSplit(Text=trim, Separators="[")  # -> simplify(Result)
trim_2 = TrimTree(Tree=split_4, Depth=1)
split_5 = TextSplit(Text=trim_2, Separators="]")  # -> simplify(Result)
trim_3 = TrimTree(Tree=split_5, Depth=1)
num = Number(trim_3)
panel = Panel(num)
null = NullItem(Item=num)  # -> NullFlags, InvalidFlags, Description
not = GateNot(A=null.NullFlags)
cull = CullPattern(List=num, CullPattern=not)
item = ListItem(List=cull, Index=0, Wrap=True)  # -> Item, Item1
pt_7 = ConstructPoint(XCoordinate=0, YCoordinate=256, ZCoordinate=0)
pt_8 = ConstructPoint(XCoordinate=item.Item1, YCoordinate=item.Item, ZCoordinate=0)
xz = XZPlane(Origin=pt_7)
mirror = Mirror(Geometry=pt_8, Plane=xz)  # -> Geometry, Transform
move = Move(Geometry=mirror.Geometry, Motion=pt_4)  # -> Geometry, Transform
trim_4 = TrimTree(Tree=move.Geometry, Depth=1)
pline = PolyLine(Vertices=trim_4, Closed=False)  # -> flatten(Polyline)
len = Length(Curve=pline)  # disabled
end = EndPoints(Curve=pline)  # -> Start, End
graft = GraftTree(Tree=end.End, IncludeEmptyLists=True, IncludeNullItems=True)
graft_2 = GraftTree(Tree=end.Start, IncludeEmptyLists=True, IncludeNullItems=True)
explode = Explode(Curve=pline, Recursive=True)  # -> Segments, Vertices; disabled
merge = Merge(Data1=end.Start, Data2=end.End)
ln = Line(StartPoint=end.Start, EndPoint=end.End)  # disabled
larger = LargerThan(FirstNumber=len, SecondNumber=3)  # -> LargerThan, OrEqualTo; disabled
duppt = RemoveDuplicatePts(Points=merge, Tolerance=0.01)
sort = SortList(Keys=len, ValuesA=pline)  # -> Keys, ValuesA; disabled
python = GhPythonScript(x=explode.Vertices, y=pline)  # -> out, a; inputs x: tree of Point3d, y: list of Curve; disabled
# ---------- python: Python ----------
__author__ = "Platina"
__version__ = "2021.07.24"

import rhinoscriptsyntax as rs
import ghpythonlib.treehelpers as ghtree

x = ghtree.tree_to_list(x)

a = []
for i in range(len(y)):
    q = 0
    p = 3
    while p<=len(x[i])-1:
        c = rs.AddLine(x[i][q],x[i][p])
        temp = rs.CurveCurveIntersection(c,y[i])
        if (temp==None) or (len(temp)<=2):
            a.append(c)
            q = p
            p += 2
        p += 1
    if q!=len(x[i])-1:
        a.append(rs.AddLine(x[i][q],x[i][len(x[i])-1]))
# ---------- end python ----------
duppt_2 = RemoveDuplicatePts(Points=duppt, Tolerance=6)
cp = ClosestPoint(Point=graft, Cloud=duppt_2)  # -> ClosestPoint, CPIndex, Distance
cp_2 = ClosestPoint(Point=graft_2, Cloud=duppt_2)  # -> ClosestPoint, CPIndex, Distance
ln_2 = Line(StartPoint=cp_2.ClosestPoint, EndPoint=cp.ClosestPoint)  # -> flatten(Line)
len_2 = Length(Curve=ln_2)
larger_2 = LargerThan(FirstNumber=len_2, SecondNumber=0.01)  # -> LargerThan, OrEqualTo
rev = ReverseList(List=sort.ValuesA)  # disabled
cull_2 = CullPattern(List=pline, CullPattern=larger.LargerThan)  # disabled
len_3 = Length(Curve=python.a)  # disabled
larger_3 = LargerThan(FirstNumber=len_3, SecondNumber=0.01)  # -> LargerThan, OrEqualTo; disabled
cull_3 = CullPattern(List=ln_2, CullPattern=larger_2.LargerThan)
dupln = RemoveDuplicateLines(Lines=cull_3, Tolerance=0.01)
end_2 = EndPoints(Curve=dupln)  # -> Start, End
merge_2 = Merge(Data1=end_2.Start, Data2=end_2.End)
cull_4 = CullPattern(List=python.a, CullPattern=larger_3.LargerThan)  # disabled
explode_2 = Explode(Curve=rev, Recursive=True)  # -> Segments, Vertices; disabled
duppt_3 = RemoveDuplicatePts(Points=merge_2, Tolerance=0.01)
flatten = FlattenTree(Tree=explode_2.Segments, Path="{0}")  # disabled
cps = ClosestPoints(Point=duppt_3, Cloud=merge_2, Count=3)  # -> ClosestPoint, CPIndex, Distance
dupln_2 = RemoveDuplicateLines(Lines=flatten, Tolerance=0.01)  # disabled
item_2 = ListItem(List=cps.Distance, Index=-1, Wrap=True)
toggle = BooleanToggle(True)  # disabled
subset = SubList(List=cull_4, Domain=Domain(0, 1000), Wrap=True)  # -> List, Index; disabled
scale = Scale(Geometry=dupln_2, Center=pt_4, Factor=division)  # -> Geometry, Transform; disabled
smaller = SmallerThan(FirstNumber=item_2, SecondNumber=0.01)  # -> flatten(SmallerThan), OrEqualTo
toggle_2 = BooleanToggle(False)  # disabled
cull_5 = CullPattern(List=duppt_3, CullPattern=smaller.SmallerThan)
python_2 = GhPythonScript(curves=cull_4, run=toggle)  # -> out, curves; inputs curves: list of Curve, run: Boolean; disabled
# ---------- python_2: Python ----------
__author__ = "Platina"
__version__ = "2021.07.24"

import rhinoscriptsyntax as rs
import ghpythonlib.components as gh

if run:
    for i in range(len(curves)):
        spp = rs.CurveStartPoint(curves[i])
        epp = rs.CurveEndPoint(curves[i])
        l = rs.CurveLength(curves[i])
        curve = rs.ScaleObject(curves[i],rs.CurveMidPoint(curves[i]),[1024/l,1024/l,1024/l])
        sp = rs.CurveStartPoint(curve)
        ep = rs.CurveEndPoint(curve)
        a = [sp,ep]
        for j in range(len(curves)):
            if i!=j:
                temp = rs.CurveCurveIntersection(curve,curves[j])
                if temp!=None:
                    a.append(temp[0][1])
        d = gh.Distance(a,sp)
        a = gh.SortList(d,a)[1]
        minep = 9999
        minsp = 9999
        epf = None
        spf = None
        for j in range(len(a)):
            if abs((rs.Distance(a[j],epp)-rs.Distance(a[j],spp))-l)<0.01:
                ll = rs.Distance(a[j],spp)
                if ll<minsp:
                    minsp = ll
                    spf = a[j]
            if abs((rs.Distance(a[j],spp)-rs.Distance(a[j],epp))-l)<0.01:
                ll = rs.Distance(a[j],epp)
                if ll<minep:
                    minep = ll
                    epf = a[j]
        curves[i] = rs.AddLine(spf,epf)
# ---------- end python_2 ----------
slider = Slider(0.001, range=0..0.001)  # disabled
rotate = Rotate(Geometry=python_2.curves, Angle=0.6283185307, Plane=PlaneXY(0, 0, 0))  # -> Geometry, Transform; disabled
scale_2 = Scale(Geometry=cull_5, Center=pt_4, Factor=division)  # -> Geometry, Transform
toggle_3 = BooleanToggle(False)  # disabled
del = DelaunayMesh(Points=cull_5, Plane=PlaneXY(0, 0, 0))
python_3 = GhPythonScript(curves=subset.List, run=toggle_2)  # -> out, curves; inputs curves: list of Curve, run: Boolean; disabled
# ---------- python_3: Python ----------
__author__ = "Platina"
__version__ = "2021.07.24"

import rhinoscriptsyntax as rs

if run:
    for i in range(len(curves)):
        curve = curves[i]
        pds = False
        pde = False
        pdsp = None
        pdep = None
        s1 = rs.CurveStartPoint(curve)
        e1 = rs.CurveEndPoint(curve)
        temp = []
        for j in range(len(curves)):
            if i!=j:
                if rs.Distance(rs.EvaluateCurve(curves[j],rs.CurveClosestPoint(curves[j],s1)),s1)<50:
                    temp.append(curves[j])
                elif rs.Distance(rs.EvaluateCurve(curves[j],rs.CurveClosestPoint(curves[j],e1)),e1)<50:
                    temp.append(curves[j])
        for j in range(len(temp)):
            a = rs.CurveCurveIntersection(curve,temp[j])
            if a!=None:
                if rs.Distance(a[0][1],rs.CurveStartPoint(curve))<0.01:
                    pds = True
                    pdsp = a[0][1]
                if rs.Distance(a[0][1],rs.CurveEndPoint(curve))<0.01:
                    pde = True
                    pdep = a[0][1]
            if (pds==True) and (pde==True):
                break
        count = 0
        while ((pds==False) or (pde==False)) and (count<50):
            if pds==False:
                l = (rs.CurveLength(curve)+1)/rs.CurveLength(curve)
                curve = rs.ScaleObject(curve,rs.CurveEndPoint(curve),[l,l,l])
                for j in range(len(temp)):
                    a = rs.CurveCurveIntersection(curve,temp[j])
                    if a!=None:
                        if rs.Distance(a[0][1],rs.CurveStartPoint(curve))<=1:
                            pds = True
                            pdsp = a[0][1]
                            break
            if pde==False:
                l = (rs.CurveLength(curve)+1)/rs.CurveLength(curve)
                curve = rs.ScaleObject(curve,rs.CurveStartPoint(curve),[l,l,l])
                for j in range(len(temp)):
                    a = rs.CurveCurveIntersection(curve,temp[j])
                    if a!=None:
                        if rs.Distance(a[0][1],rs.CurveEndPoint(curve))<=1:
                            pde = True
                            pdep = a[0][1]
                            break
            count += 1
        if pdsp==None:
            pdsp = rs.CurveStartPoint(curve)
        if pdep==None:
            pdep = rs.CurveEndPoint(curve)
        curves[i] = rs.AddCurve([pdsp,pdep])
# ---------- end python_3 ----------
end_3 = EndPoints(Curve=python_2.curves)  # -> Start, End; disabled
scale_3 = Scale(Geometry=del, Center=pt_4, Factor=division)  # -> Geometry, Transform
python_4 = GhPythonScript(curves=python_2.curves, run=toggle_3)  # -> out, curves; inputs curves: list of Curve, run: Boolean; disabled
# ---------- python_4: Python ----------
__author__ = "Platina"
__version__ = "2021.07.25"

import rhinoscriptsyntax as rs
import ghpythonlib.components as gh

if run:
    pd = True
    while pd==True:
        pd = False
        a = []
        for i in range(len(curves)):
            a.append(rs.CurveEndPoint(curves[i]))
            a.append(rs.CurveStartPoint(curves[i]))
        pp = []
        for i in range(len(curves)):
            d = gh.ClosestPoints(rs.CurveEndPoint(curves[i]),a,2)[2]
            if d[1]<0.01:
                p1 = True
            else:
                p1 = False
            d = gh.ClosestPoints(rs.CurveStartPoint(curves[i]),a,2)[2]
            if d[1]<0.01:
                p2 = True
            else:
                p2 = False
            if p1 and p2:
                pp.append(True)
            else:
                pp.append(False)
                pd = True
        curves = gh.CullPattern(curves,pp)
# ---------- end python_4 ----------
splitcurves = PythonScript(curves=rotate.Geometry, tolerance=slider)  # -> out, pieces; inputs curves: list of Curve; disabled
# ---------- splitcurves: Python ----------
import Rhino
import clr
clr.AddReference("Grasshopper")
from Grasshopper.Kernel.Data import GH_Path
from Grasshopper import DataTree
import ghpythonlib.components as gh


def boxes_overlap(boxA, boxB):
    """Check if there is any overlap between two bounding boxes.
    """
    intersection = boxA.Intersection(boxA, boxB)
    if intersection.IsValid:
        intSize = intersection.Diagonal.Length
        return intSize > 0.0
    else:
        return False

def distribute_intersections(curveIntersections):
    """returns two lists: the parameters on curveA, and the parameters on
    curveB.
    """
    params_a = []
    params_b = []
    for intersection in curveIntersections:
        if not intersection.IsOverlap:
            params_a.append(intersection.ParameterA)
            params_b.append(intersection.ParameterB)
        else: # it's an overlap!
            intervalA = intersection.OverlapA
            intervalB = intersection.OverlapB
            params_a.extend([intervalA.T0, intervalA.T1])
            params_b.extend([intervalB.T0, intervalB.T1])
    return params_a, params_b

def split(curves, tol=0.001):
    """Take a set of curves and split them at every point-type intersection.
    """
    results = []
    parameter_bank = {}
    indices = range(len(curves) - 1, -1, -1)
    for i in indices:
        parameter_bank[i] = []
    for i in indices:
        # check to see if this curve has any previously found intersections
        intersection_parameters = parameter_bank[i]
        if curves:
            curve = curves.pop()
            # check for self intersections first
            self_intersections = Rhino.Geometry.Intersect.Intersection.CurveSelf(curve, tol)
            if self_intersections.Count > 0:
                this_intersect, that_intersect = distribute_intersections(self_intersections)
                intersection_parameters.extend(this_intersect)
                intersection_parameters.extend(that_intersect)
            # check if there are any other curves
            if curves:
                # get the bounding box for this curve
                thisbbox = curve.GetBoundingBox(False)
                # go through the other curves
                for j, other in enumerate(curves):
                    # check if the other curve is anywhere near this one
                    otherbbox = other.GetBoundingBox(False)
                    if boxes_overlap(thisbbox, otherbbox):
                        # get the intersections with the other curve
                        other_intersections = Rhino.Geometry.Intersect.Intersection.CurveCurve( curve,
                                other, tol, tol)
                        if other_intersections.Count > 0:
                            this_intersect, that_intersect = distribute_intersections(other_intersections)
                            intersection_parameters.extend(this_intersect)
                            parameter_bank[j].extend(that_intersect)
        if intersection_parameters:
            # chop up the curve
            curve_pieces = curve.Split(intersection_parameters)
            for curvesss in curve_pieces:
                results.append(gh.Line(curvesss.PointAtStart,curvesss.PointAtEnd))
        else:
            results.append(curve)
    return results

if curves:
    if tolerance == None:
        tolerance = 0.001
    pieces = split(curves, tolerance)
# ---------- end splitcurves ----------
ln_3 = Line(StartPoint=end_3.Start, EndPoint=end_3.End)  # disabled
wbedges = WeaverbirdsMeshEdges(MeshOrPolylines=scale_3.Geometry)
rotate_2 = Rotate(Geometry=splitcurves.pieces, Angle=-0.6283185307, Plane=PlaneXY(0, 0, 0))  # -> Geometry, Transform; disabled
len_4 = Length(Curve=rotate_2.Geometry)  # disabled
L = ClusterOutput(wbedges)
larger_4 = LargerThan(FirstNumber=len_4, SecondNumber=0.01)  # -> LargerThan, OrEqualTo; disabled
cull_6 = CullPattern(List=rotate_2.Geometry, CullPattern=larger_4.LargerThan)  # disabled
dupln_3 = RemoveDuplicateLines(Lines=cull_6, Tolerance=0.01)  # disabled
len_5 = Length(Curve=dupln_3)  # disabled
sort_2 = SortList(Keys=len_5, ValuesA=dupln_3)  # -> Keys, ValuesA; disabled
shift = ShiftList(List=sort_2.Keys, Shift=-1, Wrap=False)  # disabled
lng = ListLength(List=shift)  # disabled
shift_2 = ShiftList(List=sort_2.Keys, Shift=1, Wrap=False)  # disabled
series = Series(Start=0, Step=1, Count=lng)  # disabled
subtraction = Subtraction(A=shift_2, B=shift)  # disabled
division_2 = Division(A=subtraction, B=shift)  # disabled
larger_5 = LargerThan(FirstNumber=division_2, SecondNumber=0.3)  # -> LargerThan, OrEqualTo; disabled
cull_7 = CullPattern(List=series, CullPattern=larger_5.LargerThan)  # disabled
item_3 = ListItem(List=cull_7, Index=-1, Wrap=True)  # disabled
dom = ConstructDomain(DomainStart=0, DomainEnd=item_3)  # disabled
subset_2 = SubList(List=sort_2.ValuesA, Domain=dom, Wrap=True)  # -> List, Index; disabled
end_4 = EndPoints(Curve=subset_2.List)  # -> Start, End; disabled
merge_3 = Merge(Data1=end_4.Start, Data2=end_4.End)  # disabled
duppt_4 = RemoveDuplicatePts(Points=merge_3, Tolerance=0.01)  # disabled
cps_2 = ClosestPoints(Point=duppt_4, Cloud=merge_3, Count=3)  # -> ClosestPoint, CPIndex, Distance; disabled
smaller_2 = SmallerThan(FirstNumber=cps_2.Distance, SecondNumber=0.01)  # -> SmallerThan, OrEqualTo; disabled
toggle_4 = BooleanToggle(False)  # disabled
ma = MassAddition(Input=smaller_2.SmallerThan)  # -> Result, PartialResults; disabled
larger_6 = LargerThan(FirstNumber=ma.Result, SecondNumber=3)  # -> LargerThan, flatten(OrEqualTo); disabled
equals = Equality(FirstNumber=ma.Result, SecondNumber=2)  # -> flatten(Equality), Inequality; disabled
toggle_5 = BooleanToggle(False)  # disabled
cull_8 = CullPattern(List=duppt_4, CullPattern=larger_6.OrEqualTo)  # disabled
cull_9 = CullPattern(List=duppt_4, CullPattern=equals.Equality)  # disabled
flatten_2 = FlattenTree(Tree=ma.Result, Path="{0}")  # disabled
duppt_5 = RemoveDuplicatePts(Points=cull_8, Tolerance=3)  # disabled
subset_3 = SubList(List=duppt_5, Domain=Domain(0, 20), Wrap=True)  # -> List, Index; disabled
python_5 = GhPythonScript(pts=duppt_5, curves=pline, run=toggle_4)  # -> out, a; inputs pts: list of Point3d, curves: list of Curve, run: Boolean; disabled
# ---------- python_5: Python ----------
__author__ = "Platina"
__version__ = "2021.07.25"

import rhinoscriptsyntax as rs
import ghpythonlib.components as gh

def okpass(pt1,pt2):
    curve = rs.AddLine(pt1,pt2)
    l = rs.CurveLength(curve)
    pts = rs.DivideCurve(curve,4)[1:4]
    for j in range(len(a)):
        t = rs.CurveCurveIntersection(curve,a[j])
        if t!=None:
            if (rs.Distance(pt1,t[0][1])>0.01) or (rs.Distance(pt2,t[0][1])>0.01):
                return False
    for pt in pts:
        d = gh.CurveClosestPoint(pt,curves)[2]
        if min(d)<0.2*l:
            return True

def search(k):
    pt = pts[k]
    ptc,ptk,ptd = gh.ClosestPoints(pt,pts,10)
    for i in range(len(ptc)):
        if okpass(pt,ptc[i])==True:
            a.append(rs.AddLine(pt,ptc[i]))
            if pd[ptk[i]]==False:
                pd[ptk[i]] = True
                search(ptk[i])

if run:
    pd = [False for i in range(len(pts))]
    a = []
    
    for i in range(len(pts)):
        if pd[i]==False:
            pd[i] = True
            search(i)
# ---------- end python_5 ----------
python_6 = GhPythonScript(curves=subset_2.List, pts=cull_9, run=toggle_5)  # -> out, curves; inputs curves: list of Curve, pts: list of Point3d, run: Boolean; disabled
# ---------- python_6: Python ----------
__author__ = "Platina"
__version__ = "2021.07.25"

import rhinoscriptsyntax as rs
import ghpythonlib.components as gh

if run:
    for i in range(len(pts)):
        d = gh.CurveClosestPoint(pts[i],curves)[2]
        t = []
        c = []
        curves_new = []
        for j in range(len(d)):
            if d[j]<0.01:
                t.append(j)
                c.append(curves[j])
            else:
                curves_new.append(curves[j])
        curves = curves_new
        c = gh.JoinCurves(c,False)
        curves.append(gh.Line(gh.EndPoints(c)[0],gh.EndPoints(c)[1]))
# ---------- end python_6 ----------
del_2 = DelaunayMesh(Points=duppt_5, Plane=PlaneXY(0, 0, 0))  # disabled
dupln_4 = RemoveDuplicateLines(Lines=python_6.curves, Tolerance=0.01)  # disabled
end_5 = EndPoints(Curve=dupln_4)  # -> Start, End; disabled
merge_4 = Merge(Data1=end_5.Start, Data2=end_5.End)  # disabled
duppt_6 = RemoveDuplicatePts(Points=merge_4, Tolerance=0.01)  # disabled
cps_3 = ClosestPoints(Point=duppt_6, Cloud=merge_4, Count=3)  # -> ClosestPoint, CPIndex, Distance; disabled
smaller_3 = SmallerThan(FirstNumber=cps_3.Distance, SecondNumber=0.01)  # -> SmallerThan, OrEqualTo; disabled
ma_2 = MassAddition(Input=smaller_3.SmallerThan)  # -> Result, PartialResults; disabled
equals_2 = Equality(FirstNumber=ma_2.Result, SecondNumber=1)  # -> flatten(Equality), Inequality; disabled
cull_10 = CullPattern(List=duppt_6, CullPattern=equals_2.Equality)  # disabled
flatten_3 = FlattenTree(Tree=ma_2.Result, Path="{0}")  # disabled
graft_3 = GraftTree(Tree=dupln_4, IncludeEmptyLists=True, IncludeNullItems=True)  # disabled
crv_cp = CurveClosestPoint(Point=cull_10, Curve=graft_3)  # -> Point, Parameter, Distance; disabled
smaller_4 = SmallerThan(FirstNumber=crv_cp.Distance, SecondNumber=0.01)  # -> SmallerThan, OrEqualTo; disabled
ma_3 = MassAddition(Input=smaller_4.SmallerThan)  # -> flatten(Result), PartialResults; disabled
equals_3 = Equality(FirstNumber=ma_3.Result, SecondNumber=0)  # -> Equality, Inequality; disabled
cull_11 = CullPattern(List=dupln_4, CullPattern=equals_3.Equality)  # disabled
end_6 = EndPoints(Curve=cull_11)  # -> Start, End; disabled
merge_5 = Merge(Data1=end_6.Start, Data2=end_6.End)  # disabled
duppt_7 = RemoveDuplicatePts(Points=merge_5, Tolerance=0.01)  # disabled
cps_4 = ClosestPoints(Point=duppt_7, Cloud=merge_5, Count=3)  # -> ClosestPoint, CPIndex, Distance; disabled
smaller_5 = SmallerThan(FirstNumber=cps_4.Distance, SecondNumber=0.01)  # -> SmallerThan, OrEqualTo; disabled
ma_4 = MassAddition(Input=smaller_5.SmallerThan)  # -> Result, PartialResults; disabled
equals_4 = Equality(FirstNumber=ma_4.Result, SecondNumber=2)  # -> flatten(Equality), Inequality; disabled
toggle_6 = BooleanToggle(False)  # disabled
cull_12 = CullPattern(List=duppt_7, CullPattern=equals_4.Equality)  # disabled
flatten_4 = FlattenTree(Tree=ma_4.Result, Path="{0}")  # disabled
python_7 = GhPythonScript(curves=cull_11, pts=cull_12, run=toggle_6)  # -> out, curves; inputs curves: list of Curve, pts: list of Point3d, run: Boolean; disabled; same code as python_6
dupln_5 = RemoveDuplicateLines(Lines=python_7.curves, Tolerance=0.01)  # disabled
end_7 = EndPoints(Curve=dupln_5)  # -> Start, End; disabled
merge_6 = Merge(Data1=end_7.Start, Data2=end_7.End)  # disabled
duppt_8 = RemoveDuplicatePts(Points=merge_6, Tolerance=0.01)  # disabled
cps_5 = ClosestPoints(Point=duppt_8, Cloud=merge_6, Count=3)  # -> ClosestPoint, CPIndex, Distance; disabled
smaller_6 = SmallerThan(FirstNumber=cps_5.Distance, SecondNumber=0.01)  # -> SmallerThan, OrEqualTo; disabled
ma_5 = MassAddition(Input=smaller_6.SmallerThan)  # -> Result, PartialResults; disabled
equals_5 = Equality(FirstNumber=ma_5.Result, SecondNumber=1)  # -> flatten(Equality), Inequality; disabled
cull_13 = CullPattern(List=duppt_8, CullPattern=equals_5.Equality)  # disabled
flatten_5 = FlattenTree(Tree=ma_5.Result, Path="{0}")  # disabled
graft_4 = GraftTree(Tree=dupln_5, IncludeEmptyLists=True, IncludeNullItems=True)  # disabled
crv_cp_2 = CurveClosestPoint(Point=cull_13, Curve=graft_4)  # -> Point, Parameter, Distance; disabled
smaller_7 = SmallerThan(FirstNumber=crv_cp_2.Distance, SecondNumber=0.01)  # -> SmallerThan, OrEqualTo; disabled
ma_6 = MassAddition(Input=smaller_7.SmallerThan)  # -> flatten(Result), PartialResults; disabled
equals_6 = Equality(FirstNumber=ma_6.Result, SecondNumber=0)  # -> Equality, Inequality; disabled
cull_14 = CullPattern(List=dupln_5, CullPattern=equals_6.Equality)  # disabled
end_8 = EndPoints(Curve=cull_14)  # -> Start, End; disabled
merge_7 = Merge(Data1=end_8.Start, Data2=end_8.End)  # disabled
duppt_9 = RemoveDuplicatePts(Points=merge_7, Tolerance=0.01)  # disabled
cps_6 = ClosestPoints(Point=duppt_9, Cloud=merge_7, Count=3)  # -> ClosestPoint, CPIndex, Distance; disabled
smaller_8 = SmallerThan(FirstNumber=cps_6.Distance, SecondNumber=0.01)  # -> SmallerThan, OrEqualTo; disabled
ma_7 = MassAddition(Input=smaller_8.SmallerThan)  # -> Result, PartialResults; disabled
equals_7 = Equality(FirstNumber=ma_7.Result, SecondNumber=2)  # -> flatten(Equality), Inequality; disabled
toggle_7 = BooleanToggle(False)  # disabled
cull_15 = CullPattern(List=duppt_9, CullPattern=equals_7.Equality)  # disabled
flatten_6 = FlattenTree(Tree=ma_7.Result, Path="{0}")  # disabled
python_8 = GhPythonScript(curves=cull_14, pts=cull_15, run=toggle_7)  # -> out, curves; inputs curves: list of Curve, pts: list of Point3d, run: Boolean; disabled; same code as python_6
dupln_6 = RemoveDuplicateLines(Lines=python_8.curves, Tolerance=0.01)  # disabled
end_9 = EndPoints(Curve=dupln_6)  # -> Start, End; disabled
merge_8 = Merge(Data1=end_9.Start, Data2=end_9.End)  # disabled
duppt_10 = RemoveDuplicatePts(Points=merge_8, Tolerance=0.01)  # disabled
cps_7 = ClosestPoints(Point=duppt_10, Cloud=merge_8, Count=3)  # -> ClosestPoint, CPIndex, Distance; disabled
smaller_9 = SmallerThan(FirstNumber=cps_7.Distance, SecondNumber=0.01)  # -> SmallerThan, OrEqualTo; disabled
ma_8 = MassAddition(Input=smaller_9.SmallerThan)  # -> Result, PartialResults; disabled
equals_8 = Equality(FirstNumber=ma_8.Result, SecondNumber=1)  # -> flatten(Equality), Inequality; disabled
cull_16 = CullPattern(List=duppt_10, CullPattern=equals_8.Equality)  # disabled
flatten_7 = FlattenTree(Tree=ma_8.Result, Path="{0}")  # disabled
graft_5 = GraftTree(Tree=dupln_6, IncludeEmptyLists=True, IncludeNullItems=True)  # disabled
crv_cp_3 = CurveClosestPoint(Point=cull_16, Curve=graft_5)  # -> Point, Parameter, Distance; disabled
smaller_10 = SmallerThan(FirstNumber=crv_cp_3.Distance, SecondNumber=0.01)  # -> SmallerThan, OrEqualTo; disabled
ma_9 = MassAddition(Input=smaller_10.SmallerThan)  # -> flatten(Result), PartialResults; disabled
equals_9 = Equality(FirstNumber=ma_9.Result, SecondNumber=0)  # -> Equality, Inequality; disabled
cull_17 = CullPattern(List=dupln_6, CullPattern=equals_9.Equality)  # disabled
end_10 = EndPoints(Curve=cull_17)  # -> Start, End; disabled
merge_9 = Merge(Data1=end_10.Start, Data2=end_10.End)  # disabled
duppt_11 = RemoveDuplicatePts(Points=merge_9, Tolerance=0.01)  # disabled
cps_8 = ClosestPoints(Point=duppt_11, Cloud=merge_9, Count=3)  # -> ClosestPoint, CPIndex, Distance; disabled
smaller_11 = SmallerThan(FirstNumber=cps_8.Distance, SecondNumber=0.01)  # -> SmallerThan, OrEqualTo; disabled
ma_10 = MassAddition(Input=smaller_11.SmallerThan)  # -> Result, PartialResults; disabled
equals_10 = Equality(FirstNumber=ma_10.Result, SecondNumber=2)  # -> flatten(Equality), Inequality; disabled
toggle_8 = BooleanToggle(False)  # disabled
cull_18 = CullPattern(List=duppt_11, CullPattern=equals_10.Equality)  # disabled
flatten_8 = FlattenTree(Tree=ma_10.Result, Path="{0}")  # disabled
python_9 = GhPythonScript(curves=cull_17, pts=cull_18, run=toggle_8)  # -> out, curves; inputs curves: list of Curve, pts: list of Point3d, run: Boolean; disabled; same code as python_6
dupln_7 = RemoveDuplicateLines(Lines=python_9.curves, Tolerance=0.01)  # disabled
end_11 = EndPoints(Curve=dupln_7)  # -> Start, End; disabled
merge_10 = Merge(Data1=end_11.Start, Data2=end_11.End)  # disabled
duppt_12 = RemoveDuplicatePts(Points=merge_10, Tolerance=0.01)  # disabled
cps_9 = ClosestPoints(Point=duppt_12, Cloud=merge_10, Count=3)  # -> ClosestPoint, CPIndex, Distance; disabled
smaller_12 = SmallerThan(FirstNumber=cps_9.Distance, SecondNumber=0.01)  # -> SmallerThan, OrEqualTo; disabled
ma_11 = MassAddition(Input=smaller_12.SmallerThan)  # -> Result, PartialResults; disabled
equals_11 = Equality(FirstNumber=ma_11.Result, SecondNumber=1)  # -> flatten(Equality), Inequality; disabled
cull_19 = CullPattern(List=duppt_12, CullPattern=equals_11.Equality)  # disabled
flatten_9 = FlattenTree(Tree=ma_11.Result, Path="{0}")  # disabled
graft_6 = GraftTree(Tree=dupln_7, IncludeEmptyLists=True, IncludeNullItems=True)  # disabled
crv_cp_4 = CurveClosestPoint(Point=cull_19, Curve=graft_6)  # -> Point, Parameter, Distance; disabled
smaller_13 = SmallerThan(FirstNumber=crv_cp_4.Distance, SecondNumber=0.01)  # -> SmallerThan, OrEqualTo; disabled
ma_12 = MassAddition(Input=smaller_13.SmallerThan)  # -> flatten(Result), PartialResults; disabled
equals_12 = Equality(FirstNumber=ma_12.Result, SecondNumber=0)  # -> Equality, Inequality; disabled
cull_20 = CullPattern(List=dupln_7, CullPattern=equals_12.Equality)  # disabled
