# Grasshopper definition AIStructureGenerator_User.gh (Grasshopper 1.0.7)
# plug-ins: Anemone, Kangaroo2 Components

anchorwalls = Curve([<curve referenced from the Rhino model> x3])
_2d = Curve(<curve referenced from the Rhino model>)

cluster = Cluster_6(crv_2=_2d, crv=anchorwalls)  # -> C, crv_6, pt_3, num_2
lng = ListLength(List=anchorwalls)

panel = Panel(lng)

_3d = Surface(<surface referenced from the Rhino model>)
loop_start = LoopStart(Repeat=Slider(0, range=0..10))  # -> port, Counter, Data
neg = Negative(Value=cluster.num_2)
get_2d_curve = Get_2D_curve(_3d=_3d)
_2d_2 = Curve(<curve referenced from the Rhino model>)
item = ListItem(List=cluster.crv_6, Index=loop_start.Counter, Wrap=True)

# ----
# 01 INPUT
# The form boundary should be a closed curvature with an approximate width of 3000-5000 unit in Rhino.
# The form anchors are points.
list = ValueList({"DragonflyWings", "DamselflyWings", "GrasshopperWings", "AmazonWaterLily", "AutoMode"}, selected="DragonflyWings")
form_boundary = Curve(_2d_2)
form_anchors = Point([<point referenced from the Rhino model> x3])
select_mode = Select_mode(G=form_boundary, mode=list)

# ----
# 02 GENERATING FORCE IMAGE
# 03 option 1 - switch to True - to recognize the image and generate the force geometry
# 03 option 2 - switch to True - to place the generated image in Rhino
panel_2 = Panel("01 - switch to True")
generate_input_image = Generate_Input_Image(txt=select_mode, crv=item, run=Toggle(False))  # -> file_path, pt_10, pt_8, pt_9
panel_3 = Panel("02 - switch to True")
generate_force_image = GhPythonScript(type=select_mode, file_path=generate_input_image.file_path, run=Toggle(False))  # -> out, file_path; inputs run: Boolean
# ---------- generate_force_image: Python ----------
__author__ = "Platina"
__version__ = "2021.07.19"

#encoding=utf-8
import os
import shutil
import rhinoscriptsyntax as rs
from subprocess import Popen, PIPE
DETACHED_PROCESS = 0x00000008

import ghpythonlib.components as gh

if run:
    
    if type=="DragonflyWings":
        os.system("cd C:\\AIStructureGenerator && C: && python test.py --name fmb_to_fcb --dataroot ./datasets/fmb_to_fcb/ --no_instance --label_nc 0 --loadSize 1000 --fineSize 1000 --resize_or_crop none --how_many 1 --gpu_ids 0")
        shutil.copy(r'C:\\AIStructureGenerator\\results\\fmb_to_fcb\\test_latest\\images\\test_synthesized_image.jpg', r'C:\\AIStructureGenerator\\datasets\\fcb_to_fc\\test_A\\test.jpg')
        shutil.copy(r'C:\\AIStructureGenerator\\results\\fmb_to_fcb\\test_latest\\images\\test_synthesized_image.jpg', r'C:\\AIStructureGenerator\\results\\result_bou.jpg')
        os.system("cd C:\\AIStructureGenerator && C: && python test.py --name fcb_to_fc --dataroot ./datasets/fcb_to_fc/ --no_instance --label_nc 0 --loadSize 1000 --fineSize 1000 --resize_or_crop none --how_many 1 --gpu_ids 0")
        shutil.copy(r'C:\\AIStructureGenerator\\results\\fcb_to_fc\\test_latest\\images\\test_synthesized_image.jpg', r'C:\\AIStructureGenerator\\datasets\\fc_to_fcg\\test_A\\test.jpg')
        shutil.copy(r'C:\\AIStructureGenerator\\results\\fcb_to_fc\\test_latest\\images\\test_synthesized_image.jpg', r'C:\\AIStructureGenerator\\results\\result_mp.jpg')
        os.system("cd C:\\AIStructureGenerator && C: && python test.py --name fc_to_fcg --dataroot ./datasets/fc_to_fcg/ --no_instance --label_nc 0 --loadSize 1000 --fineSize 1000 --resize_or_crop none --how_many 1 --gpu_ids 0")
        shutil.copy(r'C:\\AIStructureGenerator\\results\\fc_to_fcg\\test_latest\\images\\test_synthesized_image.jpg', r'C:\\AIStructureGenerator\\results\\result.jpg')
    elif type=="DamselflyWings":
        os.system("cd C:\\AIStructureGenerator && C: && python test.py --name Damselfly_1 --dataroot ./datasets/Damselfly_1/ --no_instance --label_nc 0 --loadSize 1000 --fineSize 1000 --resize_or_crop none --how_many 1 --gpu_ids 0")
        shutil.copy(r'C:\\AIStructureGenerator\\results\\Damselfly_1\\test_latest\\images\\test_synthesized_image.jpg', r'C:\\AIStructureGenerator\\datasets\\Damselfly_2\\test_A\\test.jpg')
        shutil.copy(r'C:\\AIStructureGenerator\\results\\Damselfly_1\\test_latest\\images\\test_synthesized_image.jpg', r'C:\\AIStructureGenerator\\results\\result_bou.jpg')
        os.system("cd C:\\AIStructureGenerator && C: && python test.py --name Damselfly_2 --dataroot ./datasets/Damselfly_2/ --no_instance --label_nc 0 --loadSize 1000 --fineSize 1000 --resize_or_crop none --how_many 1 --gpu_ids 0")
        shutil.copy(r'C:\\AIStructureGenerator\\results\\Damselfly_2\\test_latest\\images\\test_synthesized_image.jpg', r'C:\\AIStructureGenerator\\results\\result.jpg')
    elif type=="GrasshopperWings":
        os.system("cd C:\\AIStructureGenerator && C: && python test.py --name GH_1 --dataroot ./datasets/GH_1/ --no_instance --label_nc 0 --loadSize 1000 --fineSize 1000 --resize_or_crop none --how_many 1 --gpu_ids 0")
        shutil.copy(r'C:\\AIStructureGenerator\\results\\GH_1\\test_latest\\images\\test_synthesized_image.jpg', r'C:\\AIStructureGenerator\\datasets\\GH_2\\test_A\\test.jpg')
        shutil.copy(r'C:\\AIStructureGenerator\\results\\GH_1\\test_latest\\images\\test_synthesized_image.jpg', r'C:\\AIStructureGenerator\\results\\result_bou.jpg')
        os.system("cd C:\\AIStructureGenerator && C: && python test.py --name GH_2 --dataroot ./datasets/GH_2/ --no_instance --label_nc 0 --loadSize 1000 --fineSize 1000 --resize_or_crop none --how_many 1 --gpu_ids 0")
        shutil.copy(r'C:\\AIStructureGenerator\\results\\GH_2\\test_latest\\images\\test_synthesized_image.jpg', r'C:\\AIStructureGenerator\\results\\result.jpg')
    elif type=="AmazonWaterLily":
        os.system("cd C:\\AIStructureGenerator && C: && python test.py --name AWL_1 --dataroot ./datasets/AWL_1/ --no_instance --label_nc 0 --loadSize 1000 --fineSize 1000 --resize_or_crop none --how_many 1 --gpu_ids 0")
        shutil.copy(r'C:\\AIStructureGenerator\\results\\AWL_1\\test_latest\\images\\test_synthesized_image.jpg', r'C:\\AIStructureGenerator\\datasets\\AWL_2\\test_A\\test.jpg')
        shutil.copy(r'C:\\AIStructureGenerator\\results\\AWL_1\\test_latest\\images\\test_synthesized_image.jpg', r'C:\\AIStructureGenerator\\results\\result_bou.jpg')
        os.system("cd C:\\AIStructureGenerator && C: && python test.py --name AWL_2 --dataroot ./datasets/AWL_2/ --no_instance --label_nc 0 --loadSize 1000 --fineSize 1000 --resize_or_crop none --how_many 1 --gpu_ids 0")
        shutil.copy(r'C:\\AIStructureGenerator\\results\\AWL_2\\test_latest\\images\\test_synthesized_image.jpg', r'C:\\AIStructureGenerator\\results\\result.jpg')
        
    file_path = 'C:\\AIStructureGenerator\\results\\result.jpg'
# ---------- end generate_force_image ----------
place_force_image = GhPythonScript(
    pt1=generate_input_image.pt_10,
    pt2=generate_input_image.pt_8,
    pt3=generate_input_image.pt_9,
    file_path=generate_force_image.file_path,
    run=Toggle(False))  # inputs pt1: Point3d, pt2: Point3d, pt3: Point3d, run: Boolean
# ---------- place_force_image: Python ----------
__author__ = "Platina"
__version__ = "2021.07.19"

import rhinoscriptsyntax as rs
import ghpythonlib.components as gh

if run:
    
    """
    x1,y1,z1 = gh.DeconstructVector(pt1)
    x2,y2,z2 = gh.DeconstructVector(pt2)
    x3,y3,z3 = gh.DeconstructVector(pt3)
    
    pt1 = gh.ConstructPoint(x1-(x3-x1)/24,y1,z1)
    pt2 = gh.ConstructPoint(x2-(x3-x1)/24,y2,z2)
    pt3 = gh.ConstructPoint(x3-(x3-x1)/24,y3,z3)
    """
    
    cmd = "_-Pictureframe " + file_path + " " + "3Point" + " " + str(pt1) + " " + str(pt2) + " " + str(pt3) + " " + " _EnterEnd"
    
    rs.Command(cmd, True)
# ---------- end place_force_image ----------
generate_force_geometry_dragonfly_wing = Generate_Force_GeometryDragonflyWing(
    pt=generate_input_image.pt_10,
    pt_3=generate_input_image.pt_8,
    pt_2=generate_input_image.pt_9,
    txt=generate_force_image.file_path,
    bool=Toggle(False))  # -> L, G_2, G, G_4, G_6, G_5, G_3

# ----
# 02 GENERATING FORCE IMAGE
# 03 option 1 - switch to True - to recognize the image and generate the force geometry
# You should bake the geometry to Rhino or place the image in Rhino, and then adjust or draw the geometry by hand. Make sure the force diagram is a network that only contains closed and convex polygons. All nodes in the network should have a number of connecting edges larger than or equal to three.
# 03 option 2 - switch to True - to place the generated image in Rhino
panel_4 = Panel("01 - switch to True")
# Visit our github page of this project for more information. https://github.com/HaoZhengUPenn/AIStructureGenerator
generate_input_image_2 = Generate_Input_Image(txt=select_mode, crv=form_boundary, run=Toggle(False))  # -> file_path, pt_10, pt_8, pt_9
generate_force_image_2 = GhPythonScript(type=select_mode, file_path=generate_input_image_2.file_path, run=Toggle(False))  # -> out, file_path; inputs run: Boolean; same code as generate_force_image
place_force_image_2 = GhPythonScript(
    pt1=generate_input_image_2.pt_10,
    pt2=generate_input_image_2.pt_8,
    pt3=generate_input_image_2.pt_9,
    file_path=generate_force_image_2.file_path,
    run=Toggle(False))  # inputs pt1: Point3d, pt2: Point3d, pt3: Point3d, run: Boolean; same code as place_force_image
generate_force_geometry_dragonfly_wing_2 = Generate_Force_GeometryDragonflyWing(
    pt=generate_input_image_2.pt_10,
    pt_3=generate_input_image_2.pt_8,
    pt_2=generate_input_image_2.pt_9,
    txt=generate_force_image_2.file_path,
    bool=Toggle(False))  # -> L, G_2, G, G_4, G_6, G_5, G_3

crv = Curve(generate_force_geometry_dragonfly_wing.G_5)
group = Group(Objects=crv)
merge = Merge(Data1=loop_start.Data, Data2=group)  # -> flatten(Result)
loop_end = LoopEnd(port=loop_start.port, Exit=False, Data=merge, TimeOutVal=0, pausedState=False, state="Constant output")
dam = DataDam(DataA=loop_end, BufferDelay=10000000, BufferMode=0)
crv_2 = Curve(generate_force_geometry_dragonfly_wing_2.G_5)

# ----
# 03 PREDICTING EDGE LENGTH 3D OPTION 2
# This part 03 can be separately executed without the result from part 02. It only needs an input of the force geometry as described in part 02.
# 01 - input the force geometry
# 01.5 - input the height of the force
number_slider = Slider(1000, range=0..10000)  # disabled
panel_6 = Panel("02 - switch to True")  # disabled
toggle = BooleanToggle(False)  # disabled
force_geometry = Curve(crv_2)  # disabled
generate_dual = Generate_Dual_2(crv=force_geometry, num=number_slider, bool=toggle)  # disabled
panel_7 = Panel("03 - switch to True")  # disabled
toggle_2 = BooleanToggle(False)  # disabled
generate_ann_input = Generate_ANN_Input(crv=generate_dual, bool=toggle_2)  # disabled
panel_8 = Panel("04 - switch to True")  # disabled
toggle_3 = BooleanToggle(False)  # disabled
generate_form_length = GhPythonScript(type=select_mode, file_path=generate_ann_input, run=toggle_3)  # -> out, file_path; inputs run: Boolean; disabled
# ---------- generate_form_length: Python ----------
__author__ = "Platina"
__version__ = "2021.07.19"

#encoding=utf-8
import os
import rhinoscriptsyntax as rs
DETACHED_PROCESS = 0x00000010

if run:
    
    os.system("cd C:\\AIStructureGenerator\\ANN && C: && python main.py "+type)
    
    file_path = "C:\\AIStructureGenerator\\ANN\\results.csv"
# ---------- end generate_form_length ----------

cluster_2 = Cluster_7(data=dam, A=neg, P=cluster.pt_3)  # -> G, Q

# ----
# 03 PREDICTING EDGE LENGTH
# This part 03 can be separately executed without the result from part 02. It only needs an input of the force geometry as described in part 02.
# 01 - input the force geometry
panel_9 = Panel("02 - switch to True")
force_geometry_2 = Curve(crv_2)
generate_dual_2 = Generate_Dual(crv=force_geometry_2, bool=Toggle(False))
panel_10 = Panel("03 - switch to True")
generate_ann_input_2 = Generate_ANN_Input(crv=generate_dual_2, bool=Toggle(False))
panel_11 = Panel("04 - switch to True")
generate_form_length_2 = GhPythonScript(type=select_mode, file_path=generate_ann_input_2, run=Toggle(False))  # -> out, file_path; inputs run: Boolean; same code as generate_form_length

# ----
# 03 PREDICTING EDGE LENGTH 3D OPTION 3
number_slider_2 = Slider(3000, range=0..10000)  # disabled
toggle_4 = BooleanToggle(False)  # disabled
force_geometry_3 = Curve(crv_2)  # disabled
button = Button()  # disabled
cluster_3 = Cluster_3(crv_2=force_geometry_3, crv=form_boundary, pt=form_anchors, x=number_slider_2)  # -> pt_6, srf_3, G, R, num_2; disabled
solver = Solver(GoalObjects=cluster_3.R, Reset=button, Threshold=1e-15, Tolerance=0.01, On=True)  # -> I, V, O; disabled
dam_2 = DataDam(DataA=solver.V, BufferDelay=10000000, BufferMode=0)  # disabled
cluster_4 = Cluster_4(P=dam_2, P_2=cluster_3.pt_6, srf_3=cluster_3.srf_3, F=cluster_3.num_2, G=cluster_3.G)  # disabled
python = GhPythonScript(run=toggle_4, geo=cluster_4)  # -> out, Form_InternalLines; inputs geo: list of Brep; disabled; same code as python
toggle_5 = BooleanToggle(False)  # disabled
cluster_5 = Cluster_5(crv=form_boundary, crv_2=python.Form_InternalLines, pt=form_anchors, num=cluster_3.num_2, pleaserun=toggle_5)  # disabled

data = Data(cluster_2.G)
crv_3 = Curve(cluster_2.Q)

# ----
# 03 PREDICTING EDGE LENGTH
# This part 03 can be separately executed without the result from part 02. It only needs an input of the force geometry as described in part 02.
# 01 - input the force geometry
panel_12 = Panel("02 - switch to True")
force_geometry_4 = Curve(crv_3)
generate_dual_3 = Generate_Dual(crv=force_geometry_4, bool=Toggle(False))
generate_ann_input_3 = Generate_ANN_Input(crv=generate_dual_3, bool=Toggle(False))
generate_form_length_3 = GhPythonScript(type=select_mode, file_path=generate_ann_input_3, run=Toggle(False))  # -> out, file_path; inputs run: Boolean; same code as generate_form_length

# ----
# 04 (optional) OPTIMIZING EDGE LENGTH
# This part 04 is optional and each sub-part is separate. Generate_Optimization_Training_Data generates the training data in “./ANN2/data.csv”, it will add new pieces of data when running each time. Train_Optimization_Model trains the ANN model using the data, and it results in a series of model files in “./ANN2/model”. Find_Optimization_SA uses the trained ANN model and find the optimal using Simulated Annealing (SA) as “./ANN2/results.csv”. If you already generated enough data, you can skip Generate_Optimization_Training_Data. If you already trained the model, you can skip Train_Optimization_Model. If you don’t want to include the optimization, you can skip Find_Optimization_SA.
# 01 - input the number of training samples that you want to generate
# 02 - switch to True - to generate training samples
# 03 - switch to True - to train the optimization ANN
# 04 - switch to True - to find the optimal using Simulated Annealing (SA) with the results from ANN
number_slider_3 = Slider(300, range=0..1000)
generate_optimization_training_data = Generate_Optimization_Training_Data(
    crv_2=form_boundary,
    crv=generate_dual_2,
    txt=generate_form_length_2.file_path,
    int=number_slider_3,
    pleaserun=Toggle(False))
find_optimization_sa = GhPythonScript(run=Toggle(False))  # inputs run: Boolean
# ---------- find_optimization_sa: Python ----------
__author__ = "Platina"
__version__ = "2021.07.19"

#encoding=utf-8
import os
import rhinoscriptsyntax as rs
DETACHED_PROCESS = 0x00000010

if run:
    
    os.system("cd C:\\AIStructureGenerator\\ANN2 && C: && python SA.py ")
    
    file_path = "C:\\AIStructureGenerator\\ANN2\\results.csv"
    
else:
    
    file_path = ""
# ---------- end find_optimization_sa ----------
train_optimization_model = GhPythonScript(run=Toggle(False))  # inputs run: Boolean
# ---------- train_optimization_model: Python ----------
__author__ = "Platina"
__version__ = "2021.07.19"

#encoding=utf-8
import os
import rhinoscriptsyntax as rs
DETACHED_PROCESS = 0x00000010

if run:
    
    os.system("cd C:\\AIStructureGenerator\\ANN2 && C: && python train.py ")
    
    file_path = "C:\\AIStructureGenerator\\ANN2\\model\\model999.ckpt"
# ---------- end train_optimization_model ----------

# ----
# 05 GENERATING FORM 3D OPTION 2
# This part 05 can be separately executed without the result from part 02 and 04. It only needs the result from part 03.
# 01 - input the tolerance of the edge length (default 0.3)
# 02 - input whether to include the optimization of the edge length
panel_15 = Panel("03 - switch to True")  # disabled
number_slider_4 = Slider(0.3, range=0..1)  # disabled
toggle_6 = BooleanToggle(False)  # disabled
toggle_7 = BooleanToggle(False)  # disabled
generate_structural_form = Generate_Structural_Form_3(
    crv=force_geometry,
    num=number_slider,
    crv_3=form_boundary,
    crv_5=generate_dual,
    F=generate_form_length.file_path,
    num_5=number_slider_4,
    bool=toggle_7,
    pleaserun=toggle_6)  # disabled

# ----
# 05 GENERATING FORM 3D OPTION 1
# This part 05 can be separately executed without the result from part 02 and 04. It only needs the result from part 03.
# 01 - input the tolerance of the edge length (default 0.3)
# 02 - input whether to include the optimization of the edge length
panel_16 = Panel("03 - switch to True")  # disabled
number_slider_5 = Slider(0.3, range=0..1)  # disabled
toggle_8 = BooleanToggle(False)  # disabled
toggle_9 = BooleanToggle(False)  # disabled
generate_structural_form_2 = Generate_Structural_Form_2(
    srf=_3d,
    crv_2=generate_dual_2,
    F=generate_form_length_2.file_path,
    num_3=number_slider_5,
    bool=toggle_9,
    pleaserun=toggle_8)  # disabled

# ----
# 05 GENERATING FORM
# This part 05 can be separately executed without the result from part 02 and 04. It only needs the result from part 03.
# 01 - input the tolerance of the edge length (default 0.3)
# 02 - input whether to include the optimization of the edge length
panel_17 = Panel("03 - switch to True")
generate_structural_form_3 = Generate_Structural_Form(
    crv=form_boundary,
    crv_3=generate_dual_2,
    F=generate_form_length_2.file_path,
    num_3=Slider(0.3, range=0..1),
    bool=Toggle(False),
    pleaserun=Toggle(False))

# ----
# 05 GENERATING FORM
# This part 05 can be separately executed without the result from part 02 and 04. It only needs the result from part 03.
# 01 - input the tolerance of the edge length (default 0.3)
# 02 - input whether to include the optimization of the edge length
panel_18 = Panel("03 - switch to True")
generate_structural_form_4 = Generate_Structural_Form(
    crv=cluster.C,
    crv_3=generate_dual_3,
    F=generate_form_length_3.file_path,
    num_3=Slider(0.3, range=0..1),
    bool=Toggle(False),
    pleaserun=Toggle(False))

# ==== cluster Generate_Input_Image
crv = ClusterInput()
run = ClusterInput()
txt = ClusterInput()
crv_2 = Curve(crv)
python = GhPythonScript(run=run)  # -> out, a, b; inputs run: Boolean
# ---------- python: Python ----------
__author__ = "Platina"
__version__ = "2021.07.19"

import rhinoscriptsyntax as rs

if run:
    a = 1024
    b = 512
else:
    a = 0
    b = 0
# ---------- end python ----------
txt_2 = Text(txt)
brec = BoundingRectangle(Geometry=crv_2, Plane=PlaneXY(0, 0, 0), Axis=0, Slide=0, Union=True)  # -> Bounding, DimensionX, DimensionY
drec = DeconstuctRectangle(Rectangle=brec.Bounding)  # -> BasePlane, XInterval, YInterval
dedomain = DeconstructDomain(Domain=drec.YInterval)  # -> Start, End
dedomain_2 = DeconstructDomain(Domain=drec.XInterval)  # -> Start, End
subtraction = Subtraction(A=dedomain.End, B=dedomain.Start)
subtraction_2 = Subtraction(A=dedomain_2.End, B=dedomain_2.Start)
python_2 = GhPythonScript(x=subtraction_2, y=subtraction, z=Slider(1.7, range=0..10))  # -> out, a, b
# ---------- python_2: Python ----------
__author__ = "Platina"
__version__ = "2021.07.19"

import rhinoscriptsyntax as rs

if x>2*y:
    a = x
    b = x/2
else:
    a = 2*y
    b = y

a = a/2*z
b = b/2*z
# ---------- end python_2 ----------
pt = Point(drec.BasePlane)
pdecon = Deconstruct(Point=pt)  # -> XComponent, YComponent, ZComponent
subtraction_3 = Subtraction(A=pdecon.XComponent, B=python_2.a)
subtraction_4 = Subtraction(A=pdecon.YComponent, B=python_2.b)
addition = Addition(A=pdecon.YComponent, B=python_2.b)
addition_2 = Addition(A=pdecon.XComponent, B=python_2.a)
pt_2 = ConstructPoint(XCoordinate=addition_2, YCoordinate=addition, ZCoordinate=0)
pt_3 = ConstructPoint(XCoordinate=subtraction_3, YCoordinate=subtraction_4, ZCoordinate=0)
pdecon_2 = Deconstruct(Point=pt_2)  # -> XComponent, YComponent, ZComponent
pdecon_3 = Deconstruct(Point=pt_3)  # -> XComponent, YComponent, ZComponent
subtraction_5 = Subtraction(A=pdecon_2.YComponent, B=pdecon_3.YComponent)
division = Division(A=subtraction_5, B=6)
addition_3 = Addition(A=pdecon.YComponent, B=division)
pt_4 = ConstructPoint(XCoordinate=pdecon.XComponent, YCoordinate=addition_3, ZCoordinate=pdecon.ZComponent)
addition_4 = Addition(A=pdecon_3.YComponent, B=division)
addition_5 = Addition(A=pdecon_2.YComponent, B=division)
pt_5 = ConstructPoint(XCoordinate=pdecon_3.XComponent, YCoordinate=addition_4, ZCoordinate=pdecon_3.ZComponent)
pt_6 = ConstructPoint(XCoordinate=pdecon_2.XComponent, YCoordinate=addition_5, ZCoordinate=pdecon_2.ZComponent)
multiplication = Multiplication(A=python_2.a, B=2)
multiplication_2 = Multiplication(A=python_2.b, B=2)
xz = XZPlane(Origin=pt_4)
division_2 = Division(A=multiplication, B=1024)
division_3 = Division(A=multiplication_2, B=512)
dom = ConstructDomain(DomainStart=0, DomainEnd=division_3)
dom_2 = ConstructDomain(DomainStart=0, DomainEnd=division_2)
rectangle = Rectangle(Plane=pt_5, XSize=dom_2, YSize=dom, Radius=0)  # -> Rectangle, Length
arrrec = RectangularArray(Geometry=pt_5, Cell=rectangle.Rectangle, XCount=python.a, YCount=python.b)  # -> Geometry, Transform
item = ListItem(List=arrrec.Geometry, Index=1023, Wrap=True)
pt_7 = Point(item)
mirror = Mirror(Geometry=arrrec.Geometry, Plane=xz)  # -> Geometry, Transform
incurve = PointInCurve(Point=mirror.Geometry, Curve=crv_2)  # -> Relationship, Point
python_3 = GhPythonScript(type=txt_2, x=incurve.Relationship)  # -> out, file_path; inputs x: list of Int32
# ---------- python_3: Python ----------
__author__ = "Platina"
__version__ = "2021.07.19"

import rhinoscriptsyntax as rs
import System

a = System.Drawing.Bitmap(512,1024)

count = 0
for i in range(512):
    for j in range(1024):
        if x[count]==2:
            a.SetPixel(i,j,System.Drawing.Color.FromArgb(0,0,0))
        else:
            a.SetPixel(i,j,System.Drawing.Color.FromArgb(255,255,255))
        count += 1

a.RotateFlip(System.Drawing.RotateFlipType.Rotate90FlipX)

file_path = "C:\\AIStructureGenerator\\datasets\\test.jpg"

System.Drawing.Bitmap.Save(a,file_path)

if type=="DragonflyWings":
    file_path = "C:\\AIStructureGenerator\\datasets\\fmb_to_fcb\\test_A\\test.jpg"
elif type=="DamselflyWings":
    file_path = "C:\\AIStructureGenerator\\datasets\\Damselfly_1\\test_A\\test.jpg"
elif type=="GrasshopperWings":
    file_path = "C:\\AIStructureGenerator\\datasets\\GH_1\\test_A\\test.jpg"
elif type=="AmazonWaterLily":
    file_path = "C:\\AIStructureGenerator\\datasets\\AWL_1\\test_A\\test.jpg"

System.Drawing.Bitmap.Save(a,file_path)
# ---------- end python_3 ----------
file_path = ClusterOutput(python_3.file_path)
pt_8 = ClusterOutput(pt_7)
pt_9 = ClusterOutput(pt_6)
pt_10 = ClusterOutput(pt_5)

# ==== cluster Generate_Dual
crv = ClusterInput()
crv_2 = Curve(crv)
explode = Explode(Curve=crv_2, Recursive=True)  # -> flatten(Segments), Vertices
dupln = RemoveDuplicateLines(Lines=explode.Segments, Tolerance=0.01)
crv_3 = Curve(dupln)

grid_divisions = Integer(20)
crv_4 = Curve(simplify(crv_3))
x_bounds = Domain(Domain(1950, 3650))
y_bounds = Domain(Domain(2750, 3550))

dom² = Domain²(DomainU=x_bounds, DomainV=y_bounds)
hem_open_xy_networks = VBScript(seg=crv_4, bnd=dom², sbdv=grid_divisions)  # -> out, flatten(e), flatten(eOV), flatten(ePE), flatten(eNE), flatten(eTE), flatten(eIF), flatten(v)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; inputs seg: list of Curve
# ---------- hem_open_xy_networks: VB ----------
    Dim edgeList As New list(Of Line)
    Dim eOVlist As New dataTree(Of int32)
    Dim ePElist As New dataTree(Of int32)
    Dim eNElist As New dataTree(Of int32)
    Dim eTElist As New list(Of int32)
    Dim eIFlist As New list(Of int32)
    Dim vtxList As New list(Of point3d)
    Dim vIElist As New list(Of int32)
    Dim fList As New datatree(Of point3d)
    Dim fIElist As New dataTree(Of int32)

    Dim vIEall As New dataTree(Of int32)
    Dim eF As New list(Of Boolean)

    Dim eDegList As New List(Of Double)

    '********FOR EACH SEGMENT, ADD EDGE AND ITS REVERSE (twin) TO edgeList********
    Dim segCt As int32 = 0
    For i As int32=0 To seg.count - 1
      If seg(i).pointAtStart.distanceto(seg(i).pointAtEnd) > 0 Then
        edgeList.add(New Line(seg(i).pointAtStart, seg(i).pointAtEnd))
        edgeList.add(New Line(seg(i).pointAtEnd, seg(i).pointAtStart))
        eTEList.add((segCt * 2) + 1)
        eTEList.add((segCt * 2))
        'DEFAULT SETTING FOR ef IS TRUE (ie EDGE NEEDS TO BE ASSIGNED TO A FACE)
        ef.add(True)
        ef.add(True)
        eIFlist.add(-10)
        eIFlist.add(-10)

        EdgeDirection(edgeList(edgeList.count - 2), eDegList)
        segCt += 1
      End If
    Next

    Dim vtxTree As New dataTree(Of point3d)
    Dim vNdxTree As New dataTree(Of Int32)
    For i As int32=0 To sbdv - 1
      For j As int32=0 To sbdv - 1
        vtxTree.ensurepath(New gh_path(i, j))
        vNdxTree.ensurepath(New gh_path(i, j))
      Next
    Next


    '********CONSTRUCT VERTEX LIST FROM LIST OF HALF-EDGES********
    For i As int32=0 To edgeList.count - 1
      'boolCk = (is there a close point?, what is the index)
      Dim boolCk() As int32 = {0,-10}

      Dim vCt As int32 = vtxTree.datacount
      CheckLinePt(edgeList(i), vtxTree, vNdxTree, boolCk, bnd, sbdv, 0)

      'IF A NEW VERTEX WAS ADDED, THEN ADD EDGE INDEX TO vIE, vIEall, AND eOV
      If vtxTree.datacount > vCt Then
        vIElist.add(i)
        vIEall.add(i, New GH_Path(boolCk(1)))
        eOVlist.add(boolCk(1), New GH_Path(i))

      Else If boolCK(1) >= 0 Then
        vIEall.add(i, New GH_Path(boolCK(1)))
        eOVlist.add(boolCK(1), New GH_Path(i))
      End If
    Next



    '********FROM EACH HALF-EDGE..
    For i As int32=0 To edgeList.count - 1
      Dim boolCk() As int32 = {0,-10}
      'FIND VERTEX CORRESPONDING TO ENDPOINT (=boolCk(1))
      CheckLinePt(edgeList(i), vtxTree, vNdxTree, boolCk, bnd, sbdv, 1)

      'boolCk(1)=TARGET VERTEX, CHECK ANGLE OF ALL EDGES LEAVING THIS VERTEX
      Dim nxtVtxPth As New gh_path(boolCk(1))
      Dim angCk As Double = -100
      Dim ndx As int32 = -10
      'Dim xProd As vector3d = vector3d.CrossProduct(edgeList(i).direction, vector3d.ZAxis)



      '..FIND NEXT EDGE********
      For j As int32=0 To vIEall.branch(nxtVtxPth).count - 1
        If i <> eTElist(vIEall(nxtVtxPth, j)) Then
          Dim ang As Double = eDegList(eTElist(i)) - eDegList(vIEall(nxtVtxPth, j))
          If ang < 0 Then ang += 360
          If ang > angCk  Then
            angCk = ang
            ndx = j
          End If
        End If
      Next

      If ndx >= 0 Then
        eNElist.add(vIEall(nxtVtxPth, ndx), New GH_Path(i))
        ePElist.add(i, New GH_Path(vIEall(nxtVtxPth, ndx)))
      Else
        'NO NEXT EDGE FOUND, THEN NEXT EDGE IS TWIN
        angCk = math.PI
        ndx = eTElist(i)
        eNElist.add(eTElist(i), New GH_Path(i))
        ePElist.add(i, New GH_Path(eTElist(i)))
      End If
    Next



    '********FIND EDGE-LOOPS / 'FACES'********
    Dim faceCt As int32 = 0
    For i As int32=0 To edgeList.count - 1
      If ef(i) Then
        fList.add(edgeList(i).pointAt(0), New gh_path(faceCt))
        fIEList.add(i, New gh_path(faceCt))
        eIFlist(i) = faceCt
        ef(i) = False
        loopFace(edgeList, ef, eNElist, eNElist(New GH_Path(i), 0), i, fIElist, fList, eIFlist, faceCt)
        faceCt += 1
      End If
    Next


    '********CONVERT vtxTree (SORTED IN BRANCHES BY LOCATION IN GRID)TO LIST (IN ORDER OF INDEX VALUE)********
    For i As int32=0 To vtxTree.datacount - 1
      vtxList.add(Nothing)
    Next
    For i As int32=0 To vtxTree.datacount - 1
      Dim sortNdx As int32 = vNdxTree.alldata(i)
      vtxList(sortNdx) = vtxTree.alldata(i)
    Next

    e = edgeList
    eOV = eOVlist
    eNE = eNElist
    ePE = ePElist
    eTE = eTElist
    eIF = eIFlist
    v = vtxList ' vtxTree
    vIE = vIEall
    f = fList
    fIE = fIElist

    '********PRINT HEM STATS********
    print(vtxList.count & " vertices")
    print(faceCt & " faces")
    print(edgeList.count & " ½ edges")
# ---------- hem_open_xy_networks: VB additional code ----------
  Sub CheckLinePt(ByVal eCurr As Line, ByRef vTree As datatree(Of point3d), ByRef nTree As datatree (Of int32), ByRef ck As Array, ByVal dom As UVInterval, ByVal div As int32, ByVal t As Double)
    'WHEN t=0: CHECKING START POINT; WHEN t=1: CHECKING END POINT
    Dim ptCk As New point3d(eCurr.PointAt(t))

    'POINT VALUE (MINUS DOMAIN STARTING POINT) DIVIDED BY STEP, FLOORED
    Dim pthX As int32 = Math.floor((ptCk.X - dom.u0) / ((dom.U1 - dom.U0) / div))
    Dim pthY As int32 = Math.floor((ptCk.y - dom.v0) / ((dom.v1 - dom.v0) / div))
    pthX = math.min(math.Max(pthX, 0), div - 1)
    pthY = math.min(math.Max(pthY, 0), div - 1)
    Dim pthXY As New gh_path(pthX, pthY)
    ck(1) = -10

    'CHECK ALREADY ADDED NODES
    If vTree.pathExists(pthXY) Then
      For j As int32=0 To vTree.branch(pthXY).count - 1
        If ptCk.DistanceTo(vTree(pthXY, j)) < .1 Then
          ck(0) += 1
          ck(1) = nTree(pthXY, j)
          Exit For
        End If
      Next
    End If

    'IF NOT ALREADY ADDED, THEN ADD
    If  ck(0) = 0 AndAlso ck(1) < 0 Then
      ck(1) = vTree.datacount
      nTree.add(vTree.datacount, pthXY)
      vTree.add(ptCk, pthXY)
    End If

  End Sub


  Sub EdgeDirection(ByRef eCurr As Line, ByRef degList As List(Of Double))
    'FIND DIRECTION OF EDGE
    Dim deg As Double
    If eCurr.direction.x = 0 Then
      deg = (90 * (eCurr.Direction.Y / math.abs(eCurr.Direction.Y))) + 360
      deg = (360 + deg) Mod 360
    Else
      deg = ((math.atan(eCurr.Direction.Y / eCurr.Direction.x)) * 180 / math.PI)
      If eCurr.Direction.X < 0 Then deg = 180 + deg
      If eCurr.Direction.X > 0  Then deg = (360 + deg) Mod 360
    End If

    degList.add(deg)
    degList.add((deg + 180) Mod 360)
  End Sub


  Sub loopFace(ByVal eList As list(Of line), ByRef ck As list(Of Boolean), ByVal eNE As datatree(Of int32), ByVal n As int32, ByVal init As int32, ByRef fList As datatree(Of int32), ByRef f As datatree(Of point3d), ByRef efList As List(Of int32), ByRef ct As int32)
    If n <> init Then
      f.add(eList(n).pointAt(0), New gh_path(ct))
      fList.add(n, New gh_path(ct))
      efList(n) = ct
      ck(n) = False
      loopFace(eList, ck, eNE, eNE(New GH_Path(n), 0), init, fList, f, efList, ct)
    End If
  End Sub
# ---------- end hem_open_xy_networks ----------
pline = PolyLine(Vertices=hem_open_xy_networks.f, Closed=True)
flatten = FlattenTree(Tree=pline, Path="{0}")
srf = Surface(flatten)
area = Area(Geometry=srf)  # -> Area, Centroid
sort = SortList(Keys=area.Area, ValuesA=flatten)  # -> Keys, ValuesA

# ---- group: make lines to polygons
shift = ShiftList(List=sort.ValuesA, Shift=-1, Wrap=False)

# ----
graft = GraftTree(Tree=shift, IncludeEmptyLists=True, IncludeNullItems=True)
boundary = BoundarySurfaces(Edges=graft)  # -> flatten(Surfaces)
srf_2 = Surface(boundary)
Z = UnitZ(Factor=50)
extr = Extrude(Base=srf_2, Direction=Vector(0, 0, -100))
bool = ClusterInput()
move = Move(Geometry=extr, Motion=Z)  # -> Geometry, Transform
bool_2 = Boolean(bool)
python = GhPythonScript(run=bool_2, geo=move.Geometry)  # -> out, Form_InternalLines; inputs geo: list of Brep
# ---------- python: Python ----------
__author__ = "Hao"
__version__ = "2018.1.28"


import rhinoscriptsyntax as rs
import scriptcontext as sc
import Rhino
import ghpythonlib.treehelpers as ghtree
import math
import ghpythonlib.components as gh

import clr
import os
import time
clr.AddReferenceToFileAndPath("C:\\PolyFramework\\PolyFramework.dll")

import Rhino.Geometry as rg
import PolyFramework as pf

if run:
    
    sc.doc = Rhino.RhinoDoc.ActiveDoc
    rhdoc = Rhino.RhinoDoc.ActiveDoc
    
    rs.AddLayer("temp")
    a = rs.ObjectsByLayer("temp")
    rs.DeleteObjects(a)
    
    rl = Rhino.DocObjects.ObjectAttributes()
    rl.LayerIndex = rhdoc.Layers.FindName("temp").Index
    for geoi in geo:
        rhdoc.Objects.Add(geoi,rl)
    
    rs.Command("_SelLayerNumber "+str(rhdoc.Layers.FindName("temp").Index))
    rs.Command("PFBuild _Enter _Enter _Enter")
    rs.Command("_SelLayerNumber "+str(rhdoc.Layers.FindName("_Force_Lines").Index))
    rs.Command("PFDual _Enter _Enter _Enter _Enter")
    
    Form_InternalLines = rs.ObjectsByLayer("_Form_InternalLines")
# ---------- end python ----------
form_internallines = ClusterOutput(python.Form_InternalLines)

# ==== cluster Generate_ANN_Input
bool = ClusterInput()
crv = ClusterInput()
bool_2 = Boolean(bool)
crv_2 = Curve(crv)
python = GhPythonScript(Form_InternalLines=crv_2, pleaserun=bool_2)  # -> out, linestemp, edgetemp, facetemp; inputs Form_InternalLines: list of Curve, pleaserun: Boolean
# ---------- python: Python ----------
__author__ = "Platina"
__version__ = "2019.12.15"

import rhinoscriptsyntax as rs
import scriptcontext as sc
import Rhino
import ghpythonlib.treehelpers as ghtree
import math
import ghpythonlib.components as gh

import clr
import os
import time
clr.AddReferenceToFileAndPath("C:\\PolyFramework\\PolyFramework.dll")

import Rhino.Geometry as rg
import PolyFramework as pf

if pleaserun:
    rhdoc = Rhino.RhinoDoc.ActiveDoc
    linestemp = []
    edgetemp = []
    facetemp = []
    rs.Command("_SelLayerNumber "+str(rhdoc.Layers.FindName("_Form_InternalLines").Index))
    primal = pf.PFoam()
    dual = pf.PFoam()
    containerType = pf.ContainerType
    multiData = pf.LoadData.LoadPrimalDual(True)
    guids = multiData[0]
    primal = multiData[1]
    dual = multiData[2]
    containerType = multiData[3]
    for edge in primal.Edges:
        if (edge.Dual) and (edge.Id>=0):
            if (edge.GetLength()>0) and (edge.Dual.Area>0):
                linestemp.append(edge.CreateLine())
                edgelength = edge.GetLength()
                edgetemp.append(edge.GetLength())
                facearea = edge.Dual.Area
                facetemp.append(edge.Dual.Area)
# ---------- end python ----------
curvepoint = PointOnCurve(python.linestemp, parameter=0.5)
curvepoint_2 = PointOnCurve(crv_2, parameter=0.5)
cp = ClosestPoint(Point=curvepoint_2, Cloud=curvepoint)  # -> ClosestPoint, CPIndex, Distance
item = ListItem(List=python.facetemp, Index=cp.CPIndex, Wrap=True)
end = EndPoints(Curve=crv_2)  # -> Start, End
pdecon = Deconstruct(Point=end.Start)  # -> XComponent, YComponent, ZComponent
pdecon_2 = Deconstruct(Point=end.End)  # -> XComponent, YComponent, ZComponent
merge = Merge(
    Data1=simplify(graft(pdecon.XComponent)),
    Data2=simplify(graft(pdecon.YComponent)),
    Data3=simplify(graft(pdecon_2.XComponent)),
    Data4=simplify(graft(pdecon_2.YComponent)),
    Data5=simplify(graft(item)))
merge_2 = Merge(
    Data1=simplify(graft(pdecon_2.XComponent)),
    Data2=simplify(graft(pdecon_2.YComponent)),
    Data3=simplify(graft(pdecon.XComponent)),
    Data4=simplify(graft(pdecon.YComponent)),
    Data5=simplify(graft(item)))
join = TextJoin(Text=merge_2, Join=",")  # -> flatten(Result)
join_2 = TextJoin(Text=merge, Join=",")  # -> flatten(Result)
merge_3 = Merge(Data1=join_2, Data2=join)  # -> flatten(Result)
panel = Panel(merge_3)
python_2 = FileCreator(name="C:\AIStructureGenerator\ANN\pre", ext="csv", lines=merge_3, write=bool_2)  # -> file_path; inputs lines: list, write: Boolean
# ---------- python_2: Python ----------
"""
Creates a file with a given ndame and extension.
    Inputs:
        name: Desired file name.
        ext: Desired file extension.
        lines: Text to write.
        write: Set to True to write.
"""

# Stephen P. Maher /  2015

ghenv.Component.Name = "File Creator"

import Grasshopper as gh
import os

gh_path = ghdoc.Path # Get GH file path
file = os.path.dirname(os.path.realpath(gh_path)) # Get GH file directory to save to

if "." not in ext: ext = "." + ext
else: pass

#if os.path.exists(file) == False: # Test if file already exists; if it doesn't, proceed
file = name + ext # Set file name and extension
#if os.path.exists(file) == True: # If it does exists, follow the next steps
#    file_count = len([f for f in os.walk(".").next()[2] if f[-4:] == ext]) # Find all files with the same extension
#    file = name + "_" + str(file_count) + ext # Add the number to the new file name as a differentiator

if write:
    filePath = open(file, "w") # Open the file
    for line in lines: # Iterate through lines
        filePath.write(line + "\n") # Write separate lines
    filePath.close() # Close the file
else:
    msg = "Set 'write' to True."
    ghenv.Component.AddRuntimeMessage(gh.Kernel.GH_RuntimeMessageLevel.Warning, msg)

file_path = file
# ---------- end python_2 ----------
file_path = ClusterOutput(python_2)

# ==== cluster Generate_Structural_Form
pleaserun = ClusterInput()
F = ClusterInput()
crv = ClusterInput()
python = GhPythonScript(file_path=F, run=pleaserun)  # -> out, a; inputs run: Boolean; disabled
# ---------- python: Python ----------
__author__ = "Platina"
__version__ = "2021.07.19"

import rhinoscriptsyntax as rs
import csv
import ghpythonlib.treehelpers as ghtree

if run:
    with open(file_path, 'r') as f:
        a = []
        reader = csv.reader(f)
        for row in reader:
            temp = float(row[0])
            a.append(temp)
    
    a = ghtree.list_to_tree(a)
# ---------- end python ----------
file = ReadFile(File=F, PerLineParse=True)
file_2 = ReadFile(File="C:\AIStructureGenerator\ANN2\results.csv", PerLineParse=True)
crv_2 = Curve(crv)
num = Number(file)
split = TextSplit(Text=file_2, Separators=",")
crv_3 = ClusterInput()
division = Division(A=num, B=Slider(1, range=0..1))
num_2 = Number(split)
bool = ClusterInput()
crv_4 = Curve(crv_3)
lng = ListLength(List=crv_4)
lng_2 = ListLength(List=division)
dup = DuplicateData(Data=0.5, Number=lng, Order=True)
bool_2 = Boolean(bool)
division_2 = Division(A=lng_2, B=2)
python_2 = GhPythonScript(x=dup, y=num_2, z=bool_2)  # -> out, a; inputs x: list, y: list, z: Boolean
# ---------- python_2: Python ----------
__author__ = "Platina"
__version__ = "2021.08.16"

import rhinoscriptsyntax as rs

if z==True:
    a = y
else:
    a = x
# ---------- end python_2 ----------
boundary = BoundarySurfaces(Edges=crv_4)
subtraction = Subtraction(A=division_2, B=1)
crv_5 = Curve(boundary)
dom = ConstructDomain(DomainStart=0, DomainEnd=subtraction)
subset = SubList(List=division, Domain=dom, Wrap=True)  # -> List, Index
explode = Explode(Curve=crv_5, Recursive=True)  # -> Segments, Vertices
num_3 = ClusterInput()
pt = Point(explode.Vertices)
divide = DivideCurve(Curve=crv_2, Count=100, Kinks=False)  # -> Points, Tangents, Parameters
data = Data(subset.List)
num_4 = Number(num_3)
python_3 = GhPythonScript(pleaserun=pleaserun, constraint=divide.Points, marker=pt, ori=crv_4, ori_len=data, tor=num_4, ran=python_2.a)  # -> out, bakeout; inputs constraint: list of Point3d, marker: list of Point3d, ori: list of Curve, ori_len: list, ran: list
# ---------- python_3: Python ----------
__author__ = "Hao"
__version__ = "2018.1.28"


import rhinoscriptsyntax as rs
import scriptcontext as sc
import Rhino
import ghpythonlib.treehelpers as ghtree
import math
import ghpythonlib.components as gh

import clr
import os
import time
clr.AddReferenceToFileAndPath("C:\\PolyFramework\\PolyFramework.dll")

import Rhino.Geometry as rg
import PolyFramework as pf

if pleaserun :
    
    cir = gh.Interpolate(constraint,3,True)[0]
    
    InternalLines = []
    ExternalForces = []
    ExternalPoly = []
    
    edgelengths = []
    faceareas = []
    lines = []
    mibfs = []
    primals = []
    
    countc = 0
    
    sc.doc = Rhino.RhinoDoc.ActiveDoc
    rhdoc = Rhino.RhinoDoc.ActiveDoc
    rs.Command("_SelLayerNumber "+str(rhdoc.Layers.FindName("_Form_InternalLines").Index))
    primal = pf.PFoam()
    dual = pf.PFoam()
    containerType = pf.ContainerType
    multiData = pf.LoadData.LoadPrimalDual(True)
    guids = multiData[0]
    primal = multiData[1]
    dual = multiData[2]
    containerType = multiData[3]
    geoouttemp = rs.ObjectsByLayer('_Form_ExternalForces')
    geoouttemp = [rs.coercecurve(j) for j in geoouttemp]
    ExternalForcestemp = geoouttemp
    pt1 = gh.EndPoints(ExternalForcestemp)[0]
    pt2 = gh.EndPoints(ExternalForcestemp)[1]
    pt1.extend(pt2)
    ptall = pt1
    result = []
    for i in range(len(ptall)):
        for j in range(len(marker)):
            if rs.Distance(ptall[i],marker[j])<0.01:
                result.append(ptall[i])
                break
    pickedVertsup = []
    fixableVerts ={}
    result2 = []
    for vert in primal.Vertices:
        id = vert.Id
        location = vert.Point
        for i in range(len(result)):
            if rs.Distance(result[i],location)<0.01:
                fixableVerts[location] = vert
                pickedVertsup.append(fixableVerts[location])
                primal.SetVertexConstraints([fixableVerts[location]], cir, 1.0, True)
                result2.append(location)
                break
                
    stpp = []
    enpp = []
    for i in range(len(ori)):
        temp = gh.EndPoints(ori[i])
        stpp.append(temp[0])
        enpp.append(temp[1])
    for edge in primal.Edges:
        for i in range(len(ori)):
            if (rs.Distance(stpp[i],edge.Vertices[0].Point)<0.01) and (rs.Distance(enpp[i],edge.Vertices[1].Point)<0.01) or (rs.Distance(stpp[i],edge.Vertices[1].Point)<0.01) and (rs.Distance(enpp[i],edge.Vertices[1].Point)<0.01):
                   edge.MinLength = (0.5+ran[i]*1.0)*ori_len[i]*(1.0-tor)
                   edge.MaxLength = (0.5+ran[i]*1.0)*ori_len[i]*(1.0+tor)
    
    primal.PerpSoft(maxSteps = 10000)
    bakeout = pf.PFoam.SaveAsEdges(primal)
# ---------- end python_3 ----------

# ==== cluster Select_mode
G = ClusterInput()
brec = BoundingRectangle(Geometry=G, Plane=PlaneXY(0, 0, 0), Axis=0, Slide=0, Union=True)  # -> Bounding, DimensionX, DimensionY
explode = Explode(Curve=brec.Bounding, Recursive=True)  # -> Segments, Vertices
mode = ClusterInput()
item = ListItem(List=explode.Segments, Index=0, Wrap=True)  # -> Item, Item1
len = Length(Curve=item.Item)
len_2 = Length(Curve=item.Item1)
division = Division(A=len, B=len_2)
select_type = GhPythonScript(ratio=division, mode=mode)  # -> out, type
# ---------- select_type: Python ----------
__author__ = "Platina"
__version__ = "2021.07.24"

import rhinoscriptsyntax as rs
import ghpythonlib.components as gh

a = [1.0,1.8,3.5,4.4]
b = ["AmazonWaterLily","GrasshopperWings","DragonflyWings","DamselflyWings"]

if mode!="AutoMode":
    type = mode
else:
    if ratio<1.4:
        type = "AmazonWaterLily"
    elif ratio<2.65:
        type = "GrasshopperWings"
    elif ratio<3.95:
        type = "DragonflyWings"
    else:
        type = "DamselflyWings"
# ---------- end select_type ----------
type = ClusterOutput(select_type.type)

# ==== cluster Generate_Force_GeometryDragonflyWing
pt = ClusterInput()
pt_2 = ClusterInput()
txt = ClusterInput()
pt_3 = ClusterInput()
bool = ClusterInput()
pt_4 = Point(pt)
pt_5 = Point(pt_2)
txt_2 = Text(txt)
pt_6 = Point(pt_3)
bool_2 = Boolean(bool)
generate_force_geometry = GhPythonScript(pt1=pt_4, file_path=txt_2, run=bool_2)  # -> out, file_path; inputs pt1: Point3d, run: Boolean
# ---------- generate_force_geometry: Python ----------
__author__ = "Platina"
__version__ = "2021.07.19"

import rhinoscriptsyntax as rs
import os

if run:
    
    os.system("cd C:\\AIStructureGenerator && C: && python get_skeleton.py")
    
    file_path = 'C:\\AIStructureGenerator\\results\\result.csv'
# ---------- end generate_force_geometry ----------
dist = Distance(PointA=pt_6, PointB=pt_4)
pdecon = Deconstruct(Point=pt_5)  # -> XComponent, YComponent, ZComponent
pdecon_2 = Deconstruct(Point=pt_4)  # -> XComponent, YComponent, ZComponent
division = Division(A=dist, B=1024)
subtraction = Subtraction(A=pdecon.XComponent, B=pdecon_2.XComponent)
file = ReadFile(File=generate_force_geometry.file_path, PerLineParse=True)
division_2 = Division(A=subtraction, B=24)
split = TextSplit(Text=file, Separators=",")  # -> simplify(Result)
neg = Negative(Value=division_2)
split_2 = TextSplit(Text=split, Separators=" ")  # -> simplify(Result)
X = UnitX(Factor=neg)
split_3 = TextSplit(Text=split_2, Separators=" .")  # -> simplify(Result)
trim = TrimTree(Tree=split_3, Depth=1)
split_4 = TextSplit(Text=trim, Separators="[")  # -> simplify(Result)
trim_2 = TrimTree(Tree=split_4, Depth=1)
split_5 = TextSplit(Text=trim_2, Separators="]")  # -> simplify(Result)
trim_3 = TrimTree(Tree=split_5, Depth=1)
num = Number(trim_3)
panel = Panel(num)
null = NullItem(Item=num)  # -> NullFlags, InvalidFlags, Description
not = GateNot(A=null.NullFlags)
cull = CullPattern(List=num, CullPattern=not)
item = ListItem(List=cull, Index=0, Wrap=True)  # -> Item, Item1
pt_7 = ConstructPoint(XCoordinate=0, YCoordinate=256, ZCoordinate=0)
pt_8 = ConstructPoint(XCoordinate=item.Item1, YCoordinate=item.Item, ZCoordinate=0)
xz = XZPlane(Origin=pt_7)
mirror = Mirror(Geometry=pt_8, Plane=xz)  # -> Geometry, Transform
move = Move(Geometry=mirror.Geometry, Motion=pt_4)  # -> Geometry, Transform
trim_4 = TrimTree(Tree=mirror.Geometry, Depth=1)
pline = PolyLine(Vertices=trim_4, Closed=False)  # -> flatten(Polyline)
len = Length(Curve=pline)  # disabled
end = EndPoints(Curve=pline)  # -> Start, End
graft = GraftTree(Tree=end.End, IncludeEmptyLists=True, IncludeNullItems=True)  # disabled
graft_2 = GraftTree(Tree=end.Start, IncludeEmptyLists=True, IncludeNullItems=True)  # disabled
explode = Explode(Curve=pline, Recursive=True)  # -> Segments, Vertices
merge = Merge(Data1=end.Start, Data2=end.End)  # disabled
graft_3 = GraftTree(Tree=end.End, IncludeEmptyLists=True, IncludeNullItems=True)
ln = Line(StartPoint=end.Start, EndPoint=end.End)
larger = LargerThan(FirstNumber=len, SecondNumber=3)  # -> LargerThan, OrEqualTo; disabled
duppt = RemoveDuplicatePts(Points=merge, Tolerance=0.01)  # disabled
sort = SortList(Keys=len, ValuesA=pline)  # -> Keys, ValuesA; disabled
python = GhPythonScript(x=explode.Vertices, y=pline)  # -> out, a; inputs x: tree of Point3d, y: list of Curve; disabled
# ---------- python: Python ----------
__author__ = "Platina"
__version__ = "2021.07.24"

import rhinoscriptsyntax as rs
import ghpythonlib.treehelpers as ghtree

x = ghtree.tree_to_list(x)

a = []
for i in range(len(y)):
    q = 0
    p = 3
    while p<=len(x[i])-1:
        c = rs.AddLine(x[i][q],x[i][p])
        temp = rs.CurveCurveIntersection(c,y[i])
        if (temp==None) or (len(temp)<=2):
            a.append(c)
            q = p
            p += 2
        p += 1
    if q!=len(x[i])-1:
        a.append(rs.AddLine(x[i][q],x[i][len(x[i])-1]))
# ---------- end python ----------
divlength = DivideLength(Curve=pline, Length=50)  # -> Points, Tangents, Parameters
duppt_2 = RemoveDuplicatePts(Points=duppt, Tolerance=6)  # disabled
cp = ClosestPoint(Point=graft, Cloud=duppt_2)  # -> ClosestPoint, CPIndex, Distance; disabled
cp_2 = ClosestPoint(Point=graft_2, Cloud=duppt_2)  # -> ClosestPoint, CPIndex, Distance; disabled
ln_2 = Line(StartPoint=cp_2.ClosestPoint, EndPoint=cp.ClosestPoint)  # -> flatten(Line); disabled
len_2 = Length(Curve=ln_2)  # disabled
larger_2 = LargerThan(FirstNumber=len_2, SecondNumber=0.01)  # -> LargerThan, OrEqualTo; disabled
rev = ReverseList(List=sort.ValuesA)  # disabled
cull_2 = CullPattern(List=pline, CullPattern=larger.LargerThan)  # disabled
len_3 = Length(Curve=python.a)  # disabled
merge_2 = Merge(Data1=divlength.Points, Data2=graft_3)
larger_3 = LargerThan(FirstNumber=len_3, SecondNumber=0.01)  # -> LargerThan, OrEqualTo; disabled
cull_3 = CullPattern(List=ln_2, CullPattern=larger_2.LargerThan)  # disabled
dupln = RemoveDuplicateLines(Lines=cull_3, Tolerance=0.01)  # disabled
end_2 = EndPoints(Curve=dupln)  # -> Start, End; disabled
merge_3 = Merge(Data1=end_2.Start, Data2=end_2.End)  # disabled
cull_4 = CullPattern(List=python.a, CullPattern=larger_3.LargerThan)  # disabled
pline_2 = PolyLine(Vertices=merge_2, Closed=False)  # -> flatten(Polyline)
explode_2 = Explode(Curve=rev, Recursive=True)  # -> Segments, Vertices; disabled
duppt_3 = RemoveDuplicatePts(Points=merge_3, Tolerance=0.01)  # disabled
explode_3 = Explode(Curve=pline_2, Recursive=True)  # -> flatten(Segments), Vertices
len_4 = Length(Curve=explode_3.Segments)
flatten = FlattenTree(Tree=explode_2.Segments, Path="{0}")  # disabled
larger_4 = LargerThan(FirstNumber=len_4, SecondNumber=0.01)  # -> LargerThan, OrEqualTo
cull_5 = CullPattern(List=explode_3.Segments, CullPattern=larger_4.LargerThan)
cps = ClosestPoints(Point=duppt_3, Cloud=merge_3, Count=3)  # -> ClosestPoint, CPIndex, Distance; disabled
dupln_2 = RemoveDuplicateLines(Lines=flatten, Tolerance=0.01)  # disabled
dupln_3 = RemoveDuplicateLines(Lines=cull_5, Tolerance=0.01)
crv = Curve(dupln_3)
remove_1 = Remove1(C=crv)
crv_2 = Curve(remove_1)
end_3 = EndPoints(Curve=crv_2)  # -> Start, End
merge_4 = Merge(Data1=end_3.Start, Data2=end_3.End)
vec2pt = Vector2Pt(PointA=end_3.Start, PointB=end_3.End, Unitize=False)  # -> Vector, Length
remove_1_2 = Remove1(C=remove_1)
duppt_4 = RemoveDuplicatePts(Points=merge_4, Tolerance=0.01)
remove_1_3 = Remove1(C=remove_1_2)
remove_1_4 = Remove1(C=remove_1_3)
remove_1_5 = Remove1(C=remove_1_4)
remove_1_6 = Remove1(C=remove_1_5)
remove_1_7 = Remove1(C=remove_1_6)
remove_1_8 = Remove1(C=remove_1_7)
end_4 = EndPoints(Curve=remove_1_8)  # -> Start, End
merge_5 = Merge(Data1=end_4.Start, Data2=end_4.End)
duppt_5 = RemoveDuplicatePts(Points=merge_5, Tolerance=0.01)
del = DelaunayMesh(Points=duppt_5, Plane=PlaneXY(0, 0, 0))
wbedges = WeaverbirdsMeshEdges(MeshOrPolylines=del)
dupln_4 = RemoveDuplicateLines(Lines=wbedges, Tolerance=0.01)
len_5 = Length(Curve=dupln_4)
smaller = SmallerThan(FirstNumber=len_5, SecondNumber=60)  # -> SmallerThan, OrEqualTo
curvepoint = PointOnCurve(dupln_4, parameter=0.5)
cp_3 = ClosestPoint(Point=curvepoint, Cloud=duppt_5)  # -> ClosestPoint, CPIndex, Distance
smaller_2 = SmallerThan(FirstNumber=cp_3.Distance, SecondNumber=30)  # -> SmallerThan, OrEqualTo
and = GateAnd(A=smaller_2.SmallerThan, B=smaller.SmallerThan)
cull_6 = CullPattern(List=dupln_4, CullPattern=and)
merge_6 = Merge(Data1=cull_6, Data2=remove_1_8)  # -> flatten(Result)
dupln_5 = RemoveDuplicateLines(Lines=merge_6, Tolerance=0.01)
wbweave = WeaverbirdsMeshFromLinesWeaveBack(Lines=dupln_5, MaximumValence=1000)
explode_4 = MeshExplode(Mesh=wbweave, Interpolate=False)
end_5 = EndPoints(Curve=dupln_5)  # -> Start, End
wbedges_2 = WeaverbirdsMeshEdges(MeshOrPolylines=explode_4)
merge_7 = Merge(Data1=end_5.Start, Data2=end_5.End)
dupln_6 = RemoveDuplicateLines(Lines=wbedges_2, Tolerance=0.01)
boundary = BoundarySurfaces(Edges=dupln_6)
debrep = DeconstructBrep(Brep=boundary)  # -> Faces, Edges, Vertices
pline_3 = PolyLine(Vertices=debrep.Vertices, Closed=True)
boundary_2 = BoundarySurfaces(Edges=pline_3)  # -> flatten(Surfaces)
duppt_6 = RemoveDuplicatePts(Points=merge_7, Tolerance=0.01)
del_2 = DelaunayMesh(Points=duppt_6, Plane=PlaneXY(0, 0, 0))
wbnaked = WeaverbirdsNakedBoundary(MeshClosedPolylines=del_2)
merge_8 = Merge(Data1=flatten(wbnaked), Data2=flatten(boundary_2))
item_2 = ListItem(List=merge_8, Index=1, Wrap=True)
area = Area(Geometry=item_2)  # -> Area, Centroid
sort_2 = SortList(Keys=area.Area, ValuesA=item_2)  # -> Keys, ValuesA
item_3 = ListItem(List=sort_2.ValuesA, Index=-1, Wrap=True)
crv_3 = Curve(item_3)
divlength_2 = DivideLength(Curve=item_3, Length=10)  # -> Points, Tangents, Parameters
lng = ListLength(List=divlength_2.Points)
dup = DuplicateData(Data=divlength_2.Points, Number=2, Order=True)
subtraction_2 = Subtraction(A=lng, B=1)
dom = ConstructDomain(DomainStart=0, DomainEnd=subtraction_2)
python_2 = GhPythonScript(x=dup)  # -> out, pd; inputs x: list of Point3d
# ---------- python_2: Python ----------
__author__ = "Platina"
__version__ = "2021.08.19"

import rhinoscriptsyntax as rs

n = int(len(x)/2)
pd = [True for i in range(len(x))]
for i in range(n-1):
    if pd[i]==True:
        for j in range(i+5,i+50):
            if pd[j]==True:
                if rs.Distance(x[i],x[j])<20:
                    print(i,j)
                    for k in range(i+1,j):
                        pd[k] = False
# ---------- end python_2 ----------
subset = SubList(List=python_2.pd, Domain=dom, Wrap=True)  # -> List, Index
cull_7 = CullPattern(List=divlength_2.Points, CullPattern=subset.List)
intcrv = Interpolate(Vertices=cull_7, Degree=3, Periodic=True, KnotStyle=1)  # -> Curve, Length, Domain
divide = DivideCurve(Curve=intcrv.Curve, Count=15, Kinks=False)  # -> Points, Tangents, Parameters
remove_2 = Remove2(C=remove_1_8)  # disabled
remove_2_2 = Remove2(C=remove_2)  # disabled
intcrv_2 = Interpolate(Vertices=divide.Points, Degree=3, Periodic=True, KnotStyle=1)  # -> Curve, Length, Domain
flip = FlipCurve(Curve=intcrv_2.Curve)  # -> Curve, Flag
remove_2_3 = Remove2(C=remove_2_2)  # disabled
offset = OffsetCurve(Curve=intcrv_2.Curve, Distance=10, Plane=PlaneXY(0, 0, 0), Corners=1)
offset_2 = OffsetCurve(Curve=intcrv_2.Curve, Distance=-10, Plane=PlaneXY(0, 0, 0), Corners=1)
remove_2_4 = Remove2(C=remove_2_3)  # disabled
area_2 = Area(Geometry=offset_2)  # -> Area, Centroid
area_3 = Area(Geometry=offset)  # -> Area, Centroid
merge_9 = Merge(Data1=intcrv_2.Curve, Data2=flip.Curve)
larger_5 = LargerThan(FirstNumber=area_3.Area, SecondNumber=area_2.Area)  # -> LargerThan, OrEqualTo
crv_4 = Curve(intcrv.Curve)
remove_2_5 = Remove2(C=remove_2_4)  # disabled
item_4 = ListItem(List=cps.Distance, Index=-1, Wrap=True)  # disabled
item_5 = ListItem(List=merge_9, Index=larger_5.LargerThan, Wrap=True)
srf = Surface(item_5)
divide_2 = DivideCurve(Curve=srf, Count=1000, Kinks=False)  # -> Points, Tangents, Parameters
rotate = Rotate(Geometry=divide_2.Tangents, Angle=-1.570796327, Plane=PlaneXY(0, 0, 0))  # -> Geometry, Transform
multiplication = Multiplication(A=rotate.Geometry, B=200)
move_2 = Move(Geometry=divide_2.Points, Motion=multiplication)  # -> Geometry, Transform
ln_3 = Line(StartPoint=divide_2.Points, EndPoint=move_2.Geometry)
python_3 = GhPythonScript(a=ln_3, b=crv_2, crv=crv_4)  # -> out, c; inputs a: list of Curve, b: list of Curve, crv: Curve
# ---------- python_3: Python ----------
__author__ = "Platina"
__version__ = "2021.08.19"

import rhinoscriptsyntax as rs
import ghpythonlib.components as gh
import math

c = []
for i in range(len(a)):
    dis = []
    cur = []
    spt = rs.CurveStartPoint(a[i])
    ept = rs.CurveEndPoint(a[i])
    for j in range(len(b)):
        pt = rs.CurveCurveIntersection(a[i],b[j])
        if pt!=None:
            pt = pt[0][1]
            #dis.append(rs.Distance(spt,pt))
            dis.append(gh.CurveClosestPoint(pt,crv)[2])
            cur.append(b[j])
    mind = 99999
    pp = None
    v1 = gh.Vector2Pt(spt,ept,True)[0]
    for j in range(len(dis)):
        if dis[j]>10:
            if dis[j]<mind:
                v2 = gh.Vector2Pt(rs.CurveStartPoint(cur[j]),rs.CurveEndPoint(cur[j]),True)[0]
                if (gh.Angle(v1,v2)[0]>45/180*math.pi) and (gh.Angle(v1,v2)[0]<135/180*math.pi):
                    mind = dis[j]
                    pp = rs.CurveCurveIntersection(a[i],cur[j])[0][1]
    c.append(pp)
# ---------- end python_3 ----------
remove_2_6 = Remove2(C=remove_2_5)  # disabled
toggle = BooleanToggle(True)  # disabled
subset_2 = SubList(List=cull_4, Domain=Domain(0, 100), Wrap=True)  # -> List, Index; disabled
scale = Scale(Geometry=dupln_2, Center=pt_4, Factor=division)  # -> Geometry, Transform; disabled
smaller_3 = SmallerThan(FirstNumber=item_4, SecondNumber=0.01)  # -> flatten(SmallerThan), OrEqualTo; disabled
ln_4 = Line(StartPoint=divide_2.Points, EndPoint=python_3.c)
remove_2_7 = Remove2(C=remove_2_6)  # disabled
toggle_2 = BooleanToggle(True)  # disabled
cull_8 = CullPattern(List=duppt_3, CullPattern=smaller_3.SmallerThan)  # disabled
cp_4 = ClosestPoint(Point=end_2.Start, Cloud=cull_8)  # -> ClosestPoint, CPIndex, Distance; disabled
cp_5 = ClosestPoint(Point=end_2.End, Cloud=cull_8)  # -> ClosestPoint, CPIndex, Distance; disabled
smaller_4 = SmallerThan(FirstNumber=cp_4.Distance, SecondNumber=0.01)  # -> SmallerThan, OrEqualTo; disabled
smaller_5 = SmallerThan(FirstNumber=cp_5.Distance, SecondNumber=0.01)  # -> SmallerThan, OrEqualTo; disabled
and_2 = GateAnd(A=smaller_4.SmallerThan, B=smaller_5.SmallerThan)  # disabled
cull_9 = CullPattern(List=dupln, CullPattern=and_2)  # disabled
python_4 = GhPythonScript(curves=cull_4, run=toggle)  # -> out, curves; inputs curves: list of Curve, run: Boolean; disabled
# ---------- python_4: Python ----------
__author__ = "Platina"
__version__ = "2021.07.24"

import rhinoscriptsyntax as rs
import ghpythonlib.components as gh

if run:
    for i in range(len(curves)):
        spp = rs.CurveStartPoint(curves[i])
        epp = rs.CurveEndPoint(curves[i])
        l = rs.CurveLength(curves[i])
        curve = rs.ScaleObject(curves[i],rs.CurveMidPoint(curves[i]),[1024/l,1024/l,1024/l])
        sp = rs.CurveStartPoint(curve)
        ep = rs.CurveEndPoint(curve)
        a = [sp,ep]
        for j in range(len(curves)):
            if i!=j:
                temp = rs.CurveCurveIntersection(curve,curves[j])
                if temp!=None:
                    a.append(temp[0][1])
        d = gh.Distance(a,sp)
        a = gh.SortList(d,a)[1]
        minep = 9999
        minsp = 9999
        epf = None
        spf = None
        for j in range(len(a)):
            if abs((rs.Distance(a[j],epp)-rs.Distance(a[j],spp))-l)<0.01:
                ll = rs.Distance(a[j],spp)
                if ll<minsp:
                    minsp = ll
                    spf = a[j]
            if abs((rs.Distance(a[j],spp)-rs.Distance(a[j],epp))-l)<0.01:
                ll = rs.Distance(a[j],epp)
                if ll<minep:
                    minep = ll
                    epf = a[j]
        curves[i] = rs.AddLine(spf,epf)
# ---------- end python_4 ----------
slider = Slider(0.001, range=0..0.001)  # disabled
vec2pt_2 = Vector2Pt(PointA=divide_2.Points, PointB=python_3.c, Unitize=False)  # -> Vector, Length
graft_4 = GraftTree(Tree=ln_4, IncludeEmptyLists=True, IncludeNullItems=True)
remove_2_8 = Remove2(C=remove_2_7)  # disabled
rotate_2 = Rotate(Geometry=python_4.curves, Angle=0.6283185307, Plane=PlaneXY(0, 0, 0))  # -> Geometry, Transform; disabled
scale_2 = Scale(Geometry=cull_8, Center=pt_4, Factor=division)  # -> Geometry, Transform; disabled
toggle_3 = BooleanToggle(False)  # disabled
del_3 = DelaunayMesh(Points=cull_8, Plane=PlaneXY(0, 0, 0))  # disabled
python_5 = GhPythonScript(curves=subset_2.List, run=toggle_2)  # -> out, curves; inputs curves: list of Curve, run: Boolean; disabled
# ---------- python_5: Python ----------
__author__ = "Platina"
__version__ = "2021.07.24"

import rhinoscriptsyntax as rs

if run:
    for i in range(len(curves)):
        curve = curves[i]
        pds = False
        pde = False
        pdsp = None
        pdep = None
        s1 = rs.CurveStartPoint(curve)
        e1 = rs.CurveEndPoint(curve)
        temp = []
        for j in range(len(curves)):
            if i!=j:
                if rs.Distance(rs.EvaluateCurve(curves[j],rs.CurveClosestPoint(curves[j],s1)),s1)<50:
                    temp.append(curves[j])
                elif rs.Distance(rs.EvaluateCurve(curves[j],rs.CurveClosestPoint(curves[j],e1)),e1)<50:
                    temp.append(curves[j])
        for j in range(len(temp)):
            a = rs.CurveCurveIntersection(curve,temp[j])
            if a!=None:
                if rs.Distance(a[0][1],rs.CurveStartPoint(curve))<0.01:
                    pds = True
                    pdsp = a[0][1]
                if rs.Distance(a[0][1],rs.CurveEndPoint(curve))<0.01:
                    pde = True
                    pdep = a[0][1]
            if (pds==True) and (pde==True):
                break
        count = 0
        while ((pds==False) or (pde==False)) and (count<50):
            if pds==False:
                l = (rs.CurveLength(curve)+1)/rs.CurveLength(curve)
                curve = rs.ScaleObject(curve,rs.CurveEndPoint(curve),[l,l,l])
                for j in range(len(temp)):
                    a = rs.CurveCurveIntersection(curve,temp[j])
                    if a!=None:
                        if rs.Distance(a[0][1],rs.CurveStartPoint(curve))<=1:
                            pds = True
                            pdsp = a[0][1]
                            break
            if pde==False:
                l = (rs.CurveLength(curve)+1)/rs.CurveLength(curve)
                curve = rs.ScaleObject(curve,rs.CurveStartPoint(curve),[l,l,l])
                for j in range(len(temp)):
                    a = rs.CurveCurveIntersection(curve,temp[j])
                    if a!=None:
                        if rs.Distance(a[0][1],rs.CurveEndPoint(curve))<=1:
                            pde = True
                            pdep = a[0][1]
                            break
            count += 1
        if pdsp==None:
            pdsp = rs.CurveStartPoint(curve)
        if pdep==None:
            pdep = rs.CurveEndPoint(curve)
        curves[i] = rs.AddCurve([pdsp,pdep])
# ---------- end python_5 ----------
slider_2 = Slider(0.001, range=0..0.001)  # disabled
end_6 = EndPoints(Curve=python_4.curves)  # -> Start, End; disabled
graft_5 = GraftTree(Tree=vec2pt_2.Vector, IncludeEmptyLists=True, IncludeNullItems=True)
crvprox = CurveProximity(CurveA=graft_4, CurveB=crv_2)  # -> PointA, PointB, Distance
wbedges_3 = WeaverbirdsMeshEdges(MeshOrPolylines=del_3)  # disabled
move_3 = Move(Geometry=del_3, Motion=pt_4)  # -> Geometry, Transform; disabled
number_slider = Slider(30, range=0..100)
angle = Angle(VectorA=graft_5, VectorB=vec2pt.Vector)  # -> simplify(Angle), Reflex
python_6 = GhPythonScript(curves=python_4.curves, run=toggle_3)  # -> out, curves; inputs curves: list of Curve, run: Boolean; disabled
# ---------- python_6: Python ----------
__author__ = "Platina"
__version__ = "2021.07.25"

import rhinoscriptsyntax as rs
import ghpythonlib.components as gh

if run:
    pd = True
    while pd==True:
        pd = False
        a = []
        for i in range(len(curves)):
            a.append(rs.CurveEndPoint(curves[i]))
            a.append(rs.CurveStartPoint(curves[i]))
        pp = []
        for i in range(len(curves)):
            d = gh.ClosestPoints(rs.CurveEndPoint(curves[i]),a,2)[2]
            if d[1]<0.01:
                p1 = True
            else:
                p1 = False
            d = gh.ClosestPoints(rs.CurveStartPoint(curves[i]),a,2)[2]
            if d[1]<0.01:
                p2 = True
            else:
                p2 = False
            if p1 and p2:
                pp.append(True)
            else:
                pp.append(False)
                pd = True
        curves = gh.CullPattern(curves,pp)
# ---------- end python_6 ----------
splitcurves = PythonScript(curves=rotate_2.Geometry, tolerance=slider)  # -> out, pieces; inputs curves: list of Curve; disabled
# ---------- splitcurves: Python ----------
import Rhino
import clr
clr.AddReference("Grasshopper")
from Grasshopper.Kernel.Data import GH_Path
from Grasshopper import DataTree
import ghpythonlib.components as gh


def boxes_overlap(boxA, boxB):
    """Check if there is any overlap between two bounding boxes.
    """
    intersection = boxA.Intersection(boxA, boxB)
    if intersection.IsValid:
        intSize = intersection.Diagonal.Length
        return intSize > 0.0
    else:
        return False

def distribute_intersections(curveIntersections):
    """returns two lists: the parameters on curveA, and the parameters on
    curveB.
    """
    params_a = []
    params_b = []
    for intersection in curveIntersections:
        if not intersection.IsOverlap:
            params_a.append(intersection.ParameterA)
            params_b.append(intersection.ParameterB)
        else: # it's an overlap!
            intervalA = intersection.OverlapA
            intervalB = intersection.OverlapB
            params_a.extend([intervalA.T0, intervalA.T1])
            params_b.extend([intervalB.T0, intervalB.T1])
    return params_a, params_b

def split(curves, tol=0.001):
    """Take a set of curves and split them at every point-type intersection.
    """
    results = []
    parameter_bank = {}
    indices = range(len(curves) - 1, -1, -1)
    for i in indices:
        parameter_bank[i] = []
    for i in indices:
        # check to see if this curve has any previously found intersections
        intersection_parameters = parameter_bank[i]
        if curves:
            curve = curves.pop()
            # check for self intersections first
            self_intersections = Rhino.Geometry.Intersect.Intersection.CurveSelf(curve, tol)
            if self_intersections.Count > 0:
                this_intersect, that_intersect = distribute_intersections(self_intersections)
                intersection_parameters.extend(this_intersect)
                intersection_parameters.extend(that_intersect)
            # check if there are any other curves
            if curves:
                # get the bounding box for this curve
                thisbbox = curve.GetBoundingBox(False)
                # go through the other curves
                for j, other in enumerate(curves):
                    # check if the other curve is anywhere near this one
                    otherbbox = other.GetBoundingBox(False)
                    if boxes_overlap(thisbbox, otherbbox):
                        # get the intersections with the other curve
                        other_intersections = Rhino.Geometry.Intersect.Intersection.CurveCurve( curve,
                                other, tol, tol)
                        if other_intersections.Count > 0:
                            this_intersect, that_intersect = distribute_intersections(other_intersections)
                            intersection_parameters.extend(this_intersect)
                            parameter_bank[j].extend(that_intersect)
        if intersection_parameters:
            # chop up the curve
            curve_pieces = curve.Split(intersection_parameters)
            for curvesss in curve_pieces:
                results.append(gh.Line(curvesss.PointAtStart,curvesss.PointAtEnd))
        else:
            results.append(curve)
    return results

if curves:
    if tolerance == None:
        tolerance = 0.001
    pieces = split(curves, tolerance)
# ---------- end splitcurves ----------
scale_3 = Scale(Geometry=move_3.Geometry, Center=pt_4, Factor=division)  # -> Geometry, Transform; disabled
subtraction_3 = Subtraction(A=180, B=number_slider)
ln_5 = Line(StartPoint=end_6.Start, EndPoint=end_6.End)  # disabled
curvepoint_2 = PointOnCurve(wbedges_3, parameter=0.5)  # disabled
smaller_6 = SmallerThan(FirstNumber=crvprox.Distance, SecondNumber=Slider(3, range=0..10))  # -> SmallerThan, OrEqualTo
splitcurves_2 = PythonScript(curves=remove_2_8, tolerance=slider_2)  # -> out, pieces; inputs curves: list of Curve; disabled; same code as splitcurves
wbedges_4 = WeaverbirdsMeshEdges(MeshOrPolylines=scale_3.Geometry)  # disabled
rad = Radians(Degrees=subtraction_3)
larger_6 = LargerThan(FirstNumber=angle.Angle, SecondNumber=rad)  # -> LargerThan, OrEqualTo
rad_2 = Radians(Degrees=number_slider)
smaller_7 = SmallerThan(FirstNumber=angle.Angle, SecondNumber=rad_2)  # -> SmallerThan, OrEqualTo
rotate_3 = Rotate(Geometry=splitcurves.pieces, Angle=-0.6283185307, Plane=PlaneXY(0, 0, 0))  # -> Geometry, Transform; disabled
graft_6 = GraftTree(Tree=curvepoint_2, IncludeEmptyLists=True, IncludeNullItems=True)  # disabled
len_6 = Length(Curve=rotate_3.Geometry)  # disabled
L = ClusterOutput(wbedges_4)  # disabled
or = GateOr(A=smaller_7.SmallerThan, B=larger_6.LargerThan)
larger_7 = LargerThan(FirstNumber=len_6, SecondNumber=0.01)  # -> LargerThan, OrEqualTo; disabled
crv_cp = CurveClosestPoint(Point=graft_6, Curve=dupln_3)  # -> Point, Parameter, Distance; disabled
dupln_7 = RemoveDuplicateLines(Lines=splitcurves_2.pieces, Tolerance=0.01)  # disabled
and_3 = GateAnd(A=or, B=smaller_6.SmallerThan)
sort_3 = SortList(Keys=crv_cp.Distance, ValuesA=dupln_3)  # -> Keys, ValuesA; disabled
cull_10 = CullPattern(List=rotate_3.Geometry, CullPattern=larger_7.LargerThan)  # disabled
crv_5 = Curve(dupln_7)  # disabled
ma = MassAddition(Input=and_3)  # -> flatten(Result), PartialResults
dupln_8 = RemoveDuplicateLines(Lines=cull_10, Tolerance=0.01)  # disabled
item_6 = ListItem(List=sort_3.ValuesA, Index=0, Wrap=True)  # -> flatten(Item); disabled
larger_8 = LargerThan(FirstNumber=ma.Result, SecondNumber=0)  # -> LargerThan, OrEqualTo
len_7 = Length(Curve=dupln_8)  # disabled
crv_6 = Curve(crv_5)  # disabled
end_7 = EndPoints(Curve=item_6)  # -> Start, End; disabled
end_8 = EndPoints(Curve=wbedges_3)  # -> Start, End; disabled
cull_11 = CullPattern(List=ln_4, CullPattern=larger_8.LargerThan)
sort_4 = SortList(Keys=len_7, ValuesA=dupln_8)  # -> Keys, ValuesA; disabled
end_9 = EndPoints(Curve=cull_11)  # -> Start, End
vec2pt_3 = Vector2Pt(PointA=end_7.Start, PointB=end_7.End, Unitize=False)  # -> Vector, Length; disabled
vec2pt_4 = Vector2Pt(PointA=end_8.Start, PointB=end_8.End, Unitize=False)  # -> Vector, Length; disabled

grid_divisions = Integer(20)  # disabled
crv_7 = Curve(simplify(crv_6))  # disabled
x_bounds = Domain(Domain(1950, 3650))  # disabled
y_bounds = Domain(Domain(2750, 3550))  # disabled

python_7 = GhPythonScript(x=cull_11)  # -> out, pd; inputs x: list of Curve
# ---------- python_7: Python ----------
__author__ = "Platina"
__version__ = "2021.08.19"

import rhinoscriptsyntax as rs
import ghpythonlib.components as gh

pd = [True for i in range(len(x))]

for i in range(1,len(x)):
    for j in range(i):
        if pd[j]==True:
            d = gh.CurveProximity(x[i],x[j])[2]
            if (d<gh.Length(x[i])*0.2) or (d<gh.Length(x[j])*0.2) or (d<5):
                pd[i] = False
                break
# ---------- end python_7 ----------
number_slider_2 = Slider(45, range=0..90)  # disabled
shift = ShiftList(List=sort_4.Keys, Shift=-1, Wrap=False)  # disabled
lng_2 = ListLength(List=shift)  # disabled
shift_2 = ShiftList(List=sort_4.Keys, Shift=1, Wrap=False)  # disabled
angle_2 = Angle(VectorA=vec2pt_3.Vector, VectorB=vec2pt_4.Vector)  # -> Angle, Reflex; disabled
cull_12 = CullPattern(List=cull_11, CullPattern=python_7.pd)
dom² = Domain²(DomainU=x_bounds, DomainV=y_bounds)  # disabled
series = Series(Start=0, Step=1, Count=lng_2)  # disabled
subtraction_4 = Subtraction(A=shift_2, B=shift)  # disabled
division_3 = Division(A=number_slider_2, B=180)  # disabled
subtraction_5 = Subtraction(A=1, B=division_3)  # disabled
end_10 = EndPoints(Curve=cull_12)  # -> Start, End
division_4 = Division(A=subtraction_4, B=shift)  # disabled
multiplication_2 = Multiplication(A=subtraction_5, B=3.141592654)  # disabled
larger_9 = LargerThan(FirstNumber=angle_2.Angle, SecondNumber=multiplication_2)  # -> LargerThan, OrEqualTo; disabled
larger_10 = LargerThan(FirstNumber=division_4, SecondNumber=0.3)  # -> LargerThan, OrEqualTo; disabled
multiplication_3 = Multiplication(A=division_3, B=3.141592654)  # disabled
smaller_8 = SmallerThan(FirstNumber=angle_2.Angle, SecondNumber=multiplication_3)  # -> SmallerThan, OrEqualTo; disabled
or_2 = GateOr(A=smaller_8.SmallerThan, B=larger_9.LargerThan)  # disabled
hem_open_xy_networks = VBScript(seg=crv_7, bnd=dom², sbdv=grid_divisions)  # -> out, flatten(e), flatten(eOV), flatten(ePE), flatten(eNE), flatten(eTE), flatten(eIF), flatten(v)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; inputs seg: list of Curve; disabled; same code as hem_open_xy_networks
lng_3 = ListLength(List=end_9.End)
number_slider_3 = Slider(100, range=0..1000)  # disabled
cull_13 = CullPattern(List=wbedges_3, CullPattern=or_2)  # disabled
number_slider_4 = Slider(200, range=0..1000)  # disabled
dup_2 = DuplicateData(Data=end_9.End, Number=2, Order=True)
number_slider_5 = Slider(5, range=0..10)  # disabled
cull_14 = CullPattern(List=series, CullPattern=larger_10.LargerThan)  # disabled
subtraction_6 = Subtraction(A=lng_3, B=1)
number_slider_6 = Slider(10, range=0..10)  # disabled
pline_4 = PolyLine(Vertices=hem_open_xy_networks.f, Closed=True)  # disabled
item_7 = ListItem(List=cull_14, Index=-1, Wrap=True)  # disabled
dom_2 = ConstructDomain(DomainStart=0, DomainEnd=item_7)  # disabled
dom_3 = ConstructDomain(DomainStart=0, DomainEnd=subtraction_6)
python_8 = GhPythonScript(x=dup_2)  # -> out, pd; inputs x: list of Point3d
# ---------- python_8: Python ----------
__author__ = "Platina"
__version__ = "2021.08.19"

import rhinoscriptsyntax as rs

n = int(len(x)/2)
pd = [True for i in range(len(x))]
for i in range(n-1):
    if pd[i]==True:
        for j in range(i+5,i+50):
            if pd[j]==True:
                if rs.Distance(x[i],x[j])<45:
                    print(i,j)
                    for k in range(i+1,j):
                        pd[k] = False
# ---------- end python_8 ----------
pt_9 = Point(end_10.Start)
crv_8 = Curve(cull_13)  # disabled
flatten_2 = FlattenTree(Tree=pline_4, Path="{0}")  # disabled
subset_3 = SubList(List=python_8.pd, Domain=dom_3, Wrap=True)  # -> List, Index
cluster = Cluster(curves=crv_8)  # disabled
subset_4 = SubList(List=sort_4.ValuesA, Domain=dom_2, Wrap=True)  # -> List, Index; disabled
srf_2 = Surface(flatten_2)  # disabled
cull_15 = CullPattern(List=end_9.End, CullPattern=subset_3.List)
cluster_2 = Cluster(curves=cluster)  # disabled
area_4 = Area(Geometry=srf_2)  # -> Area, Centroid; disabled
intcrv_3 = Interpolate(Vertices=cull_15, Degree=3, Periodic=True, KnotStyle=1)  # -> Curve, Length, Domain
end_11 = EndPoints(Curve=subset_4.List)  # -> Start, End; disabled
cluster_3 = Cluster(curves=cluster_2)  # disabled
sort_5 = SortList(Keys=area_4.Area, ValuesA=flatten_2)  # -> Keys, ValuesA; disabled
number_slider_7 = Slider(15, range=0..90)  # disabled
merge_10 = Merge(Data1=end_11.Start, Data2=end_11.End)  # disabled
crv_cp_2 = CurveClosestPoint(Point=pt_9, Curve=intcrv_3.Curve)  # -> Point, Parameter, Distance
crv_9 = Curve(crv_2)
cluster_4 = Cluster(curves=cluster_3)  # disabled
duppt_7 = RemoveDuplicatePts(Points=merge_10, Tolerance=0.01)  # disabled

# ---- group: make lines to polygons
shift_3 = ShiftList(List=sort_5.ValuesA, Shift=-1, Wrap=False)  # disabled

# ----
cluster_5 = Cluster(curves=cluster_4)  # disabled
pt_10 = Point(duppt_4)
division_5 = Division(A=number_slider_7, B=180)  # disabled
cps_2 = ClosestPoints(Point=duppt_7, Cloud=merge_10, Count=3)  # -> ClosestPoint, CPIndex, Distance; disabled
pline_5 = PolyLine(Vertices=crv_cp_2.Point, Closed=True)
divide_3 = DivideCurve(Curve=pline_5, Count=30, Kinks=False)  # -> Points, Tangents, Parameters
intcrv_4 = Interpolate(Vertices=divide_3.Points, Degree=3, Periodic=True, KnotStyle=1)  # -> Curve, Length, Domain
ln_6 = Line(StartPoint=pt_9, EndPoint=crv_cp_2.Point)
end_12 = EndPoints(Curve=ln_6)  # -> Start, End
duppt_8 = RemoveDuplicatePts(Points=end_12.End, Tolerance=5)
cp_6 = ClosestPoint(Point=end_12.End, Cloud=duppt_8)  # -> ClosestPoint, CPIndex, Distance
crv_cp_3 = CurveClosestPoint(Point=cp_6.ClosestPoint, Curve=intcrv_4.Curve)  # -> Point, Parameter, Distance
pt_11 = Point(crv_cp_3.Point)

pline_6 = PolyLine(Vertices=crv_cp_3.Point, Closed=True)
ln_7 = Line(StartPoint=end_12.Start, EndPoint=crv_cp_3.Point)
pline_7 = PolyLine(Vertices=pt_9, Closed=True)

area_5 = Area(Geometry=pline_6)  # -> Area, Centroid
smaller_9 = SmallerThan(FirstNumber=cps_2.Distance, SecondNumber=0.01)  # -> SmallerThan, OrEqualTo; disabled
multiplication_4 = Multiplication(A=division_5, B=3.141592654)  # disabled
number_slider_8 = Slider(50, range=0..1000)  # disabled
divide_4 = DivideCurve(Curve=cluster_5, Count=7, Kinks=False)  # -> Points, Tangents, Parameters; disabled
number_slider_9 = Slider(5, range=0..10)  # disabled
scale_4 = Scale(Geometry=pline_6, Center=area_5.Centroid, Factor=0.95)  # -> Geometry, Transform
incurve = PointInCurve(Point=pt_10, Curve=scale_4.Geometry)  # -> Relationship, Point
equals = Equality(FirstNumber=incurve.Relationship, SecondNumber=2)  # -> Equality, Inequality
srf_3 = Surface(scale_4.Geometry)  # disabled
toggle_4 = BooleanToggle(False)  # disabled
ma_2 = MassAddition(Input=smaller_9.SmallerThan)  # -> Result, PartialResults; disabled
larger_11 = LargerThan(FirstNumber=ma_2.Result, SecondNumber=3)  # -> LargerThan, flatten(OrEqualTo); disabled
equals_2 = Equality(FirstNumber=ma_2.Result, SecondNumber=2)  # -> flatten(Equality), Inequality; disabled
explode_5 = Explode(Curve=pline_6, Recursive=True)  # -> Segments, Vertices
Z = UnitZ(Factor=1)  # disabled
python_9 = GhPythonScript(curves=shift_3, com=dupln_3, rat=multiplication_4)  # -> out, a; inputs curves: list of Curve, com: list of Curve; disabled
# ---------- python_9: Python ----------
__author__ = "Platina"
__version__ = "2021.08.01"

import rhinoscriptsyntax as rs
import ghpythonlib.components as gh
import math
import ghpythonlib.treehelpers as ghtree

a = []
for curve in curves:
    temp = gh.Explode(curve,True)[0]
    pts = gh.Explode(curve,True)[1][1:]
    if len(pts)>=4:
        
        okpass = [False for i in range(len(pts))]
        ch = gh.ConvexHull(pts)[0]
        pd = gh.PointInCurve(pts,ch)[0]
        
        for i in range(len(pts)):
            if pd[i]==2:
                for j in range(len(pts)):
                    if i!=j:
                        pp = True
                        l  =gh.Line(pts[i],pts[j])
                        cp = gh.CurveMiddle(l)
                        if gh.PointInCurve(cp,curve)[0]==2:
                            lscale = gh.Scale(l,cp,0.999)[0]
                            for k in temp:
                                if gh.CurveXCurve(lscale,k)[0]!=None:
                                    pp = False
                                    break
                            if pp==True:
                                d = gh.CurveClosestPoint(cp,com)[2]
                                k = gh.SortList(d,com)[1][0]
                                v1 = gh.Vector2Pt(gh.EndPoints(k)[0],gh.EndPoints(k)[1],False)[0]
                                v2 = gh.Vector2Pt(gh.EndPoints(l)[0],gh.EndPoints(l)[1],False)[0]
                                ang = gh.Angle(v1,v2)[0]
                                if ang<rat or ang>math.pi-rat:
                                    temp.append(l)
        
        for i in range(len(pts)):
            if okpass[i]==False:
                for j in range(len(pts)):
                    if i!=j:
                        pp = True
                        l  =gh.Line(pts[i],pts[j])
                        cp = gh.CurveMiddle(l)
                        if gh.PointInCurve(cp,curve)[0]==2:
                            lscale = gh.Scale(l,cp,0.95)[0]
                            for k in temp:
                                if gh.CurveXCurve(lscale,k)[0]!=None:
                                    pp = False
                                    break
                            if pp==True:
                                temp.append(l)
                                break
        
        for i in range(len(pts)):
            if pd[i]!=2:
                for j in range(len(pts)):
                    if i!=j:
                        pp = True
                        l  =gh.Line(pts[i],pts[j])
                        cp = gh.CurveMiddle(l)
                        if gh.PointInCurve(cp,curve)[0]==2:
                            lscale = gh.Scale(l,cp,0.95)[0]
                            for k in temp:
                                if gh.CurveXCurve(lscale,k)[0]!=None:
                                    pp = False
                                    break
                            if pp==True:
                                d = gh.CurveClosestPoint(cp,com)[2]
                                k = gh.SortList(d,com)[1][0]
                                v1 = gh.Vector2Pt(gh.EndPoints(k)[0],gh.EndPoints(k)[1],False)[0]
                                v2 = gh.Vector2Pt(gh.EndPoints(l)[0],gh.EndPoints(l)[1],False)[0]
                                ang = gh.Angle(v1,v2)[0]
                                if ang<rat or ang>math.pi-rat:
                                    temp.append(l)
    a.append(temp)

a = ghtree.list_to_tree(a)
# ---------- end python_9 ----------
cull_16 = CullPattern(List=pt_10, CullPattern=equals.Equality)
python_10 = GhPythonScript(
    pts=cull_16,
    threshold=number_slider_3,
    step=number_slider_5,
    threshold2=number_slider_4,
    step2=number_slider_6,
    run=bool_2)  # -> out, pts; inputs pts: list of Point3d, threshold: Int32, step: Int32, threshold2: Int32, step2: Int32; disabled
# ---------- python_10: Python ----------
__author__ = "Platina"
__version__ = "2021.08.29"

import rhinoscriptsyntax as rs
import ghpythonlib.components as gh
import System.Drawing as SD
import time

if run:
    
    filename = 'C:\\AIStructureGenerator\\results\\result_mp.jpg'
    count = 0
    
    img = SD.Bitmap(filename)
    
    w = img.Width
    h = img.Height
    
    rs.EnableRedraw(False)
    
    #周边像素出现蓝色的点留下
    temp = []
    for pt in pts:
        xx,yy,zz = gh.DeconstructVector(pt)
        xx = int(xx)
        yy = int(yy)
        pp = True
        for i in range(-step+1,step):
            if pp==True:
                for j in range(-step+1,step):
                    x = xx+i
                    y = h - (yy+j)
                    if (x>=0) and (x<w) and (y>=0) and (y<h):
                        color = img.GetPixel(x, y)
                        B = color.B
                        if B>=threshold:
                            temp.append(pt)
                            pp = False
                            break
    
    #周边像素出现白色的点剔除
    pts = temp
    temp = []
    for pt in pts:
        xx,yy,zz = gh.DeconstructVector(pt)
        xx = int(xx)
        yy = int(yy)
        pp = True
        for i in range(-step2+1,step2):
            if pp==True:
                for j in range(-step2+1,step2):
                    x = xx+i
                    y = h - (yy+j)
                    if (x>=0) and (x<w) and (y>=0) and (y<h):
                        color = img.GetPixel(x, y)
                        R = color.R
                        G = color.G
                        B = color.B
                        if (R>=threshold2) and (G>=threshold2) and (B>=threshold2):
                            pp = False
                            break
        if pp==True:
            temp.append(pt)
    
    rs.EnableRedraw(True)
    
    pts = temp
# ---------- end python_10 ----------
duppt_9 = RemoveDuplicatePts(Points=python_10.pts, Tolerance=0.01)  # disabled
shift_4 = ShiftList(List=divide_4.Points, Shift=1, Wrap=False)  # disabled
toggle_5 = BooleanToggle(False)  # disabled
shift_5 = ShiftList(List=explode_5.Vertices, Shift=1, Wrap=False)
extr = Extrude(Base=srf_3, Direction=Z)  # disabled
cull_17 = CullPattern(List=duppt_7, CullPattern=larger_11.OrEqualTo)  # disabled
cull_18 = CullPattern(List=duppt_7, CullPattern=equals_2.Equality)  # disabled
flatten_3 = FlattenTree(Tree=ma_2.Result, Path="{0}")  # disabled
division_6 = Division(A=Z, B=2)  # disabled
python_11 = GhPythonScript(pts=cull_16, threshold=number_slider_8, step=number_slider_9)  # -> out, pts; inputs pts: list of Point3d, threshold: Int32, step: Int32; disabled
# ---------- python_11: Python ----------
__author__ = "Platina"
__version__ = "2021.08.29"

import rhinoscriptsyntax as rs
import ghpythonlib.components as gh
import System.Drawing as SD
import time

filename = 'C:\\AIStructureGenerator\\results\\result_mp.jpg'
count = 0

img = SD.Bitmap(filename)

w = img.Width
h = img.Height

rs.EnableRedraw(False)

temp = []
for pt in pts:
    xx,yy,zz = gh.DeconstructVector(pt)
    xx = int(xx)
    yy = int(yy)
    pp = True
    for i in range(-step+1,step):
        if pp==True:
            for j in range(-step+1,step):
                x = xx+i
                y = h - (yy+j)
                if (x>=0) and (x<w) and (y>=0) and (y<h):
                    color = img.GetPixel(x, y)
                    B = color.B
                    if B>=threshold:
                        temp.append(pt)
                        pp = False
                        break
rs.EnableRedraw(True)

pts = temp
# ---------- end python_11 ----------
shift_6 = ShiftList(List=shift_4, Shift=-1, Wrap=False)  # -> simplify(List); disabled
python_12 = GhPythonScript(
    pts=cull_16,
    threshold=Slider(50, range=0..1000),
    step=Slider(5, range=0..10),
    threshold2=Slider(200, range=0..1000),
    step2=Slider(10, range=0..10),
    run=bool_2)  # -> out, pts; inputs pts: list of Point3d, threshold: Int32, step: Int32, threshold2: Int32, step2: Int32
# ---------- python_12: Python ----------
__author__ = "Platina"
__version__ = "2021.08.29"

import rhinoscriptsyntax as rs
import ghpythonlib.components as gh
import System.Drawing as SD
import time

if run:
    
    filename = 'C:\\AIStructureGenerator\\results\\result_mp.jpg'
    count = 0
    
    img = SD.Bitmap(filename)
    
    w = img.Width
    h = img.Height
    
    rs.EnableRedraw(False)
    
    #周边像素出现蓝色的点留下
    temp = []
    for pt in pts:
        xx,yy,zz = gh.DeconstructVector(pt)
        xx = int(xx)
        yy = int(yy)
        pp = True
        for i in range(-step+1,step):
            if pp==True:
                for j in range(-step+1,step):
                    x = xx+i
                    y = h - (yy+j)
                    if (x>=0) and (x<w) and (y>=0) and (y<h):
                        color = img.GetPixel(x, y)
                        B = color.B
                        if B>=threshold:
                            temp.append(pt)
                            pp = False
                            break
    
    #周边像素出现白色的点剔除
    pts = temp
    temp = []
    for pt in pts:
        xx,yy,zz = gh.DeconstructVector(pt)
        xx = int(xx)
        yy = int(yy)
        pp = True
        for i in range(-step2+1,step2):
            if pp==True:
                for j in range(-step2+1,step2):
                    x = xx+i
                    y = h - (yy+j)
                    if (x>=0) and (x<w) and (y>=0) and (y<h):
                        color = img.GetPixel(x, y)
                        R = color.R
                        G = color.G
                        B = color.B
                        if (R>=threshold2) and (G>=threshold2) and (B>=threshold2):
                            pp = False
                            break
        if pp==True:
            temp.append(pt)
    
    rs.EnableRedraw(True)
    
    img.Dispose()
    
    pts = temp
# ---------- end python_12 ----------
duppt_10 = RemoveDuplicatePts(Points=cull_17, Tolerance=3)  # disabled
subset_5 = SubList(List=duppt_10, Domain=Domain(0, 20), Wrap=True)  # -> List, Index; disabled
python_13 = GhPythonScript(pts=duppt_10, curves=pline, run=toggle_4)  # -> out, a; inputs pts: list of Point3d, curves: list of Curve, run: Boolean; disabled
# ---------- python_13: Python ----------
__author__ = "Platina"
__version__ = "2021.07.25"

import rhinoscriptsyntax as rs
import ghpythonlib.components as gh

def okpass(pt1,pt2):
    curve = rs.AddLine(pt1,pt2)
    l = rs.CurveLength(curve)
    pts = rs.DivideCurve(curve,4)[1:4]
    for j in range(len(a)):
        t = rs.CurveCurveIntersection(curve,a[j])
        if t!=None:
            if (rs.Distance(pt1,t[0][1])>0.01) or (rs.Distance(pt2,t[0][1])>0.01):
                return False
    for pt in pts:
        d = gh.CurveClosestPoint(pt,curves)[2]
        if min(d)<0.2*l:
            return True

def search(k):
    pt = pts[k]
    ptc,ptk,ptd = gh.ClosestPoints(pt,pts,10)
    for i in range(len(ptc)):
        if okpass(pt,ptc[i])==True:
            a.append(rs.AddLine(pt,ptc[i]))
            if pd[ptk[i]]==False:
                pd[ptk[i]] = True
                search(ptk[i])

if run:
    pd = [False for i in range(len(pts))]
    a = []
    
    for i in range(len(pts)):
        if pd[i]==False:
            pd[i] = True
            search(i)
# ---------- end python_13 ----------
neg_2 = Negative(Value=division_6)  # disabled
move_4 = Move(Geometry=extr, Motion=neg_2)  # -> Geometry, Transform; disabled
python_14 = GhPythonScript(curves=subset_4.List, pts=cull_18, run=toggle_5)  # -> out, curves; inputs curves: list of Curve, pts: list of Point3d, run: Boolean; disabled; same code as python
number_slider_10 = Slider(15, range=0..100)  # disabled
path_mapper = PathMapper(shift_6, source="{a}", target="{0;a}")  # disabled
flatten_4 = FlattenTree(Tree=python_9.a, Path="{0}")  # disabled
del_4 = DelaunayMesh(Points=duppt_10, Plane=PlaneXY(0, 0, 0))  # disabled
duppt_11 = RemoveDuplicatePts(Points=python_11.pts, Tolerance=0.01)  # disabled
trim_5 = TrimWithBrep(Curve=crv_9, Brep=move_4.Geometry)  # -> Inside, Outside; disabled
duppt_12 = RemoveDuplicatePts(Points=python_12.pts, Tolerance=0.01)
python_15 = GhPythonScript(pts=pt_11, run=bool_2, bou=pline_6, ptbase=duppt_12)  # -> out, a, pts, bou, pd; inputs pts: list of Point3d, bou: Curve, ptbase: list of Point3d
# ---------- python_15: Python ----------
__author__ = "Platina"
__version__ = "2021.08.29"

import rhinoscriptsyntax as rs
import ghpythonlib.components as gh
#import System.Drawing as SD
import math
import Rhino
import scriptcontext as sc

if run:
    
    sc.doc = Rhino.RhinoDoc.ActiveDoc
    rhdoc = Rhino.RhinoDoc.ActiveDoc
    
    a = []
    
    #filename = 'C:\\AIStructureGenerator\\results\\result_mp.jpg'
    
    #img = SD.Bitmap(filename)
    
    #w = img.Width
    #h = img.Height
    
    #rs.EnableRedraw(False)
    
    """
    def okpass(curve):
        ptv = gh.DivideCurve(curve,100)[0]
        count = 0
        for pt in ptv:
            x,y,z = gh.DeconstructVector(pt)
            y = h - y
            color = img.GetPixel(x, y)
            B = color.B
            if B>100:
                if rs.PointInPlanarClosedCurve(pt,bou)==1:
                    count += 1
        return count/100
    """
    
    n = len(pts)
    
    maxy = -99999
    p = -1
    for i in range(len(pts)):
        y = gh.DeconstructVector(pts[i])[1]
        if y>maxy:
            maxy = y
            p = i
    pts = gh.ShiftList(pts,p,True)
    pd = [True for i in range(len(pts))]
    
    q = -1
    while q<n-1:
        q += 1
        p = q - 1
        bestmatch = 0
        pcurve = None
        pj = -1
        for i in range(len(pts)-3):
            p -= 1
            if p<0:
                p = len(pts)-1
            if pd[p]==True:
                v = gh.Vector2Pt(pts[q],pts[p],True)[0]
                x,y,z = gh.DeconstructVector(v)
                if x<=0 and y>=0: #第四象限
                    pt1 = pts[q]
                    pt2 = pts[p]
                    pt3 = gh.CurveMiddle(gh.Line(pt1,pt2))
                    l = gh.Length(gh.Line(pt1,pt2))
                    v = gh.Rotate(v,-math.pi/2,gh.XYPlane(gh.ConstructPoint(0,0,0)))[0]
                    v = gh.UnitVector(v)
                    for j in [1,-1,2,-2,3,-3,4,-4]:
                        pt4 = gh.Move(pt3,v*j*(l*0.02))[0] #弧线大小
                        if rs.PointInPlanarClosedCurve(pt4,bou)==1: #中点在边界内
                            if gh.CurveClosestPoint(pt4,bou)[2]>10: #中点离边界有距离
                                #curve = gh.Arc3Pt(pt1,pt4,pt2)[0]
                                curve = gh.Interpolate([pt1,pt4,pt2],3,False,1)[0]
                                if len(gh.CurveXCurve(curve,bou)[0])==2: #线段整体都在边界内
                                    count = 0
                                    ds = gh.CurveClosestPoint(ptbase,curve)[2]
                                    for d in ds:
                                        if d<7: #有效点距离阈值
                                            count += 1
                                    score = count/(gh.Length(curve)/10)
                                    #score = okpass(curve)
                                    if score>bestmatch:
                                        bestmatch = score
                                        pcurve = curve
                                        pj = p
        if bestmatch>0.3: #成立比例阈值
            o = pj
            while o!=q:
                pd[o] = False
                o += 1
                if o>=len(pts):
                    o = o - len(pts)
            pd[q] = False
            ptadd = gh.DivideLength(pcurve,10.0)[0][1:]
            #ptadd = ptadd[int((len(ptadd))*0.1):int((len(ptadd))*0.9)]
            ptadd.reverse()
            pts.extend(ptadd)
            pd.extend([True for o in range(len(ptadd))])
            a.append(pcurve)
            bou0,bou1 = gh.Shatter(bou,gh.CurveXCurve(pcurve,bou)[2])[0:2]
            bou0 = gh.JoinCurves([bou0,pcurve],False)
            bou1 = gh.JoinCurves([bou1,pcurve],False)
            if gh.Area(bou0)[0]==None or gh.Area(bou1)[0]==None:
                #rs.AddCurve(gh.DivideCurve(bou0,1000)[0])
                #rs.AddCurve(gh.DivideCurve(bou1,1000)[0])
                rs.AddCurve(gh.DivideCurve(bou,1000)[0])
                rs.AddCurve(gh.DivideCurve(pcurve,1000)[0])
                #rs.AddPoint(gh.CurveXCurve(pcurve,bou)[0])
                #print(gh.CurveXCurve(pcurve,bou)[0])
                #for gg in gh.Shatter(bou,gh.CurveXCurve(pcurve,bou)[2]):
                #    rs.AddCurve(gh.DivideCurve(gg,1000)[0])
                exit(0)
                pass
            a0 = gh.Area(bou0)[1]
            a1 = gh.Area(bou1)[1]
            spt,ept = gh.EndPoints(pcurve)
            v0 = gh.Vector2Pt(spt,a0,True)[0]
            v1 = gh.Vector2Pt(spt,a1,True)[0]
            vm = gh.Vector2Pt(spt,ept,True)[0]
            cp0 = gh.CrossProduct(v0,vm,True)[0]
            x0,y0,z0 = gh.DeconstructVector(cp0)
            cp1 = gh.CrossProduct(v1,vm,True)[0]
            x1,y1,z1 = gh.DeconstructVector(cp1)
            if z0>0 and z1<0:
                bou = bou1
            elif z0<0 and z1>0:
                bou = bou0
            else:
                if gh.Area(bou0)[0]>gh.Area(bou1)[0]:
                    bou = bou0
                else:
                    bou = bou1
    
    #rs.EnableRedraw(True)
# ---------- end python_15 ----------
crv_10 = Curve(python_15.bou)
item_8 = ListItem(List=python_15.pts, Index=Slider(0, range=0..100), Wrap=True)
cull_19 = CullPattern(List=python_15.pts, CullPattern=python_15.pd)
crv_11 = Curve(python_15.a)
merge_11 = Merge(Data1=crv_11, Data2=pline_6)  # -> flatten(Result)
dupln_9 = RemoveDuplicateLines(Lines=flatten_4, Tolerance=0.01)  # disabled
dupln_10 = RemoveDuplicateLines(Lines=python_14.curves, Tolerance=0.01)  # disabled
crv_12 = Curve(flatten(trim_5.Inside))  # disabled
mirror_2 = Mirror(Geometry=path_mapper, Plane=xz)  # -> Geometry, Transform; disabled
graft_7 = GraftTree(Tree=duppt_12, IncludeEmptyLists=True, IncludeNullItems=True)  # -> simplify(Tree)
crv_cp_4 = CurveClosestPoint(Point=graft_7, Curve=crv_11)  # -> Point, Parameter, Distance
rad_3 = Radians(Degrees=number_slider_10)  # disabled
len_8 = Length(Curve=dupln_9)  # disabled
end_13 = EndPoints(Curve=crv_12)  # -> Start, End; disabled
python_16 = GhPythonScript(ptss=mirror_2.Geometry, pleaserun=bool_2)  # -> out, a; inputs ptss: tree of Point3d, pleaserun: Boolean; disabled
# ---------- python_16: Python ----------
import rhinoscriptsyntax as rs
import System.Drawing as SD
import ghpythonlib.components as gh
import ghpythonlib.treehelpers as ghtree

if pleaserun:
    
    ptss = ghtree.tree_to_list(ptss)
    
    filename = './/results//result_bou.jpg'
    
    img = SD.Bitmap(filename)
    
    a = []
    for pts in ptss:
        for pt in pts:
            x,y,z = gh.DeconstructVector(pt)
            pd = False
            for i in range(5):
                for j in range(5):
                    xx = int(x-2+i)
                    yy = int(y-2+j)
                    if xx>=0 and xx<=1023 and yy>=0 and yy<=1023:
                        color = img.GetPixel(int(xx), int(yy))
                        greyscale = 0.299*color.R + 0.587*color.G + 0.114*color.B
                        if greyscale<0.5:
                            pd = True
            if pd==True:
                break
        a.append(pd)
# ---------- end python_16 ----------
end_14 = EndPoints(Curve=dupln_10)  # -> Start, End; disabled
larger_12 = LargerThan(FirstNumber=len_8, SecondNumber=0.01)  # -> LargerThan, OrEqualTo; disabled
sort_6 = SortList(Keys=crv_cp_4.Distance, ValuesA=crv_cp_4.Point)  # -> Keys, ValuesA
neg_3 = Negative(Value=rad_3)  # disabled
tan = Tangent(Value=rad_3)  # disabled
vec2pt_5 = Vector2Pt(PointA=end_13.Start, PointB=end_13.End, Unitize=False)  # -> Vector, Length; disabled
merge_12 = Merge(Data1=end_14.Start, Data2=end_14.End)  # disabled
cull_20 = CullPattern(List=dupln_9, CullPattern=larger_12.LargerThan)  # disabled
neg_4 = Negative(Value=tan)  # disabled
item_9 = ListItem(List=sort_6.ValuesA, Index=0, Wrap=True)  # -> flatten(Item)
duppt_13 = RemoveDuplicatePts(Points=merge_12, Tolerance=0.01)  # disabled
pt_12 = ConstructPoint(XCoordinate=1, YCoordinate=neg_4, ZCoordinate=0)  # disabled
angle_3 = Angle(VectorA=vec2pt_5.Vector, VectorB=pt_12)  # -> Angle, Reflex; disabled
move_5 = Move(Geometry=cull_20, Motion=pt_4)  # -> Geometry, Transform; disabled
cull_21 = CullPattern(List=cluster_5, CullPattern=python_16.a)  # disabled
duppt_14 = RemoveDuplicatePts(Points=item_9, Tolerance=3)
number_slider_11 = Slider(15, range=0..100)  # disabled
cps_3 = ClosestPoints(Point=duppt_13, Cloud=merge_12, Count=3)  # -> ClosestPoint, CPIndex, Distance; disabled
scale_5 = Scale(Geometry=move_5.Geometry, Center=pt_4, Factor=division)  # -> Geometry, Transform; disabled
incurve_2 = PointInCurve(Point=duppt_14, Curve=pline_6)  # -> Relationship, Point
subtraction_7 = Subtraction(A=180, B=number_slider_11)  # disabled
smaller_10 = SmallerThan(FirstNumber=cps_3.Distance, SecondNumber=0.01)  # -> SmallerThan, OrEqualTo; disabled
G = ClusterOutput(scale_5.Geometry)  # disabled
rad_4 = Radians(Degrees=subtraction_7)  # disabled
larger_13 = LargerThan(FirstNumber=angle_3.Angle, SecondNumber=rad_4)  # -> LargerThan, OrEqualTo; disabled
equals_3 = Equality(FirstNumber=incurve_2.Relationship, SecondNumber=2)  # -> Equality, Inequality
rad_5 = Radians(Degrees=number_slider_11)  # disabled
smaller_11 = SmallerThan(FirstNumber=angle_3.Angle, SecondNumber=rad_5)  # -> SmallerThan, OrEqualTo; disabled
or_3 = GateOr(A=smaller_11.SmallerThan, B=larger_13.LargerThan)  # disabled
crv_13 = Curve(cull_21)  # disabled
ma_3 = MassAddition(Input=smaller_10.SmallerThan)  # -> Result, PartialResults; disabled
equals_4 = Equality(FirstNumber=ma_3.Result, SecondNumber=1)  # -> flatten(Equality), Inequality; disabled
xy = XYPlane(Origin=Point(0, 0, 0))  # disabled
cull_22 = CullPattern(List=crv_12, CullPattern=or_3)  # disabled
cull_23 = CullPattern(List=duppt_13, CullPattern=equals_4.Equality)  # disabled
cull_24 = CullPattern(List=duppt_14, CullPattern=equals_3.Equality)
flatten_5 = FlattenTree(Tree=ma_3.Result, Path="{0}")  # disabled
rotate_4 = Rotate(Geometry=xy, Angle=neg_3, Plane=xy)  # -> Geometry, Transform; disabled

grid_divisions_2 = Integer(20)  # disabled
crv_14 = Curve(simplify(crv_13))  # disabled
x_bounds_2 = Domain(Domain(1950, 3650))  # disabled
y_bounds_2 = Domain(Domain(2750, 3550))  # disabled

end_15 = EndPoints(Curve=cull_22)  # -> Start, End; disabled
graft_8 = GraftTree(Tree=dupln_10, IncludeEmptyLists=True, IncludeNullItems=True)  # disabled
merge_13 = Merge(Data1=end_15.Start, Data2=end_15.End)  # disabled
dom²_2 = Domain²(DomainU=x_bounds_2, DomainV=y_bounds_2)  # disabled
crv_cp_5 = CurveClosestPoint(Point=cull_23, Curve=graft_8)  # -> Point, Parameter, Distance; disabled
brec = BoundingRectangle(Geometry=cull_16, Plane=rotate_4.Geometry, Axis=0, Slide=0, Union=True)  # -> Bounding, DimensionX, DimensionY; disabled
explode_6 = Explode(Curve=brec.Bounding, Recursive=True)  # -> Segments, Vertices; disabled
number_slider_12 = Slider(25, range=0..30)  # disabled
number_slider_13 = Slider(25, range=0..30)  # disabled
smaller_12 = SmallerThan(FirstNumber=crv_cp_5.Distance, SecondNumber=0.01)  # -> SmallerThan, OrEqualTo; disabled
duppt_15 = RemoveDuplicatePts(Points=merge_13, Tolerance=0.01)  # disabled
item_10 = ListItem(List=explode_6.Vertices, Index=0, Wrap=True)  # disabled
ma_4 = MassAddition(Input=smaller_12.SmallerThan)  # -> flatten(Result), PartialResults; disabled
hem_open_xy_networks_2 = VBScript(seg=crv_14, bnd=dom²_2, sbdv=grid_divisions_2)  # -> out, flatten(e), flatten(eOV), flatten(ePE), flatten(eNE), flatten(eTE), flatten(eIF), flatten(v)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; inputs seg: list of Curve; disabled; same code as hem_open_xy_networks
one_over_x = OneOverX(Value=number_slider_13)  # disabled
pl_origin = PlaneOrigin(Base=rotate_4.Geometry, Origin=item_10)  # disabled
one_over_x_2 = OneOverX(Value=number_slider_12)  # disabled
scale_nu = ScaleNU(Geometry=brec.Bounding, Plane=pl_origin, ScaleX=one_over_x, ScaleY=one_over_x_2, ScaleZ=1)  # -> Geometry, Transform; disabled
equals_5 = Equality(FirstNumber=ma_4.Result, SecondNumber=0)  # -> Equality, Inequality; disabled
arrrec = RectangularArray(Geometry=scale_nu.Geometry, Cell=scale_nu.Geometry, XCount=number_slider_13, YCount=number_slider_12)  # -> Geometry, Transform; disabled
lng_4 = ListLength(List=arrrec.Geometry)  # disabled
pline_8 = PolyLine(Vertices=hem_open_xy_networks_2.f, Closed=True)  # disabled
cull_25 = CullPattern(List=dupln_10, CullPattern=equals_5.Equality)  # disabled
dup_3 = DuplicateData(Data=False, Number=lng_4, Order=True)  # disabled
incurves = PointInCurves(Point=cull_16, Curves=arrrec.Geometry)  # -> Relationship, Index, Point; disabled
flatten_6 = FlattenTree(Tree=pline_8, Path="{0}")  # disabled
incurves_2 = PointInCurves(Point=duppt_15, Curves=arrrec.Geometry)  # -> Relationship, Index, Point; disabled
end_16 = EndPoints(Curve=cull_25)  # -> Start, End; disabled
number_slider_14 = Slider(15, range=0..90)  # disabled
srf_4 = Surface(flatten_6)  # disabled
replace = ReplaceItems(List=dup_3, Item=True, Indices=incurves_2.Index, Wrap=False)  # -> flatten(List); disabled
item_11 = ListItem(List=replace, Index=incurves.Index, Wrap=True)  # disabled
merge_14 = Merge(Data1=end_16.Start, Data2=end_16.End)  # disabled
area_6 = Area(Geometry=srf_4)  # -> Area, Centroid; disabled
cull_26 = CullPattern(List=cull_16, CullPattern=item_11)  # disabled
duppt_16 = RemoveDuplicatePts(Points=merge_14, Tolerance=0.01)  # disabled
division_7 = Division(A=number_slider_14, B=180)  # disabled
sort_7 = SortList(Keys=area_6.Area, ValuesA=flatten_6)  # -> Keys, ValuesA; disabled
cps_4 = ClosestPoints(Point=duppt_16, Cloud=merge_14, Count=3)  # -> ClosestPoint, CPIndex, Distance; disabled
multiplication_5 = Multiplication(A=division_7, B=3.141592654)  # disabled

# ---- group: make lines to polygons
shift_7 = ShiftList(List=sort_7.ValuesA, Shift=-1, Wrap=False)  # disabled

# ----
smaller_13 = SmallerThan(FirstNumber=cps_4.Distance, SecondNumber=0.01)  # -> SmallerThan, OrEqualTo; disabled
python_17 = GhPythonScript(curves=shift_7, com=dupln_3, rat=multiplication_5)  # -> out, a; inputs curves: list of Curve, com: list of Curve; disabled; same code as python_9
merge_15 = Merge(Data1=shift_5, Data2=cull_26)  # -> flatten(Result); disabled
merge_16 = Merge(Data1=shift_5, Data2=duppt_12)  # -> flatten(Result); disabled
merge_17 = Merge(Data1=shift_5, Data2=cull_24)  # -> flatten(Result)
graft_9 = GraftTree(Tree=shift_7, IncludeEmptyLists=True, IncludeNullItems=True)  # disabled
ma_5 = MassAddition(Input=smaller_13.SmallerThan)  # -> Result, PartialResults; disabled
equals_6 = Equality(FirstNumber=ma_5.Result, SecondNumber=2)  # -> flatten(Equality), Inequality; disabled
toggle_6 = BooleanToggle(False)  # disabled
cull_27 = CullPattern(List=duppt_16, CullPattern=equals_6.Equality)  # disabled
flatten_7 = FlattenTree(Tree=ma_5.Result, Path="{0}")  # disabled
boundary_3 = BoundarySurfaces(Edges=graft_9)  # -> flatten(Surfaces); disabled
duppt_17 = RemoveDuplicatePts(Points=merge_15, Tolerance=4)  # disabled
duppt_18 = RemoveDuplicatePts(Points=merge_16, Tolerance=4)  # disabled
duppt_19 = RemoveDuplicatePts(Points=merge_17, Tolerance=4)
flatten_8 = FlattenTree(Tree=python_17.a, Path="{0}")  # disabled
del_5 = DelaunayMesh(Points=duppt_17, Plane=PlaneXY(0, 0, 0))  # disabled
del_6 = DelaunayMesh(Points=duppt_18, Plane=PlaneXY(0, 0, 0))  # disabled
del_7 = DelaunayMesh(Points=duppt_19, Plane=PlaneXY(0, 0, 0))
srf_5 = Surface(boundary_3)  # disabled
python_18 = GhPythonScript(curves=cull_25, pts=cull_27, run=toggle_6)  # -> out, curves; inputs curves: list of Curve, pts: list of Point3d, run: Boolean; disabled; same code as python
dupln_11 = RemoveDuplicateLines(Lines=flatten_8, Tolerance=0.01)  # disabled
wbedges_5 = WeaverbirdsMeshEdges(MeshOrPolylines=del_5)  # disabled
wbedges_6 = WeaverbirdsMeshEdges(MeshOrPolylines=del_6)  # disabled
wbedges_7 = WeaverbirdsMeshEdges(MeshOrPolylines=del_7)
ccx = CurveCurve(CurveA=wbedges_5, CurveB=pline_6)  # -> Points, ParamsA, ParamsB; disabled
ccx_2 = CurveCurve(CurveA=wbedges_6, CurveB=pline_6)  # -> Points, ParamsA, ParamsB; disabled
ccx_3 = CurveCurve(CurveA=wbedges_7, CurveB=pline_6)  # -> Points, ParamsA, ParamsB
curvepoint_3 = PointOnCurve(wbedges_5, parameter=0.5)  # disabled
incurve_3 = PointInCurve(Point=curvepoint_3, Curve=pline_6)  # -> Relationship, Point; disabled
dupln_12 = RemoveDuplicateLines(Lines=python_18.curves, Tolerance=0.01)  # disabled
len_9 = Length(Curve=dupln_11)  # disabled
curvepoint_4 = PointOnCurve(wbedges_6, parameter=0.5)  # disabled
incurve_4 = PointInCurve(Point=curvepoint_4, Curve=pline_6)  # -> Relationship, Point; disabled
curvepoint_5 = PointOnCurve(wbedges_7, parameter=0.5)
incurve_5 = PointInCurve(Point=curvepoint_5, Curve=pline_6)  # -> Relationship, Point
larger_14 = LargerThan(FirstNumber=len_9, SecondNumber=0.01)  # -> LargerThan, OrEqualTo; disabled
lng_5 = ListLength(List=ccx.Points)  # -> flatten(Length); disabled
equals_7 = Equality(FirstNumber=incurve_3.Relationship, SecondNumber=2)  # -> Equality, Inequality; disabled
lng_6 = ListLength(List=ccx_2.Points)  # -> flatten(Length); disabled
equals_8 = Equality(FirstNumber=incurve_4.Relationship, SecondNumber=2)  # -> Equality, Inequality; disabled
lng_7 = ListLength(List=ccx_3.Points)  # -> flatten(Length)
equals_9 = Equality(FirstNumber=incurve_5.Relationship, SecondNumber=2)  # -> Equality, Inequality
end_17 = EndPoints(Curve=dupln_12)  # -> Start, End; disabled
cull_28 = CullPattern(List=dupln_11, CullPattern=larger_14.LargerThan)  # disabled
smaller_14 = SmallerThan(FirstNumber=lng_5, SecondNumber=2)  # -> SmallerThan, OrEqualTo; disabled
and_4 = GateAnd(A=equals_7.Equality, B=smaller_14.SmallerThan)  # disabled
smaller_15 = SmallerThan(FirstNumber=lng_6, SecondNumber=2)  # -> SmallerThan, OrEqualTo; disabled
and_5 = GateAnd(A=equals_8.Equality, B=smaller_15.SmallerThan)  # disabled
cull_29 = CullPattern(List=wbedges_5, CullPattern=and_4)  # disabled
smaller_16 = SmallerThan(FirstNumber=lng_7, SecondNumber=2)  # -> SmallerThan, OrEqualTo
and_6 = GateAnd(A=equals_9.Equality, B=smaller_16.SmallerThan)
cull_30 = CullPattern(List=wbedges_6, CullPattern=and_5)  # disabled
cull_31 = CullPattern(List=wbedges_7, CullPattern=and_6)
merge_18 = Merge(Data1=end_17.Start, Data2=end_17.End)  # disabled
move_6 = Move(Geometry=cull_28, Motion=pt_4)  # -> Geometry, Transform; disabled
end_18 = EndPoints(Curve=cull_31)  # -> Start, End
duppt_20 = RemoveDuplicatePts(Points=merge_18, Tolerance=0.01)  # disabled
lng_8 = ListLength(List=crv_11)
merge_19 = Merge(Data1=pline_6, Data2=cull_29)  # -> flatten(Result); disabled
merge_20 = Merge(Data1=pline_6, Data2=ln_7, Data3=pline_7, Data4=cull_29)  # -> flatten(Result); disabled
scale_6 = Scale(Geometry=move_6.Geometry, Center=pt_4, Factor=division)  # -> Geometry, Transform; disabled
merge_21 = Merge(Data1=pline_6, Data2=ln_7, Data3=pline_7, Data4=cull_30)  # -> flatten(Result); disabled
merge_22 = Merge(Data1=pline_6, Data2=ln_7, Data3=pline_7, Data4=cull_31)  # -> flatten(Result)
graft_10 = GraftTree(Tree=end_18.End, IncludeEmptyLists=True, IncludeNullItems=True)
graft_11 = GraftTree(Tree=end_18.Start, IncludeEmptyLists=True, IncludeNullItems=True)
cps_5 = ClosestPoints(Point=duppt_20, Cloud=merge_18, Count=3)  # -> ClosestPoint, CPIndex, Distance; disabled
series_2 = Series(Start=0, Step=1, Count=lng_8)
G_2 = ClusterOutput(scale_6.Geometry)  # disabled
explode_7 = Explode(Curve=merge_19, Recursive=True)  # -> flatten(Segments), Vertices; disabled
explode_8 = Explode(Curve=merge_20, Recursive=True)  # -> flatten(Segments), Vertices; disabled
explode_9 = Explode(Curve=merge_21, Recursive=True)  # -> flatten(Segments), Vertices; disabled
explode_10 = Explode(Curve=merge_22, Recursive=True)  # -> flatten(Segments), Vertices
crv_cp_6 = CurveClosestPoint(Point=graft_10, Curve=crv_11)  # -> Point, Parameter, Distance
crv_cp_7 = CurveClosestPoint(Point=graft_11, Curve=crv_11)  # -> Point, Parameter, Distance
smaller_17 = SmallerThan(FirstNumber=cps_5.Distance, SecondNumber=0.01)  # -> SmallerThan, OrEqualTo; disabled
dupln_13 = RemoveDuplicateLines(Lines=explode_7.Segments, Tolerance=0.01)  # disabled
smaller_18 = SmallerThan(FirstNumber=crv_cp_6.Distance, SecondNumber=0.01)  # -> SmallerThan, OrEqualTo
smaller_19 = SmallerThan(FirstNumber=crv_cp_7.Distance, SecondNumber=0.01)  # -> SmallerThan, OrEqualTo
dupln_14 = RemoveDuplicateLines(Lines=explode_8.Segments, Tolerance=0.01)  # disabled
dupln_15 = RemoveDuplicateLines(Lines=explode_9.Segments, Tolerance=0.01)  # disabled
ma_6 = MassAddition(Input=smaller_17.SmallerThan)  # -> Result, PartialResults; disabled
equals_10 = Equality(FirstNumber=ma_6.Result, SecondNumber=1)  # -> flatten(Equality), Inequality; disabled
dupln_16 = RemoveDuplicateLines(Lines=explode_10.Segments, Tolerance=0.01)
crv_15 = Curve(dupln_13)  # disabled
cull_32 = CullPattern(List=series_2, CullPattern=smaller_18.SmallerThan)
cull_33 = CullPattern(List=series_2, CullPattern=smaller_19.SmallerThan)
cull_34 = CullPattern(List=duppt_20, CullPattern=equals_10.Equality)  # disabled
flatten_9 = FlattenTree(Tree=ma_6.Result, Path="{0}")  # disabled
end_19 = EndPoints(Curve=crv_15)  # -> Start, End; disabled
crv_16 = Curve(dupln_16)
graft_12 = GraftTree(Tree=dupln_12, IncludeEmptyLists=True, IncludeNullItems=True)  # disabled
equals_11 = Equality(FirstNumber=cull_33, SecondNumber=cull_32)  # -> Equality, Inequality
crv_17 = Curve(dupln_14)  # disabled
crv_18 = Curve(dupln_15)  # disabled
vec2pt_6 = Vector2Pt(PointA=end_19.Start, PointB=end_19.End, Unitize=False)  # -> Vector, Length; disabled
ins = InsertItems(List=equals_11.Equality, Item=False, Indices=0, Wrap=False)
crv_cp_8 = CurveClosestPoint(Point=cull_34, Curve=graft_12)  # -> Point, Parameter, Distance; disabled
grid_divisions_3 = Integer(20)
crv_19 = Curve(simplify(crv_16))
x_bounds_3 = Domain(Domain(1950, 3650))
y_bounds_3 = Domain(Domain(2750, 3550))
number_slider_15 = Slider(45, range=0..100)  # disabled
grid_divisions_4 = Integer(20)  # disabled
smaller_20 = SmallerThan(FirstNumber=crv_cp_8.Distance, SecondNumber=0.01)  # -> SmallerThan, OrEqualTo; disabled
crv_20 = Curve(simplify(crv_17))  # disabled
angle_4 = Angle(VectorA=vec2pt_6.Vector, VectorB=pt_12)  # -> Angle, Reflex; disabled
ma_7 = MassAddition(Input=ins)  # -> flatten(Result), PartialResults
grid_divisions_5 = Integer(20)  # disabled
crv_21 = Curve(simplify(crv_18))  # disabled
x_bounds_4 = Domain(Domain(1950, 3650))  # disabled
y_bounds_4 = Domain(Domain(2750, 3550))  # disabled
x_bounds_5 = Domain(Domain(1950, 3650))  # disabled
y_bounds_5 = Domain(Domain(2750, 3550))  # disabled
dom²_3 = Domain²(DomainU=x_bounds_3, DomainV=y_bounds_3)
ma_8 = MassAddition(Input=smaller_20.SmallerThan)  # -> flatten(Result), PartialResults; disabled
larger_15 = LargerThan(FirstNumber=ma_7.Result, SecondNumber=0)  # -> LargerThan, OrEqualTo
cull_35 = CullPattern(List=cull_31, CullPattern=larger_15.LargerThan)
dom²_4 = Domain²(DomainU=x_bounds_4, DomainV=y_bounds_4)  # disabled
dom²_5 = Domain²(DomainU=x_bounds_5, DomainV=y_bounds_5)  # disabled
subtraction_8 = Subtraction(A=180, B=number_slider_15)  # disabled
rad_6 = Radians(Degrees=number_slider_15)  # disabled
larger_16 = LargerThan(FirstNumber=angle_4.Angle, SecondNumber=rad_6)  # -> LargerThan, OrEqualTo; disabled
equals_12 = Equality(FirstNumber=ma_8.Result, SecondNumber=0)  # -> Equality, Inequality; disabled
rad_7 = Radians(Degrees=subtraction_8)  # disabled
smaller_21 = SmallerThan(FirstNumber=angle_4.Angle, SecondNumber=rad_7)  # -> SmallerThan, OrEqualTo; disabled
and_7 = GateAnd(A=larger_16.LargerThan, B=smaller_21.SmallerThan)  # disabled
hem_open_xy_networks_3 = VBScript(seg=crv_19, bnd=dom²_3, sbdv=grid_divisions_3)  # -> out, flatten(e), flatten(eOV), flatten(ePE), flatten(eNE), flatten(eTE), flatten(eIF), flatten(v)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; inputs seg: list of Curve; same code as hem_open_xy_networks
not_2 = GateNot(A=and_7)  # disabled
cull_36 = CullPattern(List=dupln_12, CullPattern=equals_12.Equality)  # disabled
hem_open_xy_networks_4 = VBScript(seg=crv_20, bnd=dom²_4, sbdv=grid_divisions_4)  # -> out, flatten(e), flatten(eOV), flatten(ePE), flatten(eNE), flatten(eTE), flatten(eIF), flatten(v)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; inputs seg: list of Curve; disabled; same code as hem_open_xy_networks
hem_open_xy_networks_5 = VBScript(seg=crv_21, bnd=dom²_5, sbdv=grid_divisions_5)  # -> out, flatten(e), flatten(eOV), flatten(ePE), flatten(eNE), flatten(eTE), flatten(eIF), flatten(v)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; inputs seg: list of Curve; disabled; same code as hem_open_xy_networks
cull_37 = CullPattern(List=crv_15, CullPattern=and_7)  # disabled
cull_38 = CullPattern(List=crv_15, CullPattern=not_2)  # disabled
pline_9 = PolyLine(Vertices=hem_open_xy_networks_3.f, Closed=True)
end_20 = EndPoints(Curve=cull_36)  # -> Start, End; disabled
graft_13 = GraftTree(Tree=cull_37, IncludeEmptyLists=True, IncludeNullItems=True)  # disabled
end_21 = EndPoints(Curve=graft_13)  # -> Start, End; disabled
lng_9 = ListLength(List=crv_2)  # disabled
pline_10 = PolyLine(Vertices=hem_open_xy_networks_4.f, Closed=True)  # disabled
pline_11 = PolyLine(Vertices=hem_open_xy_networks_5.f, Closed=True)  # disabled
merge_23 = Merge(Data1=end_20.Start, Data2=end_20.End)  # disabled
flatten_10 = FlattenTree(Tree=pline_9, Path="{0}")
vec2pt_7 = Vector2Pt(PointA=end_21.Start, PointB=end_21.End, Unitize=False)  # -> simplify(Vector), Length; disabled
number_slider_16 = Slider(15, range=0..100)  # disabled
series_3 = Series(Start=0, Step=1, Count=lng_9)  # disabled
flatten_11 = FlattenTree(Tree=pline_10, Path="{0}")  # disabled
duppt_21 = RemoveDuplicatePts(Points=merge_23, Tolerance=0.01)  # disabled
curvepoint_6 = PointOnCurve(graft_13, parameter=0.5)  # disabled
flatten_12 = FlattenTree(Tree=pline_11, Path="{0}")  # disabled
srf_6 = Surface(flatten_10)
number_slider_17 = Slider(10, range=0..100)  # disabled
srf_7 = Surface(flatten_11)  # disabled
cps_6 = ClosestPoints(Point=duppt_21, Cloud=merge_23, Count=3)  # -> ClosestPoint, CPIndex, Distance; disabled
srf_8 = Surface(flatten_12)  # disabled
area_7 = Area(Geometry=srf_6)  # -> Area, Centroid
subtraction_9 = Subtraction(A=180, B=number_slider_16)  # disabled
rad_8 = Radians(Degrees=number_slider_16)  # disabled
crv_cp_9 = CurveClosestPoint(Point=curvepoint_6, Curve=crv_2)  # -> Point, Parameter, Distance; disabled
area_8 = Area(Geometry=srf_7)  # -> Area, Centroid; disabled
smaller_22 = SmallerThan(FirstNumber=cps_6.Distance, SecondNumber=0.01)  # -> SmallerThan, OrEqualTo; disabled
area_9 = Area(Geometry=srf_8)  # -> Area, Centroid; disabled
sort_8 = SortList(Keys=area_7.Area, ValuesA=flatten_10)  # -> Keys, ValuesA
rad_9 = Radians(Degrees=subtraction_9)  # disabled
smaller_23 = SmallerThan(FirstNumber=crv_cp_9.Distance, SecondNumber=number_slider_17)  # -> SmallerThan, OrEqualTo; disabled
cull_39 = CullPattern(List=crv_2, CullPattern=smaller_23.SmallerThan)  # -> simplify(List); disabled
sort_9 = SortList(Keys=area_8.Area, ValuesA=flatten_11)  # -> Keys, ValuesA; disabled
ma_9 = MassAddition(Input=smaller_22.SmallerThan)  # -> Result, PartialResults; disabled
equals_13 = Equality(FirstNumber=ma_9.Result, SecondNumber=2)  # -> flatten(Equality), Inequality; disabled
sort_10 = SortList(Keys=area_9.Area, ValuesA=flatten_12)  # -> Keys, ValuesA; disabled
shift_8 = ShiftList(List=sort_8.ValuesA, Shift=-1, Wrap=False)
toggle_7 = BooleanToggle(False)  # disabled
cull_40 = CullPattern(List=duppt_21, CullPattern=equals_13.Equality)  # disabled
flatten_13 = FlattenTree(Tree=ma_9.Result, Path="{0}")  # disabled
shift_9 = ShiftList(List=sort_9.ValuesA, Shift=-1, Wrap=False)  # disabled
shift_10 = ShiftList(List=sort_10.ValuesA, Shift=-1, Wrap=False)  # disabled
end_22 = EndPoints(Curve=cull_39)  # -> Start, End; disabled
explode_11 = Explode(Curve=shift_8, Recursive=True)  # -> Segments, simplify(Vertices)
vec2pt_8 = Vector2Pt(PointA=end_22.Start, PointB=end_22.End, Unitize=False)  # -> Vector, Length; disabled
angle_5 = Angle(VectorA=vec2pt_7.Vector, VectorB=vec2pt_8.Vector)  # -> Angle, Reflex; disabled
larger_17 = LargerThan(FirstNumber=angle_5.Angle, SecondNumber=rad_9)  # -> LargerThan, OrEqualTo; disabled
smaller_24 = SmallerThan(FirstNumber=angle_5.Angle, SecondNumber=rad_8)  # -> SmallerThan, OrEqualTo; disabled
or_4 = GateOr(A=smaller_24.SmallerThan, B=larger_17.LargerThan)  # disabled
ma_10 = MassAddition(Input=or_4)  # -> Result, PartialResults; disabled
larger_18 = LargerThan(FirstNumber=ma_10.Result, SecondNumber=0)  # -> LargerThan, OrEqualTo; disabled
explode_12 = Explode(Curve=shift_9, Recursive=True)  # -> Segments, simplify(Vertices); disabled
explode_13 = Explode(Curve=shift_10, Recursive=True)  # -> Segments, simplify(Vertices); disabled
python_19 = GhPythonScript(curves=cull_36, pts=cull_40, run=toggle_7)  # -> out, curves; inputs curves: list of Curve, pts: list of Point3d, run: Boolean; disabled; same code as python
shift_11 = ShiftList(List=explode_11.Vertices, Shift=1, Wrap=False)  # -> simplify(List)
cull_41 = CullPattern(List=graft_13, CullPattern=larger_18.LargerThan)  # -> flatten(List); disabled
shift_12 = ShiftList(List=explode_12.Vertices, Shift=1, Wrap=False)  # -> simplify(List); disabled
shift_13 = ShiftList(List=explode_13.Vertices, Shift=1, Wrap=False)  # -> simplify(List); disabled
path_mapper_2 = PathMapper(shift_11, source="{a}", target="{0;a}")
dupln_17 = RemoveDuplicateLines(Lines=python_19.curves, Tolerance=0.01)  # disabled
merge_24 = Merge(Data1=pline_6, Data2=ln_7, Data3=pline_7, Data4=cull_41)  # -> flatten(Result); disabled
path_mapper_3 = PathMapper(shift_12, source="{a}", target="{0;a}")  # disabled
path_mapper_4 = PathMapper(shift_13, source="{a}", target="{0;a}")  # disabled
end_23 = EndPoints(Curve=dupln_17)  # -> Start, End; disabled
pt_13 = Point(path_mapper_2)
explode_14 = Explode(Curve=merge_24, Recursive=True)  # -> flatten(Segments), Vertices; disabled
merge_25 = Merge(Data1=end_23.Start, Data2=end_23.End)  # disabled
pt_14 = Point(path_mapper_3)  # disabled
pt_15 = Point(path_mapper_4)  # disabled
dupln_18 = RemoveDuplicateLines(Lines=explode_14.Segments, Tolerance=0.01)  # disabled

# ---- group: 迭代更新凹多边形顶点
python_20 = GhPythonScript(pts=pt_13)  # -> out, a, count, loops; inputs pts: tree of Point3d
# ---------- python_20: Python ----------
__author__ = "Platina"
__version__ = "2019.11.23"

import rhinoscriptsyntax as rs
import ghpythonlib.components as gh
import ghpythonlib.treehelpers as ghtree
import math

pts = ghtree.tree_to_list(pts)

loops = 0
while True:
    count = 0
    for i in range(len(pts)):
        j = 0
        while j<len(pts[i]):
            q = j - 1
            p = j + 1
            if q<0:
                q = len(pts[i])-1
            if p>len(pts[i])-1:
                p = 0
            pt1 = pts[i][q]
            pt2 = gh.ConstructPoint(pts[i][j][0],pts[i][j][1],pts[i][j][2])
            pt3 = pts[i][p]
            vec1 = gh.UnitVector(pt2 - pt1)
            vec2 = gh.UnitVector(pt3 - pt2)
            if (gh.VectorLength(vec1)!=0) and (gh.VectorLength(vec2)!=0):
                ang = rs.VectorAngle(vec1,vec2)
                cro = rs.VectorCrossProduct(vec1,vec2)
                if (ang<3) or (cro[2]>0):
                    count = count + 1
                    vec3 = gh.UnitVector(pt1 - pt2)
                    vec = gh.UnitVector(vec3+vec2)
                    if (cro[2]<0):
                        vec = gh.Reverse(vec)
                    elif (cro[2]==0):
                        vec = gh.Rotate(vec1,math.pi/2,gh.XYPlane())
                    vec = gh.UnitVector(vec) * 1.111111
                    for ii in range(len(pts)):
                        for jj in range(len(pts[ii])):
                            if rs.Distance(pts[ii][jj],pt2)<0.01:
                                pts[ii][jj] = pt2 + vec
            j = j + 1
    if count==0:
        break
    if loops>=100:
        break
    loops = loops + 1

a = ghtree.list_to_tree(pts)
# ---------- end python_20 ----------

# ----
duppt_22 = RemoveDuplicatePts(Points=merge_25, Tolerance=0.01)  # disabled

# ---- group: 角度15，迭代更新凹多边形顶点
python_21 = GhPythonScript(pts=pt_14)  # -> out, a, count, loops; inputs pts: tree of Point3d; disabled
# ---------- python_21: Python ----------
__author__ = "Platina"
__version__ = "2019.11.23"

import rhinoscriptsyntax as rs
import ghpythonlib.components as gh
import ghpythonlib.treehelpers as ghtree
import math

pts = ghtree.tree_to_list(pts)

loops = 0
while True:
    count = 0
    for i in range(len(pts)):
        j = 0
        while j<len(pts[i]):
            q = j - 1
            p = j + 1
            if q<0:
                q = len(pts[i])-1
            if p>len(pts[i])-1:
                p = 0
            pt1 = pts[i][q]
            pt2 = gh.ConstructPoint(pts[i][j][0],pts[i][j][1],pts[i][j][2])
            pt3 = pts[i][p]
            vec1 = gh.UnitVector(pt2 - pt1)
            vec2 = gh.UnitVector(pt3 - pt2)
            if (gh.VectorLength(vec1)!=0) and (gh.VectorLength(vec2)!=0):
                ang = rs.VectorAngle(vec1,vec2)
                cro = rs.VectorCrossProduct(vec1,vec2)
                if (ang<15) or (cro[2]>0):
                    count = count + 1
                    vec3 = gh.UnitVector(pt1 - pt2)
                    vec = gh.UnitVector(vec3+vec2)
                    if (cro[2]<0):
                        vec = gh.Reverse(vec)
                    elif (cro[2]==0):
                        vec = gh.Rotate(vec1,math.pi/2,gh.XYPlane())
                    vec = gh.UnitVector(vec) * 1.111111
                    for ii in range(len(pts)):
                        for jj in range(len(pts[ii])):
                            if rs.Distance(pts[ii][jj],pt2)<0.01:
                                pts[ii][jj] = pt2 + vec
            j = j + 1
    if count==0:
        break
    if loops>=50:
        break
    loops = loops + 1

a = ghtree.list_to_tree(pts)
# ---------- end python_21 ----------

# ---- group: 迭代更新凹多边形顶点
python_22 = GhPythonScript(pts=pt_14)  # -> out, a, count, loops; inputs pts: tree of Point3d; disabled
# ---------- python_22: Python ----------
__author__ = "Platina"
__version__ = "2019.11.23"

import rhinoscriptsyntax as rs
import ghpythonlib.components as gh
import ghpythonlib.treehelpers as ghtree
import math

pts = ghtree.tree_to_list(pts)

loops = 0
while True:
    count = 0
    for i in range(len(pts)):
        j = 0
        while j<len(pts[i]):
            q = j - 1
            p = j + 1
            if q<0:
                q = len(pts[i])-1
            if p>len(pts[i])-1:
                p = 0
            pt1 = pts[i][q]
            pt2 = gh.ConstructPoint(pts[i][j][0],pts[i][j][1],pts[i][j][2])
            pt3 = pts[i][p]
            vec1 = gh.UnitVector(pt2 - pt1)
            vec2 = gh.UnitVector(pt3 - pt2)
            if (gh.VectorLength(vec1)!=0) and (gh.VectorLength(vec2)!=0):
                ang = rs.VectorAngle(vec1,vec2)
                cro = rs.VectorCrossProduct(vec1,vec2)
                if (ang<3) or (cro[2]>0):
                    count = count + 1
                    vec3 = gh.UnitVector(pt1 - pt2)
                    vec = gh.UnitVector(vec3+vec2)
                    if (cro[2]<0):
                        vec = gh.Reverse(vec)
                    elif (cro[2]==0):
                        vec = gh.Rotate(vec1,math.pi/2,gh.XYPlane())
                    vec = gh.UnitVector(vec) * 1.111111
                    for ii in range(len(pts)):
                        for jj in range(len(pts[ii])):
                            if rs.Distance(pts[ii][jj],pt2)<0.01:
                                pts[ii][jj] = pt2 + vec
            j = j + 1
    if count==0:
        break
    if loops>=50:
        break
    loops = loops + 1

a = ghtree.list_to_tree(pts)
# ---------- end python_22 ----------

python_23 = GhPythonScript(pts=pt_15)  # -> out, a, count, loops; inputs pts: tree of Point3d; disabled; same code as python_22

# ----
cps_7 = ClosestPoints(Point=duppt_22, Cloud=merge_25, Count=3)  # -> ClosestPoint, CPIndex, Distance; disabled
pline_12 = PolyLine(Vertices=python_20.a, Closed=True)  # -> flatten(Polyline)
pline_13 = PolyLine(Vertices=python_22.a, Closed=True)  # -> flatten(Polyline); disabled
pline_14 = PolyLine(Vertices=python_21.a, Closed=True)  # -> flatten(Polyline); disabled
smaller_25 = SmallerThan(FirstNumber=cps_7.Distance, SecondNumber=0.01)  # -> SmallerThan, OrEqualTo; disabled
pline_15 = PolyLine(Vertices=python_23.a, Closed=True)  # -> flatten(Polyline); disabled
explode_15 = Explode(Curve=pline_12, Recursive=True)  # -> flatten(Segments), Vertices
srf_9 = Surface(pline_12)
ma_11 = MassAddition(Input=smaller_25.SmallerThan)  # -> Result, PartialResults; disabled
equals_14 = Equality(FirstNumber=ma_11.Result, SecondNumber=1)  # -> flatten(Equality), Inequality; disabled
explode_16 = Explode(Curve=pline_13, Recursive=True)  # -> flatten(Segments), Vertices; disabled
crv_22 = Curve(pline_14)  # disabled
explode_17 = Explode(Curve=pline_15, Recursive=True)  # -> flatten(Segments), Vertices; disabled
srf_10 = Surface(pline_13)  # disabled
srf_11 = Surface(pline_15)  # disabled
dupln_19 = RemoveDuplicateLines(Lines=explode_15.Segments, Tolerance=0.01)
cull_42 = CullPattern(List=duppt_22, CullPattern=equals_14.Equality)  # disabled
flatten_14 = FlattenTree(Tree=ma_11.Result, Path="{0}")  # disabled
dupln_20 = RemoveDuplicateLines(Lines=explode_16.Segments, Tolerance=0.01)  # disabled
dupln_21 = RemoveDuplicateLines(Lines=explode_17.Segments, Tolerance=0.01)  # disabled
graft_14 = GraftTree(Tree=dupln_17, IncludeEmptyLists=True, IncludeNullItems=True)  # disabled
move_7 = Move(Geometry=merge_11, Motion=pt_4)  # -> Geometry, Transform
move_8 = Move(Geometry=dupln_19, Motion=pt_4)  # -> Geometry, Transform
crv_cp_10 = CurveClosestPoint(Point=cull_42, Curve=graft_14)  # -> Point, Parameter, Distance; disabled
move_9 = Move(Geometry=dupln_20, Motion=pt_4)  # -> Geometry, Transform; disabled
move_10 = Move(Geometry=dupln_21, Motion=pt_4)  # -> Geometry, Transform; disabled
smaller_26 = SmallerThan(FirstNumber=crv_cp_10.Distance, SecondNumber=0.01)  # -> SmallerThan, OrEqualTo; disabled
scale_7 = Scale(Geometry=move_7.Geometry, Center=pt_4, Factor=division)  # -> Geometry, Transform
scale_8 = Scale(Geometry=move_8.Geometry, Center=pt_4, Factor=division)  # -> Geometry, Transform
scale_9 = Scale(Geometry=move_9.Geometry, Center=pt_4, Factor=division)  # -> Geometry, Transform; disabled
scale_10 = Scale(Geometry=move_10.Geometry, Center=pt_4, Factor=division)  # -> Geometry, Transform; disabled
move_11 = Move(Geometry=scale_8.Geometry, Motion=X)  # -> Geometry, Transform
ma_12 = MassAddition(Input=smaller_26.SmallerThan)  # -> flatten(Result), PartialResults; disabled
G_3 = ClusterOutput(scale_7.Geometry)
G_4 = ClusterOutput(scale_9.Geometry)  # disabled
G_5 = ClusterOutput(scale_8.Geometry)
G_6 = ClusterOutput(scale_10.Geometry)  # disabled
equals_15 = Equality(FirstNumber=ma_12.Result, SecondNumber=0)  # -> Equality, Inequality; disabled
cull_43 = CullPattern(List=dupln_17, CullPattern=equals_15.Equality)  # disabled
end_24 = EndPoints(Curve=cull_43)  # -> Start, End; disabled
merge_26 = Merge(Data1=end_24.Start, Data2=end_24.End)  # disabled
duppt_23 = RemoveDuplicatePts(Points=merge_26, Tolerance=0.01)  # disabled
cps_8 = ClosestPoints(Point=duppt_23, Cloud=merge_26, Count=3)  # -> ClosestPoint, CPIndex, Distance; disabled
smaller_27 = SmallerThan(FirstNumber=cps_8.Distance, SecondNumber=0.01)  # -> SmallerThan, OrEqualTo; disabled
ma_13 = MassAddition(Input=smaller_27.SmallerThan)  # -> Result, PartialResults; disabled
equals_16 = Equality(FirstNumber=ma_13.Result, SecondNumber=2)  # -> flatten(Equality), Inequality; disabled
toggle_8 = BooleanToggle(False)  # disabled
cull_44 = CullPattern(List=duppt_23, CullPattern=equals_16.Equality)  # disabled
flatten_15 = FlattenTree(Tree=ma_13.Result, Path="{0}")  # disabled
python_24 = GhPythonScript(curves=cull_43, pts=cull_44, run=toggle_8)  # -> out, curves; inputs curves: list of Curve, pts: list of Point3d, run: Boolean; disabled; same code as python
dupln_22 = RemoveDuplicateLines(Lines=python_24.curves, Tolerance=0.01)  # disabled
end_25 = EndPoints(Curve=dupln_22)  # -> Start, End; disabled
merge_27 = Merge(Data1=end_25.Start, Data2=end_25.End)  # disabled
duppt_24 = RemoveDuplicatePts(Points=merge_27, Tolerance=0.01)  # disabled
cps_9 = ClosestPoints(Point=duppt_24, Cloud=merge_27, Count=3)  # -> ClosestPoint, CPIndex, Distance; disabled
smaller_28 = SmallerThan(FirstNumber=cps_9.Distance, SecondNumber=0.01)  # -> SmallerThan, OrEqualTo; disabled
ma_14 = MassAddition(Input=smaller_28.SmallerThan)  # -> Result, PartialResults; disabled
equals_17 = Equality(FirstNumber=ma_14.Result, SecondNumber=1)  # -> flatten(Equality), Inequality; disabled
cull_45 = CullPattern(List=duppt_24, CullPattern=equals_17.Equality)  # disabled
flatten_16 = FlattenTree(Tree=ma_14.Result, Path="{0}")  # disabled
graft_15 = GraftTree(Tree=dupln_22, IncludeEmptyLists=True, IncludeNullItems=True)  # disabled
crv_cp_11 = CurveClosestPoint(Point=cull_45, Curve=graft_15)  # -> Point, Parameter, Distance; disabled
smaller_29 = SmallerThan(FirstNumber=crv_cp_11.Distance, SecondNumber=0.01)  # -> SmallerThan, OrEqualTo; disabled
ma_15 = MassAddition(Input=smaller_29.SmallerThan)  # -> flatten(Result), PartialResults; disabled
equals_18 = Equality(FirstNumber=ma_15.Result, SecondNumber=0)  # -> Equality, Inequality; disabled
cull_46 = CullPattern(List=dupln_22, CullPattern=equals_18.Equality)  # disabled

# ==== cluster Generate_Optimization_Training_Data
txt = ClusterInput()
crv = ClusterInput()
crv_2 = ClusterInput()
txt_2 = Text(txt)
crv_3 = Curve(crv)
crv_4 = Curve(crv_2)
pleaserun = ClusterInput()
int = ClusterInput()
int_2 = Integer(int)
file = ReadFile(File=txt_2, PerLineParse=True)
num = Number(file)
lng = ListLength(List=num)
num_2 = Number(Slider(0.1, range=0..1))
division = Division(A=lng, B=2)
boundary = BoundarySurfaces(Edges=crv_3)
subtraction = Subtraction(A=division, B=1)
dom = ConstructDomain(DomainStart=0, DomainEnd=subtraction)
crv_5 = Curve(boundary)
subset = SubList(List=num, Domain=dom, Wrap=True)  # -> List, Index
explode = Explode(Curve=crv_5, Recursive=True)  # -> Segments, Vertices
pt = Point(explode.Vertices)
divide = DivideCurve(Curve=crv_4, Count=100, Kinks=False)  # -> Points, Tangents, Parameters
toggle = BooleanToggle(False)  # disabled
data = Data(subset.List)
python = GhPythonScript(pleaserun=pleaserun, constraint=divide.Points, marker=pt, ori=crv_3, ori_len=data, tor=num_2, num=int_2)  # -> out, bakeout, recs, recran, edgelengths, faceareas, file_path; inputs constraint: list of Point3d, marker: list of Point3d, ori: list of Curve, ori_len: list, num: Int32
# ---------- python: Python ----------
__author__ = "Hao"
__version__ = "2021.8.15"

import rhinoscriptsyntax as rs
import scriptcontext as sc
import Rhino
import ghpythonlib.treehelpers as ghtree
import math
import ghpythonlib.components as gh
import random

import clr
import os
import time
clr.AddReferenceToFileAndPath("C:\\PolyFramework\\PolyFramework.dll")

import Rhino.Geometry as rg
import PolyFramework as pf

if pleaserun :
    
    cir = gh.Interpolate(constraint,3,True)[0]
    
    edgelengths = []
    faceareas = []
    
    sc.doc = Rhino.RhinoDoc.ActiveDoc
    rhdoc = Rhino.RhinoDoc.ActiveDoc
    
    rs.Command("_SelLayerNumber "+str(rhdoc.Layers.FindName("_Form_InternalLines").Index))
    primal = pf.PFoam()
    dual = pf.PFoam()
    containerType = pf.ContainerType
    multiData = pf.LoadData.LoadPrimalDual(True)
    guids = multiData[0]
    primal = multiData[1]
    dual = multiData[2]
    containerType = multiData[3]
    geoouttemp = rs.ObjectsByLayer('_Form_ExternalForces')
    geoouttemp = [rs.coercecurve(j) for j in geoouttemp]
    ExternalForcestemp = geoouttemp
    pt1 = gh.EndPoints(ExternalForcestemp)[0]
    pt2 = gh.EndPoints(ExternalForcestemp)[1]
    pt1.extend(pt2)
    ptall = pt1
    result = []
    for i in range(len(ptall)):
        for j in range(len(marker)):
            if rs.Distance(ptall[i],marker[j])<0.01:
                result.append(ptall[i])
                break
    
    countq = [False for i in range(len(primal.Vertices))]
    count = -1
    for vert in primal.Vertices:
        count += 1
        id = vert.Id
        location = vert.Point
        for i in range(len(result)):
            if rs.Distance(result[i],location)<0.01:
                countq[count] = True
                break
    
    stpp = []
    enpp = []
    for i in range(len(ori)):
        temp = gh.EndPoints(ori[i])
        stpp.append(temp[0])
        enpp.append(temp[1])
    count = -1
    countm = [-1 for i in range(len(primal.Edges))]
    internalornot = [False for i in range(len(primal.Edges))]
    for edge in primal.Edges:
        count += 1
        for i in range(len(ori)):
            if (rs.Distance(stpp[i],edge.Vertices[0].Point)<0.01) and (rs.Distance(enpp[i],edge.Vertices[1].Point)<0.01) or (rs.Distance(stpp[i],edge.Vertices[1].Point)<0.01) and (rs.Distance(enpp[i],edge.Vertices[1].Point)<0.01):
                   countm[count] = i
                   internalornot[count] = True
                   break
    
    
    recs = []
    recran = []
    for i in range(num):
        
        ran = [random.random() for j in range(len(ori_len))]
        
        rs.Command("_SelLayerNumber "+str(rhdoc.Layers.FindName("_Form_InternalLines").Index))
        primal = pf.PFoam()
        dual = pf.PFoam()
        containerType = pf.ContainerType
        multiData = pf.LoadData.LoadPrimalDual(True)
        guids = multiData[0]
        primal = multiData[1]
        dual = multiData[2]
        containerType = multiData[3]
        
        pickedVertsup = []
        fixableVerts ={}
        count = -1
        for vert in primal.Vertices:
            count += 1
            id = vert.Id
            location = vert.Point
            if countq[count]==True:
                fixableVerts[location] = vert
                pickedVertsup.append(fixableVerts[location])
                primal.SetVertexConstraints([fixableVerts[location]], cir, 1.0, True)
        
        count = -1
        for edge in primal.Edges:
            count += 1
            if countm[count]!=-1:
               edge.MinLength = (0.5+ran[countm[count]]*1.0)*ori_len[countm[count]]*(1.0-tor)
               edge.MaxLength = (0.5+ran[countm[count]]*1.0)*ori_len[countm[count]]*(1.0+tor)
        
        primal.PerpSoft(maxSteps = 10000)
        #bakeout = pf.PFoam.SaveAsEdges(primal)
        
        edgelengthtemp = []
        faceareatemp = []
        rec = 9999999999999999
        count = -1
        for edge in primal.Edges:
            count += 1
            if (edge.Dual) and (edge.Id>=0):
                if (edge.GetLength()>0) and (edge.Dual.Area>0):
                    if internalornot[count]==True:
                        edgelength = edge.GetLength()
                        facearea = edge.Dual.Area/100
                        edgelengthtemp.append(edgelength)
                        faceareatemp.append(facearea)
                        bk = (facearea*facearea*facearea*facearea*math.pi/4*math.pi*math.pi*200)/(edgelength*edgelength)
                        if bk<rec:
                            print(edge.Id,edgelength,facearea,bk)
                            rec = bk
        recs.append(rec)
        recran.append(ran)
        edgelengths.append(edgelengthtemp)
        faceareas.append(faceareatemp)
        s = ""
        for i in range(len(ran)):
            s += str(ran[i])+","
        s += str(rec)
        with open("C:\AIStructureGenerator\ANN2\data.csv","a") as f:
            f.write(s)
            f.write("\n")
    
    file_path = "C:\AIStructureGenerator\ANN2\data.csv"
    recran = ghtree.list_to_tree(recran)
    edgelengths = ghtree.list_to_tree(edgelengths)
    faceareas = ghtree.list_to_tree(faceareas)
# ---------- end python ----------
python_2 = GhPythonScript(pleaserun=toggle, constraint=divide.Points, marker=pt, ori=crv_3, ori_len=data, tor=num_2, num=int_2)  # -> out, bakeout, recs, recran, edgelengths, faceareas, file_path, a; inputs constraint: list of Point3d, marker: list of Point3d, ori: list of Curve, ori_len: list, num: Int32; disabled
# ---------- python_2: Python ----------
__author__ = "Hao"
__version__ = "2021.8.15"

import rhinoscriptsyntax as rs
import scriptcontext as sc
import Rhino
import ghpythonlib.treehelpers as ghtree
import math
import ghpythonlib.components as gh
import random

import clr
import os
import time
clr.AddReferenceToFileAndPath("C:\\PolyFramework\\PolyFramework.dll")

import Rhino.Geometry as rg
import PolyFramework as pf

if pleaserun :
    
    cir = gh.Interpolate(constraint,3,True)[0]
    
    edgelengths = []
    faceareas = []
    
    sc.doc = Rhino.RhinoDoc.ActiveDoc
    rhdoc = Rhino.RhinoDoc.ActiveDoc
    
    rs.Command("_SelLayerNumber "+str(rhdoc.Layers.FindName("_Form_InternalLines").Index))
    primal = pf.PFoam()
    dual = pf.PFoam()
    containerType = pf.ContainerType
    multiData = pf.LoadData.LoadPrimalDual(True)
    guids = multiData[0]
    primal = multiData[1]
    dual = multiData[2]
    containerType = multiData[3]
    
    a = []
    for edge in primal.Edges:
        if (edge.Dual) and (edge.Id>=0):
            if edge.Id==1886:
                a.append(edge.CreateLine())
# ---------- end python_2 ----------
crv_6 = Curve(python_2.a)  # disabled

# ==== cluster Generate_Structural_Form_2
pleaserun = ClusterInput()
F = ClusterInput()
srf = ClusterInput()
python = GhPythonScript(file_path=F, run=pleaserun)  # -> out, a; inputs run: Boolean; disabled; same code as python
file = ReadFile(File=F, PerLineParse=True)
srf_2 = Surface(srf)
file_2 = ReadFile(File="C:\AIStructureGenerator\ANN2\results.csv", PerLineParse=True)
crv = Curve(srf_2)
num = Number(file)
split = TextSplit(Text=file_2, Separators=",")
crv_2 = ClusterInput()
division = Division(A=num, B=Slider(1, range=0..1))
num_2 = Number(split)
bool = ClusterInput()
crv_3 = Curve(crv_2)
lng = ListLength(List=crv_3)
lng_2 = ListLength(List=division)
dup = DuplicateData(Data=0.5, Number=lng, Order=True)
bool_2 = Boolean(bool)
division_2 = Division(A=lng_2, B=2)
python_2 = GhPythonScript(x=dup, y=num_2, z=bool_2)  # -> out, a; inputs x: list, y: list, z: Boolean; same code as python_2
boundary = BoundarySurfaces(Edges=crv_3)
subtraction = Subtraction(A=division_2, B=1)
crv_4 = Curve(boundary)
dom = ConstructDomain(DomainStart=0, DomainEnd=subtraction)
subset = SubList(List=division, Domain=dom, Wrap=True)  # -> List, Index
explode = Explode(Curve=crv_4, Recursive=True)  # -> Segments, Vertices
num_3 = ClusterInput()
pt = Point(explode.Vertices)
divide = DivideCurve(Curve=crv, Count=100, Kinks=False)  # -> Points, Tangents, Parameters
data = Data(subset.List)
num_4 = Number(num_3)
python_3 = GhPythonScript(
    pleaserun=pleaserun,
    constraint=divide.Points,
    constraint_surf=srf_2,
    marker=pt,
    ori=crv_3,
    ori_len=data,
    tor=num_4,
    ran=python_2.a)  # -> out, bakeout; inputs constraint: list of Point3d, constraint_surf: Surface, marker: list of Point3d, ori: list of Curve, ori_len: list, ran: list
# ---------- python_3: Python ----------
__author__ = "Hao"
__version__ = "2018.1.28"


import rhinoscriptsyntax as rs
import scriptcontext as sc
import Rhino
import ghpythonlib.treehelpers as ghtree
import math
import ghpythonlib.components as gh

import clr
import os
import time
clr.AddReferenceToFileAndPath("C:\\PolyFramework\\PolyFramework.dll")

import Rhino.Geometry as rg
import PolyFramework as pf

if pleaserun :
    
    cir = gh.Interpolate(constraint,3,True)[0]
    
    InternalLines = []
    ExternalForces = []
    ExternalPoly = []
    
    edgelengths = []
    faceareas = []
    lines = []
    mibfs = []
    primals = []
    
    countc = 0
    
    sc.doc = Rhino.RhinoDoc.ActiveDoc
    rhdoc = Rhino.RhinoDoc.ActiveDoc
    rs.Command("_SelLayerNumber "+str(rhdoc.Layers.FindName("_Form_InternalLines").Index))
    primal = pf.PFoam()
    dual = pf.PFoam()
    containerType = pf.ContainerType
    multiData = pf.LoadData.LoadPrimalDual(True)
    guids = multiData[0]
    primal = multiData[1]
    dual = multiData[2]
    containerType = multiData[3]
    geoouttemp = rs.ObjectsByLayer('_Form_ExternalForces')
    geoouttemp = [rs.coercecurve(j) for j in geoouttemp]
    ExternalForcestemp = geoouttemp
    pt1 = gh.EndPoints(ExternalForcestemp)[0]
    pt2 = gh.EndPoints(ExternalForcestemp)[1]
    pt1.extend(pt2)
    ptall = pt1
    result = []
    for i in range(len(ptall)):
        for j in range(len(marker)):
            if rs.Distance(ptall[i],marker[j])<0.01:
                result.append(ptall[i])
                break
    pickedVertsup = []
    fixableVerts ={}
    result2 = []
    for vert in primal.Vertices:
        id = vert.Id
        location = vert.Point
        for i in range(len(result)):
            if rs.Distance(result[i],location)<0.01:
                fixableVerts[location] = vert
                pickedVertsup.append(fixableVerts[location])
                primal.SetVertexConstraints([fixableVerts[location]], cir, 1.0, True)
                result2.append(location)
                break
            else:
                fixableVerts[location] = vert
                pickedVertsup.append(fixableVerts[location])
                primal.SetVertexConstraints([fixableVerts[location]], constraint_surf, 1.0, True)
                result2.append(location)
                
    stpp = []
    enpp = []
    for i in range(len(ori)):
        temp = gh.EndPoints(ori[i])
        stpp.append(temp[0])
        enpp.append(temp[1])
    for edge in primal.Edges:
        for i in range(len(ori)):
            if (rs.Distance(stpp[i],edge.Vertices[0].Point)<0.01) and (rs.Distance(enpp[i],edge.Vertices[1].Point)<0.01) or (rs.Distance(stpp[i],edge.Vertices[1].Point)<0.01) and (rs.Distance(enpp[i],edge.Vertices[1].Point)<0.01):
                   edge.MinLength = (0.5+ran[i]*1.0)*ori_len[i]*(1.0-tor)
                   edge.MaxLength = (0.5+ran[i]*1.0)*ori_len[i]*(1.0+tor)
    
    primal.PerpSoft(maxSteps = 10000)
    bakeout = pf.PFoam.SaveAsEdges(primal)
# ---------- end python_3 ----------

# ==== cluster Get_2D_curve
_3d = ClusterInput()
_3d_2 = Surface(_3d)
area = Area(Geometry=_3d_2)  # -> Area, Centroid
pdecon = Deconstruct(Point=area.Centroid)  # -> XComponent, YComponent, ZComponent
crv = Curve(_3d_2)
pt = ConstructPoint(XCoordinate=pdecon.XComponent, YCoordinate=pdecon.YComponent, ZCoordinate=0)
unroll = UnrollBrep(Brep=_3d_2, JoinUnrolled=False)
xz = XZPlane(Origin=Point(0, 0, 0))
rotate = Rotate(Geometry=unroll, Angle=-1.570796327, Plane=PlaneXY(0, 0, 0))  # -> Geometry, Transform
mirror = Mirror(Geometry=rotate.Geometry, Plane=xz)  # -> Geometry, Transform
area_2 = Area(Geometry=mirror.Geometry)  # -> Area, Centroid
vec2pt = Vector2Pt(PointA=area_2.Centroid, PointB=pt, Unitize=False)  # -> Vector, Length
move = Move(Geometry=mirror.Geometry, Motion=vec2pt.Vector)  # -> Geometry, Transform
crv_2 = Curve(move.Geometry)
crv_3 = ClusterOutput(crv_2)

# ==== cluster Generate_Structural_Form_3
crv = ClusterInput()
num = ClusterInput()
crv_2 = Curve(crv)
num_2 = Number(num)
boundary = BoundarySurfaces(Edges=crv_2)
brec = BoundingRectangle(Geometry=boundary, Plane=PlaneXY(0, 0, 0), Axis=0, Slide=0, Union=True)  # -> Bounding, DimensionX, DimensionY
max = Maximum(A=brec.DimensionX, B=brec.DimensionY)
division = Division(A=max, B=2)
division_2 = Division(A=num_2, B=division)
atan = ArcTangent(Value=division_2)
cos = Cosine(Value=atan)
pleaserun = ClusterInput()
one_over_x = OneOverX(Value=cos)
F = ClusterInput()
crv_3 = ClusterInput()
python = GhPythonScript(file_path=F, run=pleaserun)  # -> out, a; inputs run: Boolean; disabled; same code as python
file = ReadFile(File=F, PerLineParse=True)
file_2 = ReadFile(File="C:\AIStructureGenerator\ANN2\results.csv", PerLineParse=True)
crv_4 = Curve(crv_3)
num_3 = Number(file)
split = TextSplit(Text=file_2, Separators=",")
crv_5 = ClusterInput()
division_3 = Division(A=num_3, B=one_over_x)
num_4 = Number(split)
bool = ClusterInput()
crv_6 = Curve(crv_5)
lng = ListLength(List=crv_6)
explode = Explode(Curve=crv_6, Recursive=True)  # -> Segments, flatten(Vertices)
lng_2 = ListLength(List=division_3)
dup = DuplicateData(Data=0.5, Number=lng, Order=True)
bool_2 = Boolean(bool)
division_4 = Division(A=lng_2, B=2)
duppt = RemoveDuplicatePts(Points=explode.Vertices, Tolerance=0.01)
python_2 = GhPythonScript(x=dup, y=num_4, z=bool_2)  # -> out, a; inputs x: list, y: list, z: Boolean; same code as python_2
boundary_2 = BoundarySurfaces(Edges=crv_6)
subtraction = Subtraction(A=division_4, B=1)
project = Project(Geometry=duppt, Plane=PlaneXY(0, 0, 0))  # -> Geometry, Transform
crv_7 = Curve(boundary_2)
dom = ConstructDomain(DomainStart=0, DomainEnd=subtraction)
incurve = PointInCurve(Point=project.Geometry, Curve=crv_7)  # -> Relationship, Point
subset = SubList(List=division_3, Domain=dom, Wrap=True)  # -> List, Index
equals = Equality(FirstNumber=incurve.Relationship, SecondNumber=1)  # -> Equality, Inequality
num_5 = ClusterInput()
cull = CullPattern(List=duppt, CullPattern=equals.Equality)
pt = Point(cull)
divide = DivideCurve(Curve=crv_4, Count=100, Kinks=False)  # -> Points, Tangents, Parameters
data = Data(subset.List)
num_6 = Number(num_5)
python_3 = GhPythonScript(pleaserun=pleaserun, constraint=divide.Points, marker=pt, ori=crv_6, ori_len=data, tor=num_6, ran=python_2.a)  # -> out, bakeout; inputs constraint: list of Point3d, marker: list of Point3d, ori: list of Curve, ori_len: list, ran: list; same code as python_3

# ==== cluster Generate_Dual_2
crv = ClusterInput()
num = ClusterInput()
crv_2 = Curve(crv)
explode = Explode(Curve=crv_2, Recursive=True)  # -> flatten(Segments), Vertices
num_2 = Number(num)
dupln = RemoveDuplicateLines(Lines=explode.Segments, Tolerance=0.01)
neg = Negative(Value=num_2)
crv_3 = Curve(dupln)
Z = UnitZ(Factor=neg)

grid_divisions = Integer(20)
crv_4 = Curve(simplify(crv_3))
x_bounds = Domain(Domain(1950, 3650))
y_bounds = Domain(Domain(2750, 3550))

dom² = Domain²(DomainU=x_bounds, DomainV=y_bounds)
hem_open_xy_networks = VBScript(seg=crv_4, bnd=dom², sbdv=grid_divisions)  # -> out, flatten(e), flatten(eOV), flatten(ePE), flatten(eNE), flatten(eTE), flatten(eIF), flatten(v)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; inputs seg: list of Curve; same code as hem_open_xy_networks
pline = PolyLine(Vertices=hem_open_xy_networks.f, Closed=True)
flatten = FlattenTree(Tree=pline, Path="{0}")
srf = Surface(flatten)
area = Area(Geometry=srf)  # -> Area, Centroid
sort = SortList(Keys=area.Area, ValuesA=flatten)  # -> Keys, ValuesA
end = EndPoints(Curve=crv_3)  # -> Start, End
boundary = BoundarySurfaces(Edges=crv_3)

# ---- group: make lines to polygons
shift = ShiftList(List=sort.ValuesA, Shift=-1, Wrap=False)

# ----
graft = GraftTree(Tree=shift, IncludeEmptyLists=True, IncludeNullItems=True)
boundary_2 = BoundarySurfaces(Edges=graft)  # -> flatten(Surfaces)
area_2 = Area(Geometry=boundary)  # -> Area, Centroid
move = Move(Geometry=area_2.Centroid, Motion=Z)  # -> Geometry, Transform
division = Division(A=num_2, B=2)
bool = ClusterInput()
Z_2 = UnitZ(Factor=division)
srf4pt = _4PointSurface(CornerA=end.Start, CornerB=end.End, CornerC=move.Geometry)
bool_2 = Boolean(bool)
merge = Merge(Data1=boundary_2, Data2=srf4pt)  # -> flatten(Result)
move_2 = Move(Geometry=merge, Motion=Z_2)  # -> Geometry, Transform
python = GhPythonScript(run=bool_2, geo=move_2.Geometry)  # -> out, Form_InternalLines; inputs geo: list of Brep; same code as python
form_internallines = ClusterOutput(python.Form_InternalLines)

# ==== cluster Cluster_3
crv = ClusterInput()
crv_2 = ClusterInput()
pt = ClusterInput()
crv_3 = Curve(crv)
crv_4 = Curve(crv_2)
pt_2 = Point(pt)
x = ClusterInput()
neg = Negative(Value=x)
cluster = Cluster_2(P=pt_2, G=crv_3, E=crv_4)
Z = UnitZ(Factor=neg)
crv_5 = Curve(crv_4)
num = Number("4000")
move = Move(Geometry=cluster, Motion=Z)  # -> Geometry, Transform
num_2 = ClusterOutput(num)

grid_divisions = Integer(20)
crv_6 = Curve(simplify(crv_5))
x_bounds = Domain(Domain(1950, 3650))
y_bounds = Domain(Domain(2750, 3550))

subtraction = Subtraction(A=x, B="500")
G = ClusterOutput(move.Geometry)
sph = Sphere(Base=move.Geometry, Radius=subtraction)
dom² = Domain²(DomainU=x_bounds, DomainV=y_bounds)
sunion = SolidUnion(Breps=sph)
hem_open_xy_networks = VBScript(seg=crv_6, bnd=dom², sbdv=grid_divisions)  # -> out, flatten(e), flatten(eOV), flatten(ePE), flatten(eNE), flatten(eTE), flatten(eIF), flatten(v)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; inputs seg: list of Curve; same code as hem_open_xy_networks
pline = PolyLine(Vertices=hem_open_xy_networks.f, Closed=True)
flatten = FlattenTree(Tree=pline, Path="{0}")
srf = Surface(flatten)
area = Area(Geometry=srf)  # -> Area, Centroid
sort = SortList(Keys=area.Area, ValuesA=flatten)  # -> Keys, ValuesA
shift = ShiftList(List=sort.ValuesA, Shift=-1, Wrap=False)
neg_2 = Negative(Value="4000")
Z_2 = UnitZ(Factor=neg_2)
srf_2 = Surface(shift)
srf_3 = ClusterOutput(srf_2)
extr = Extrude(Base=srf_2, Direction=Z_2)
split = SplitBrep(Brep=extr, Cutter=sunion)
item = ListItem(List=split, Index=0, Wrap=True)  # -> flatten(Item)
debrep = DeconstructBrep(Brep=item)  # -> Faces, Edges, Vertices
pdecon = Deconstruct(Point=debrep.Vertices)  # -> XComponent, YComponent, ZComponent
abs = Absolute(Value=pdecon.ZComponent)
larger = LargerThan(FirstNumber=abs, SecondNumber=0.01)  # -> LargerThan, OrEqualTo
smaller = SmallerThan(FirstNumber=abs, SecondNumber=0.01)  # -> SmallerThan, OrEqualTo
cull = CullPattern(List=debrep.Vertices, CullPattern=smaller.SmallerThan)  # -> simplify(List)
pdecon_2 = Deconstruct(Point=cull)  # -> XComponent, YComponent, ZComponent
pdecon_3 = Deconstruct(Point=debrep.Vertices)  # -> XComponent, YComponent, ZComponent
pt_3 = ConstructPoint(XCoordinate=pdecon_2.XComponent, YCoordinate=pdecon_2.YComponent, ZCoordinate=0)  # -> flatten(Point)
pt_4 = ConstructPoint(XCoordinate=pdecon_3.XComponent, YCoordinate=pdecon_3.YComponent, ZCoordinate=0)
cp = ClosestPoint(Point=pt_4, Cloud=pt_3)  # -> ClosestPoint, CPIndex, Distance
smaller_2 = SmallerThan(FirstNumber=cp.Distance, SecondNumber=0.01)  # -> SmallerThan, OrEqualTo
and = GateAnd(A=larger.LargerThan, B=smaller_2.SmallerThan)
cull_2 = CullPattern(List=debrep.Vertices, CullPattern=and)  # -> simplify(List)
anchorxyz = AnchorXYZ(Point=cull_2, X=True, Y=True, Z=False, Strength=1000)  # -> flatten(A)
coplanar = CoPlanar(Points=cull_2, Strength=1)  # -> flatten(Coplanar)
pdecon_4 = Deconstruct(Point=cull_2)  # -> XComponent, YComponent, ZComponent
pt_5 = ConstructPoint(XCoordinate=pdecon_4.XComponent, YCoordinate=pdecon_4.YComponent, ZCoordinate=0)
merge = Merge(Data1=coplanar, Data2=anchorxyz)
R = ClusterOutput(merge)
pt_6 = ClusterOutput(pt_5)

# ==== cluster Cluster_4
P = ClusterInput()
pdecon = Deconstruct(Point=P)  # -> XComponent, YComponent, ZComponent
pt = ConstructPoint(XCoordinate=pdecon.XComponent, YCoordinate=pdecon.YComponent, ZCoordinate=0)
P_2 = ClusterInput()
cp = ClosestPoint(Point=P_2, Cloud=pt)  # -> ClosestPoint, CPIndex, Distance
item = ListItem(List=P, Index=cp.CPIndex, Wrap=True)
pline = PolyLine(Vertices=item, Closed=True)
F = ClusterInput()
srf = Surface(flatten(pline))
Z = UnitZ(Factor=F)
crv = Curve(srf)
extr = Extrude(Base=srf, Direction=Z)
brec = BoundingRectangle(Geometry=extr, Plane=PlaneXY(0, 0, 0), Axis=0, Slide=0, Union=True)  # -> Bounding, DimensionX, DimensionY
explode = Explode(Curve=brec.Bounding, Recursive=True)  # -> Segments, Vertices
explode_2 = Explode(Curve=crv, Recursive=True)  # -> flatten(Segments), Vertices
pdecon_2 = Deconstruct(Point=explode.Vertices)  # -> XComponent, YComponent, ZComponent
pt_2 = ConstructPoint(XCoordinate=pdecon_2.XComponent, YCoordinate=pdecon_2.YComponent, ZCoordinate=0)
dupln = RemoveDuplicateLines(Lines=explode_2.Segments, Tolerance=0.01)
pln = Plane(brec.Bounding)
G = ClusterInput()
pline_2 = PolyLine(Vertices=pt_2, Closed=True)
project = Project(Geometry=crv, Plane=pln)  # -> Geometry, Transform

project_2 = Project(Geometry=dupln, Plane=pln)  # -> Geometry, Transform
project_3 = Project(Geometry=G, Plane=pln)  # -> Geometry, Transform

srf_2 = Surface(pline_2)
srf_3 = ClusterInput()
boundary = BoundarySurfaces(Edges=project_2.Geometry)
extr_2 = Extrude(Base=srf_2, Direction=Z)
split = SplitBrep(Brep=extr, Cutter=extr_2)
item_2 = ListItem(List=split, Index=0, Wrap=True)  # -> flatten(Item)
srf_4 = Surface(srf_3)
Z_2 = UnitZ(Factor=1)
crv_2 = Curve(boundary)
extr_3 = Extrude(Base=boundary, Direction=Z_2)
division = Division(A=Z_2, B=2)
merge = Merge(Data1=item_2, Data2=srf_4)  # -> flatten(Result)
voronoi = Voronoi(Points=project_3.Geometry, BruteForceOverride=False)
explode_3 = Explode(Curve=crv_2, Recursive=True)  # -> flatten(Segments), Vertices
neg = Negative(Value=division)
move = Move(Geometry=extr_3, Motion=neg)  # -> Geometry, Transform
trim = TrimWithBrep(Curve=voronoi, Brep=move.Geometry)  # -> Inside, Outside
crv_3 = Curve(flatten(trim.Inside))
explode_4 = Explode(Curve=crv_3, Recursive=True)  # -> flatten(Segments), Vertices
dupln_2 = RemoveDuplicateLines(Lines=explode_4.Segments, Tolerance=0.01)
end = EndPoints(Curve=dupln_2)  # -> Start, End
cp_2 = ClosestPoint(Point=end.Start, Cloud=explode_3.Vertices)  # -> ClosestPoint, CPIndex, Distance
cp_3 = ClosestPoint(Point=end.End, Cloud=explode_3.Vertices)  # -> ClosestPoint, CPIndex, Distance
graft = GraftTree(Tree=cp_2.ClosestPoint, IncludeEmptyLists=True, IncludeNullItems=True)
graft_2 = GraftTree(Tree=cp_3.ClosestPoint, IncludeEmptyLists=True, IncludeNullItems=True)
crv_cp = CurveClosestPoint(Point=end.Start, Curve=crv_2)  # -> Point, Parameter, Distance
crv_cp_2 = CurveClosestPoint(Point=end.End, Curve=crv_2)  # -> Point, Parameter, Distance
graft_3 = GraftTree(Tree=end.Start, IncludeEmptyLists=True, IncludeNullItems=True)
graft_4 = GraftTree(Tree=end.End, IncludeEmptyLists=True, IncludeNullItems=True)
smaller = SmallerThan(FirstNumber=crv_cp_2.Distance, SecondNumber=0.01)  # -> SmallerThan, OrEqualTo
smaller_2 = SmallerThan(FirstNumber=crv_cp.Distance, SecondNumber=0.01)  # -> SmallerThan, OrEqualTo
merge_2 = Merge(Data1=graft_3, Data2=graft)  # -> simplify(Result)
merge_3 = Merge(Data1=graft_4, Data2=graft_2)  # -> simplify(Result)
graft_5 = GraftTree(Tree=smaller.SmallerThan, IncludeEmptyLists=True, IncludeNullItems=True)
graft_6 = GraftTree(Tree=smaller_2.SmallerThan, IncludeEmptyLists=True, IncludeNullItems=True)
item_3 = ListItem(List=merge_2, Index=graft_6, Wrap=True)
item_4 = ListItem(List=merge_3, Index=graft_5, Wrap=True)
ln = Line(StartPoint=item_3, EndPoint=item_4)
merge_4 = Merge(Data1=ln, Data2=explode_3.Segments)  # -> flatten(Result)

grid_divisions = Integer(20)
crv_4 = Curve(simplify(merge_4))
x_bounds = Domain(Domain(1950, 3650))
y_bounds = Domain(Domain(2750, 3550))

dom² = Domain²(DomainU=x_bounds, DomainV=y_bounds)
hem_open_xy_networks = VBScript(seg=crv_4, bnd=dom², sbdv=grid_divisions)  # -> out, flatten(e), flatten(eOV), flatten(ePE), flatten(eNE), flatten(eTE), flatten(eIF), flatten(v)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; inputs seg: list of Curve; same code as hem_open_xy_networks
pline_3 = PolyLine(Vertices=hem_open_xy_networks.f, Closed=True)
flatten = FlattenTree(Tree=pline_3, Path="{0}")
srf_5 = Surface(flatten)
area = Area(Geometry=srf_5)  # -> Area, Centroid
sort = SortList(Keys=area.Area, ValuesA=flatten)  # -> Keys, ValuesA
area_2 = Area(Geometry=project.Geometry)  # -> Area, Centroid
shift = ShiftList(List=sort.ValuesA, Shift=-1, Wrap=False)
Z_3 = UnitZ(Factor="-500")
incurves = PointInCurves(Point=area_2.Centroid, Curves=shift)  # -> Relationship, Index, Point
python = GhPythonScript(x=incurves.Index, y=project.Geometry, z=crv)  # -> out, a, b; inputs x: list of Int32, y: list of Curve, z: list of Curve
# ---------- python: Python ----------
__author__ = "Platina"
__version__ = "2021.09.13"

import rhinoscriptsyntax as rs
import ghpythonlib.treehelpers as ghtree
import ghpythonlib.components as gh

a = [[] for i in range(max(x)+1)]
b = [[] for i in range(max(x)+1)]
for i in range(len(x)):
    a[x[i]].extend(gh.Explode(y[i],True)[0])
    b[x[i]].extend(gh.Explode(z[i],True)[0])

a = ghtree.list_to_tree(a)
b = ghtree.list_to_tree(b)
# ---------- end python ----------
dupln_3 = RemoveDuplicateLines(Lines=python.b, Tolerance=0.01)
dupln_4 = RemoveDuplicateLines(Lines=python.a, Tolerance=0.01)
wbweave = WeaverbirdsMeshFromLinesWeaveBack(Lines=dupln_3, MaximumValence=10)
curvepoint = PointOnCurve(explode_2.Segments, parameter=0.5)
wbweave_2 = WeaverbirdsMeshFromLinesWeaveBack(Lines=dupln_4, MaximumValence=10)
wbnaked = WeaverbirdsNakedBoundary(MeshClosedPolylines=wbweave)  # -> flatten(NakedCurves)
explode_5 = Explode(Curve=wbnaked, Recursive=True)  # -> Segments, Vertices
move_2 = Move(Geometry=wbnaked, Motion=Z_3)  # -> Geometry, Transform
extr_4 = Extrude(Base=explode_5.Segments, Direction=Z_3)
explode_6 = Explode(Curve=wbnaked, Recursive=True)  # -> Segments, Vertices
explode_7 = Explode(Curve=move_2.Geometry, Recursive=True)  # -> Segments, Vertices
del = DelaunayMesh(Points=explode_7.Vertices, Plane=PlaneXY(0, 0, 0))
explode_8 = MeshExplode(Mesh=del, Interpolate=False)
wbnaked_2 = WeaverbirdsNakedBoundary(MeshClosedPolylines=wbweave_2)  # -> flatten(NakedCurves)
explode_9 = Explode(Curve=wbnaked_2, Recursive=True)  # -> Segments, Vertices
rulesrf = RuledSurface(CurveA=explode_9.Segments, CurveB=explode_6.Segments)  # -> flatten(Surface)
srf_6 = Surface(wbnaked_2)
merge_5 = Merge(Data1=merge, Data2=rulesrf, Data3=srf_6)
pdecon_3 = Deconstruct(Point=curvepoint)  # -> XComponent, YComponent, ZComponent
area_3 = Area(Geometry=explode_8)  # -> Area, simplify(Centroid)
graft_7 = GraftTree(Tree=wbnaked_2, IncludeEmptyLists=True, IncludeNullItems=True)  # -> simplify(Tree)
pt_3 = ConstructPoint(XCoordinate=pdecon_3.XComponent, YCoordinate=pdecon_3.YComponent, ZCoordinate=0)
area_4 = Area(Geometry=wbnaked_2)  # -> Area, Centroid
incurve = PointInCurve(Point=area_3.Centroid, Curve=graft_7)  # -> Relationship, Point
explode_10 = Explode(Curve=wbnaked_2, Recursive=True)  # -> Segments, Vertices
explode_11 = Explode(Curve=wbnaked_2, Recursive=True)  # -> simplify(flatten(Segments)), Vertices
curvepoint_2 = PointOnCurve(explode_11.Segments, parameter=0.5)
pdecon_4 = Deconstruct(Point=curvepoint_2)  # -> XComponent, YComponent, ZComponent
pt_4 = ConstructPoint(XCoordinate=pdecon_4.XComponent, YCoordinate=pdecon_4.YComponent, ZCoordinate=0)
cps = ClosestPoints(Point=pt_3, Cloud=pt_4, Count=2)  # -> ClosestPoint, CPIndex, Distance
graft_8 = GraftTree(Tree=area_4.Centroid, IncludeEmptyLists=True, IncludeNullItems=True)
lng = ListLength(List=explode_10.Segments)
smaller_3 = SmallerThan(FirstNumber=cps.Distance, SecondNumber=0.01)  # -> SmallerThan, OrEqualTo
equals = Equality(FirstNumber=incurve.Relationship, SecondNumber=2)  # -> Equality, Inequality
dup = DuplicateData(Data=graft_8, Number=lng, Order=True)  # -> flatten(Data)
cull = CullPattern(List=cps.CPIndex, CullPattern=smaller_3.SmallerThan)
cull_2 = CullPattern(List=explode_8, CullPattern=equals.Equality)
graft_9 = GraftTree(Tree=explode_2.Segments, IncludeEmptyLists=True, IncludeNullItems=True)
item_5 = ListItem(List=dup, Index=cull, Wrap=True)
flatten_2 = FlattenTree(Tree=cull_2, Path="{0}")
end_2 = EndPoints(Curve=graft_9)  # -> Start, End
wbnaked_3 = WeaverbirdsNakedBoundary(MeshClosedPolylines=flatten_2)
srf_7 = Surface(wbnaked_3)
srf4pt = _4PointSurface(CornerA=end_2.Start, CornerB=end_2.End, CornerC=item_5)
merge_6 = Merge(Data1=merge, Data2=srf_7, Data3=extr_4)  # -> flatten(Result)
R = ClusterOutput(merge_6)

# ==== cluster Cluster_5
crv = ClusterInput()
crv_2 = ClusterInput()
num = ClusterInput()
pt = ClusterInput()
pleaserun = ClusterInput()
crv_3 = Curve(crv)
crv_4 = Curve(crv_2)
num_2 = Number(num)
pt_2 = Point(pt)
Z = UnitZ(Factor=num_2)
multiplication = Multiplication(A=Z, B=2)
neg = Negative(Value=Z)
extr = Extrude(Base=crv_3, Direction=multiplication)
move = Move(Geometry=extr, Motion=neg)  # -> Geometry, Transform
lng = ListLength(List=pt_2)
crv_5 = Curve(crv_4)
explode = Explode(Curve=crv_5, Recursive=True)  # -> Segments, flatten(Vertices)
subtraction = Subtraction(A=lng, B=1)
duppt = RemoveDuplicatePts(Points=explode.Vertices, Tolerance=0.01)
dom = ConstructDomain(DomainStart=0, DomainEnd=subtraction)
boundary = BoundarySurfaces(Edges=crv_5)
pdecon = Deconstruct(Point=duppt)  # -> XComponent, YComponent, ZComponent
project = Project(Geometry=duppt, Plane=PlaneXY(0, 0, 0))  # -> Geometry, Transform
crv_6 = Curve(boundary)
sort = SortList(Keys=pdecon.ZComponent, ValuesA=duppt)  # -> Keys, ValuesA
incurve = PointInCurve(Point=project.Geometry, Curve=crv_6)  # -> Relationship, Point
item = ListItem(List=sort.Keys, Index=0, Wrap=True)
equals = Equality(FirstNumber=incurve.Relationship, SecondNumber=1)  # -> Equality, Inequality
subset = SubList(List=sort.ValuesA, Domain=dom, Wrap=True)  # -> List, Index
cull = CullPattern(List=duppt, CullPattern=equals.Equality)
Z_2 = UnitZ(Factor=item)
pt_3 = Point(cull)
move_2 = Move(Geometry=pt_2, Motion=Z_2)  # -> Geometry, Transform
python = GhPythonScript(pleaserun=pleaserun, constraint=move.Geometry, marker=pt_3, constraint2=move_2.Geometry, marker2=subset.List)  # -> out, bakeout; inputs constraint: Brep, marker: list of Point3d, constraint2: list of Point3d, marker2: list of Point3d
# ---------- python: Python ----------
__author__ = "Hao"
__version__ = "2018.1.28"


import rhinoscriptsyntax as rs
import scriptcontext as sc
import Rhino
import ghpythonlib.treehelpers as ghtree
import math
import ghpythonlib.components as gh

import clr
import os
import time
clr.AddReferenceToFileAndPath("C:\\PolyFramework\\PolyFramework.dll")

import Rhino.Geometry as rg
import PolyFramework as pf

def searchconma(k,l):
    if k>=len(result):
        global mind
        global comp
        d = 0
        for i in range(len(l)):
            d += rs.Distance(result[i],constraint2[l[i]])
        if d<mind:
            mind = d
            comp = l
        else:
            pass
    else:
        for i in range(len(result)):
            if not (i in l):
                ll = l+[i]
                searchconma(k+1,ll)

if pleaserun :
    
    cir = constraint
    
    InternalLines = []
    ExternalForces = []
    ExternalPoly = []
    
    edgelengths = []
    faceareas = []
    lines = []
    mibfs = []
    primals = []
    
    countc = 0
    
    sc.doc = Rhino.RhinoDoc.ActiveDoc
    rhdoc = Rhino.RhinoDoc.ActiveDoc
    rs.Command("_SelLayerNumber "+str(rhdoc.Layers.FindName("_Form_InternalLines").Index))
    primal = pf.PFoam()
    dual = pf.PFoam()
    containerType = pf.ContainerType
    multiData = pf.LoadData.LoadPrimalDual(True)
    guids = multiData[0]
    primal = multiData[1]
    dual = multiData[2]
    containerType = multiData[3]
    geoouttemp = rs.ObjectsByLayer('_Form_ExternalForces')
    geoouttemp = [rs.coercecurve(j) for j in geoouttemp]
    ExternalForcestemp = geoouttemp
    pt1 = gh.EndPoints(ExternalForcestemp)[0]
    pt2 = gh.EndPoints(ExternalForcestemp)[1]
    pt1.extend(pt2)
    ptall = pt1
    
    result = []
    for i in range(len(ptall)):
        for j in range(len(marker)):
            if rs.Distance(ptall[i],marker[j])<0.01:
                result.append(ptall[i])
                break
    pickedVertsup = []
    fixableVerts ={}
    result2 = []
    for vert in primal.Vertices:
        id = vert.Id
        location = vert.Point
        for i in range(len(result)):
            if rs.Distance(result[i],location)<0.01:
                fixableVerts[location] = vert
                pickedVertsup.append(fixableVerts[location])
                primal.SetVertexConstraints([fixableVerts[location]], cir, 10000.0, True)
                result2.append(location)
                break
    #print(result2)
    
    result = []
    for i in range(len(ptall)):
        for j in range(len(marker2)):
            if rs.Distance(ptall[i],marker2[j])<0.01:
                result.append(ptall[i])
                break
    result = gh.Kangaroo2Component.removeDuplicatePts(result)
    
    comp = []
    mind = 999999999999999999
    global mind
    global comp
    searchconma(0,[])
    #print(comp)
    
    pickedVertsup = []
    fixableVerts ={}
    result2 = []
    for vert in primal.Vertices:
        id = vert.Id
        location = vert.Point
        for i in range(len(result)):
            if rs.Distance(result[i],location)<0.01:
                fixableVerts[location] = vert
                pickedVertsup.append(fixableVerts[location])
                primal.SetVertexConstraints([fixableVerts[location]], rs.coercegeometry(rs.AddPoint(constraint2[comp[i]])), 10000.0, True)
                result2.append(location)
                break
    #print(result2)
    
    primal.PerpSoft(maxSteps = 10000)
    bakeout = pf.PFoam.SaveAsEdges(primal)
# ---------- end python ----------

# ==== cluster Cluster_6
crv = ClusterInput()
crv_2 = ClusterInput()
crv_3 = Curve(crv)
crv_4 = Curve(crv_2)
graft = GraftTree(Tree=crv_3, IncludeEmptyLists=True, IncludeNullItems=True)
ccx = CurveCurve(CurveA=crv_4, CurveB=crv_3)  # -> Points, ParamsA, ParamsB
ptstrimcrv = PointsTrimCurve(Curve=graft, Points=ccx.Points, Flip=True)  # -> Trimmed, SubDomains, Intersected
flatten = FlattenTree(Tree=ccx.Points, Path="{0}")
end = EndPoints(Curve=ptstrimcrv.Trimmed)  # -> Start, End
ptstrimcrv_2 = PointsTrimCurve(Curve=crv_4, Points=flatten, Flip=True)  # -> Trimmed, SubDomains, Intersected
curvepoint = PointOnCurve(ptstrimcrv.Trimmed, parameter=0.5)
pt = Point(end.Start)
merge = Merge(Data1=ptstrimcrv.Trimmed, Data2=ptstrimcrv_2.Trimmed)  # -> flatten(Result)
vec2pt = Vector2Pt(PointA=curvepoint, PointB=pt, Unitize=False)  # -> Vector, Length
Y = UnitY(Factor=1)
angle = Angle(VectorA=vec2pt.Vector, VectorB=Y)  # -> Angle, Reflex
join = JoinCurves(Curves=merge, Preserve=False)
xprod = CrossProduct(VectorA=vec2pt.Vector, VectorB=Y, Unitize=False)  # -> Vector, Length
subtraction = Subtraction(A=6.283185307, B=angle.Angle)
C = ClusterOutput(join)
pdecon = Deconstruct(Point=xprod.Vector)  # -> XComponent, YComponent, ZComponent
merge_2 = Merge(Data1=subtraction, Data2=angle.Angle)
larger = LargerThan(FirstNumber=pdecon.ZComponent, SecondNumber=0)  # -> LargerThan, OrEqualTo
item = ListItem(List=merge_2, Index=larger.LargerThan, Wrap=True)
rotate = Rotate(Geometry=join, Angle=item, Plane=curvepoint)  # -> Geometry, Transform
num = Number(flatten(item))
crv_5 = Curve(flatten(rotate.Geometry))
pt_2 = Point(flatten(curvepoint))
pt_3 = ClusterOutput(pt_2)
num_2 = ClusterOutput(num)
crv_6 = ClusterOutput(crv_5)

# ==== cluster Cluster_7
data = ClusterInput()
data_2 = Data(data)
null = NullItem(Item=data_2)  # -> NullFlags, InvalidFlags, Description
not = GateNot(A=null.NullFlags)
A = ClusterInput()
P = ClusterInput()
cull = CullPattern(List=data_2, CullPattern=not)
rotate = Rotate(Geometry=cull, Angle=A, Plane=P)  # -> Geometry, Transform
ungroup = Ungroup(Group=rotate.Geometry)
G = ClusterOutput(rotate.Geometry)
boundary = BoundarySurfaces(Edges=flatten(ungroup))
end = EndPoints(Curve=ungroup)  # -> Start, End
explode = Explode(Curve=boundary, Recursive=True)  # -> Segments, Vertices
merge = Merge(Data1=end.Start, Data2=end.End)  # -> flatten(Result)
duppt = RemoveDuplicatePts(Points=merge, Tolerance=50)
del = DelaunayMesh(Points=duppt, Plane=PlaneXY(0, 0, 0))
wbedges = WeaverbirdsMeshEdges(MeshOrPolylines=del)
curvepoint = PointOnCurve(wbedges, parameter=0.5)
incurve = PointInCurve(Point=curvepoint, Curve=boundary)  # -> Relationship, Point
equals = Equality(FirstNumber=incurve.Relationship, SecondNumber=0)  # -> Equality, Inequality
cull_2 = CullPattern(List=wbedges, CullPattern=equals.Inequality)
merge_2 = Merge(Data1=cull_2, Data2=explode.Segments)  # -> flatten(Result)
dupln = RemoveDuplicateLines(Lines=merge_2, Tolerance=0.01)
splitcurves = PythonScript(curves=dupln, tolerance=Slider(0.001, range=0..0.001))  # -> out, pieces; inputs curves: list of Curve; same code as splitcurves
dupln_2 = RemoveDuplicateLines(Lines=splitcurves.pieces, Tolerance=0.01)
len = Length(Curve=dupln_2)
larger = LargerThan(FirstNumber=len, SecondNumber=0.01)  # -> LargerThan, OrEqualTo
grid_divisions = Integer(20)
x_bounds = Domain(Domain(1950, 3650))
y_bounds = Domain(Domain(2750, 3550))
dom² = Domain²(DomainU=x_bounds, DomainV=y_bounds)
cull_3 = CullPattern(List=dupln_2, CullPattern=larger.LargerThan)
crv = Curve(cull_3)
crv_2 = Curve(simplify(crv))
hem_open_xy_networks = VBScript(seg=crv_2, bnd=dom², sbdv=grid_divisions)  # -> out, flatten(e), flatten(eOV), flatten(ePE), flatten(eNE), flatten(eTE), flatten(eIF), flatten(v)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; inputs seg: list of Curve; same code as hem_open_xy_networks
pline = PolyLine(Vertices=hem_open_xy_networks.f, Closed=True)
flatten = FlattenTree(Tree=pline, Path="{0}")
srf = Surface(flatten)
area = Area(Geometry=srf)  # -> Area, Centroid
sort = SortList(Keys=area.Area, ValuesA=flatten)  # -> Keys, ValuesA
shift = ShiftList(List=sort.ValuesA, Shift=-1, Wrap=False)
explode_2 = Explode(Curve=shift, Recursive=True)  # -> Segments, simplify(Vertices)
shift_2 = ShiftList(List=explode_2.Vertices, Shift=1, Wrap=False)  # -> simplify(List)
path_mapper = PathMapper(shift_2, source="{a}", target="{0;a}")
pt = Point(path_mapper)

# ---- group: 迭代更新凹多边形顶点
python = GhPythonScript(pts=pt)  # -> out, a, count, loops; inputs pts: tree of Point3d; same code as python_20

# ----
pline_2 = PolyLine(Vertices=python.a, Closed=True)  # -> flatten(Polyline)
explode_3 = Explode(Curve=pline_2, Recursive=True)  # -> flatten(Segments), Vertices
dupln_3 = RemoveDuplicateLines(Lines=explode_3.Segments, Tolerance=0.01)
Q = ClusterOutput(dupln_3)

# ==== cluster Cluster
curves = ClusterInput()
end = EndPoints(Curve=curves)  # -> Start, End
merge = Merge(Data1=end.Start, Data2=end.End)
duppt = RemoveDuplicatePts(Points=merge, Tolerance=0.01)
cps = ClosestPoints(Point=duppt, Cloud=merge, Count=3)  # -> ClosestPoint, CPIndex, Distance
smaller = SmallerThan(FirstNumber=cps.Distance, SecondNumber=0.01)  # -> SmallerThan, OrEqualTo
ma = MassAddition(Input=smaller.SmallerThan)  # -> Result, PartialResults
equals = Equality(FirstNumber=ma.Result, SecondNumber=2)  # -> flatten(Equality), Inequality
cull = CullPattern(List=duppt, CullPattern=equals.Equality)
flatten = FlattenTree(Tree=ma.Result, Path="{0}")
python = GhPythonScript(curves=curves, pts=cull, run=Toggle(True))  # -> out, curves; inputs curves: list of Curve, pts: list of Point3d, run: Boolean
# ---------- python: Python ----------
__author__ = "Platina"
__version__ = "2021.07.25"

import rhinoscriptsyntax as rs
import ghpythonlib.components as gh

if run:
    for i in range(len(pts)):
        d = gh.CurveClosestPoint(pts[i],curves)[2]
        t = []
        c = []
        curves_new = []
        for j in range(len(d)):
            if d[j]<0.01:
                t.append(j)
                c.append(curves[j])
            else:
                curves_new.append(curves[j])
        curves = curves_new
        c = gh.JoinCurves(c,False)
        curves.append(gh.Line(gh.EndPoints(c)[0],gh.EndPoints(c)[1]))
# ---------- end python ----------
dupln = RemoveDuplicateLines(Lines=python.curves, Tolerance=0.01)
end_2 = EndPoints(Curve=dupln)  # -> Start, End
merge_2 = Merge(Data1=end_2.Start, Data2=end_2.End)
duppt_2 = RemoveDuplicatePts(Points=merge_2, Tolerance=0.01)
cps_2 = ClosestPoints(Point=duppt_2, Cloud=merge_2, Count=3)  # -> ClosestPoint, CPIndex, Distance
smaller_2 = SmallerThan(FirstNumber=cps_2.Distance, SecondNumber=0.01)  # -> SmallerThan, OrEqualTo
ma_2 = MassAddition(Input=smaller_2.SmallerThan)  # -> Result, PartialResults
equals_2 = Equality(FirstNumber=ma_2.Result, SecondNumber=1)  # -> flatten(Equality), Inequality
cull_2 = CullPattern(List=duppt_2, CullPattern=equals_2.Equality)
flatten_2 = FlattenTree(Tree=ma_2.Result, Path="{0}")
graft = GraftTree(Tree=dupln, IncludeEmptyLists=True, IncludeNullItems=True)
crv_cp = CurveClosestPoint(Point=cull_2, Curve=graft)  # -> Point, Parameter, Distance
smaller_3 = SmallerThan(FirstNumber=crv_cp.Distance, SecondNumber=0.01)  # -> SmallerThan, OrEqualTo
ma_3 = MassAddition(Input=smaller_3.SmallerThan)  # -> flatten(Result), PartialResults
equals_3 = Equality(FirstNumber=ma_3.Result, SecondNumber=0)  # -> Equality, Inequality
nullrep = ReplaceNulls(Items=equals_3.Equality, Replacements=True)  # -> Items, Count
cull_3 = CullPattern(List=dupln, CullPattern=nullrep.Items)
L = ClusterOutput(cull_3)

# ==== cluster Remove1
C = ClusterInput()
end = EndPoints(Curve=C)  # -> Start, End
weave = Weave(Pattern=[0, 1], Stream0=end.Start, Stream1=end.End, NullGaps=False)
cps = ClosestPoints(Point=weave, Cloud=weave, Count=2)  # -> ClosestPoint, CPIndex, Distance
ma = MassAddition(Input=cps.Distance)  # -> flatten(Result), PartialResults
smaller = SmallerThan(FirstNumber=ma.Result, SecondNumber=0.01)  # -> SmallerThan, OrEqualTo
python = GhPythonScript(pd=smaller.SmallerThan, pts=weave)  # -> out, pts; inputs pd: list of Boolean, pts: list of Point3d
# ---------- python: Python ----------
__author__ = "Platina"
__version__ = "2021.08.09"

import rhinoscriptsyntax as rs

count = 1
while count!=0:
    count = 0
    for i in range(len(pd)):
        if pd[i]==False:
            count += 1
            pd[i] = True
            j = rs.PointCloudClosestPoints(pts,[pts[i]],10000)[0][1]
            pts[i] = pts[j]
# ---------- end python ----------
dispatch = Dispatch(List=python.pts, DispatchPattern=[True, False])  # -> ListA, ListB
ln = Line(StartPoint=dispatch.ListA, EndPoint=dispatch.ListB)
len = Length(Curve=ln)
larger = LargerThan(FirstNumber=len, SecondNumber=0.01)  # -> LargerThan, OrEqualTo
cull = CullPattern(List=ln, CullPattern=larger.LargerThan)
dupln = RemoveDuplicateLines(Lines=cull, Tolerance=0.01)
crv = Curve(dupln)
crv_2 = ClusterOutput(crv)

# ==== cluster Remove2
C = ClusterInput()
end = EndPoints(Curve=C)  # -> Start, End
weave = Weave(Pattern=[0, 1], Stream0=end.Start, Stream1=end.End, NullGaps=False)
cps = ClosestPoints(Point=weave, Cloud=weave, Count=3)  # -> ClosestPoint, CPIndex, Distance
item = ListItem(List=cps.Distance, Index=2, Wrap=True)  # -> flatten(Item)
smaller = SmallerThan(FirstNumber=item, SecondNumber=0.01)  # -> SmallerThan, OrEqualTo
python = GhPythonScript(pd=smaller.SmallerThan, pts=weave)  # -> out, pts, pd; inputs pd: list of Boolean, pts: list of Point3d
# ---------- python: Python ----------
__author__ = "Platina"
__version__ = "2021.08.09"

import rhinoscriptsyntax as rs

count = 1
while count!=0:
    count = 0
    for i in range(len(pd)):
        if pd[i]==False:
            count += 1
            pd[i] = True
            j = rs.PointCloudClosestPoints(pts,[pts[i]],10000)[0][2]
            pts[i] = pts[j]
# ---------- end python ----------
dispatch = Dispatch(List=python.pts, DispatchPattern=[True, False])  # -> ListA, ListB
ln = Line(StartPoint=dispatch.ListA, EndPoint=dispatch.ListB)
len = Length(Curve=ln)
larger = LargerThan(FirstNumber=len, SecondNumber=0.01)  # -> LargerThan, OrEqualTo
cull = CullPattern(List=ln, CullPattern=larger.LargerThan)
dupln = RemoveDuplicateLines(Lines=cull, Tolerance=0.01)
crv = Curve(dupln)
crv_2 = ClusterOutput(crv)

# ==== cluster Cluster_2
G = ClusterInput()
E = ClusterInput()
P = ClusterInput()
brec = BoundingRectangle(Geometry=G, Plane=PlaneXY(0, 0, 0), Axis=0, Slide=0, Union=True)  # -> Bounding, DimensionX, DimensionY
pdecon = Deconstruct(Point=P)  # -> XComponent, YComponent, ZComponent
boundary = BoundarySurfaces(Edges=E)
explode = Explode(Curve=brec.Bounding, Recursive=True)  # -> Segments, Vertices
item = ListItem(List=explode.Vertices, Index=0, Wrap=True)  # -> Item, Item1, Item2
pdecon_2 = Deconstruct(Point=item.Item)  # -> XComponent, YComponent, ZComponent
pdecon_3 = Deconstruct(Point=item.Item2)  # -> XComponent, YComponent, ZComponent
subtraction = Subtraction(A=pdecon.YComponent, B=pdecon_2.YComponent)
subtraction_2 = Subtraction(A=pdecon.XComponent, B=pdecon_2.XComponent)
subtraction_3 = Subtraction(A=pdecon_3.XComponent, B=pdecon_2.XComponent)
subtraction_4 = Subtraction(A=pdecon_3.YComponent, B=pdecon_2.YComponent)
division = Division(A=subtraction_2, B=subtraction_3)
division_2 = Division(A=subtraction, B=subtraction_4)
pt = ConstructPoint(XCoordinate=division, YCoordinate=division_2, ZCoordinate=0)
evalsrf = EvaluateSurface(Surface=reparameterize(boundary), Point=pt)  # -> Point, Normal, UDirection, VDirection, Frame
pt_2 = Point(evalsrf.Point)
pt_3 = ClusterOutput(pt_2)
